# Grasshopper definition Tinyhouse Generator.gh (Grasshopper 1.0.7)
# plug-ins: Magnetizing_FPG, Sasquatch, Pufferfish, PlanFinderGH

# ---- group: Input Parameter
azimutrichtungeingang = Slider(90, range=0..360)
raumhöhe = Slider(2.5, range=2.5..4)
breitengrad = Slider(49.8728, range=-90..90)
längengrad = Slider(8.6512, range=-180..180)
raumhöhe_2 = GetNumber(raumhöhe, AtLeast=1, AtMost=1, Maximum=1.797693135e+308, Minimum=-1.797693135e+308, TreeAccess=False)
azimutrichtungeingang_2 = GetString(azimutrichtungeingang, AtLeast=1, AtMost=1, Prompt="AzimutRichtungEingang", TreeAccess=False)
längengrad_2 = GetNumber(
    längengrad,
    AtLeast=1,
    AtMost=1,
    Maximum=1.797693135e+308,
    Minimum=-1.797693135e+308,
    Prompt="Längengrad",
    TreeAccess=True)
breitangrad = GetNumber(
    breitengrad,
    AtLeast=1,
    AtMost=1,
    Maximum=1.797693135e+308,
    Minimum=-1.797693135e+308,
    Prompt="Breitangrad",
    TreeAccess=True)
num = Number(raumhöhe_2)
num_2 = Number(azimutrichtungeingang_2)
panel = Panel("C:\Users\mfls\OneDrive\Uni\Master\Code\Tinyhouse Generator\files\EpwZipUrls.csv")
python = GhPythonScript(csv_path=panel, target_lat=breitangrad, target_lon=längengrad_2)  # -> nearest_station_url, shortest_distance
# ---------- python: Python ----------
__author__ = "mfls"
__version__ = "2024.06.07"
        
import rhinoscriptsyntax as rs
import math

nearest_station_url = None
shortest_distance = float('inf')

def haversine(lat1, lon1, lat2, lon2):
    #Konvertieren zu rad
    lat1, lon1, lat2, lon2 = map(math.radians, [lat1, lon1, lat2, lon2])

    # Haversine Formel 
    dlat = lat2 - lat1 
    dlon = lon2 - lon1 
    a = math.sin(dlat/2)**2 + math.cos(lat1) * math.cos(lat2) * math.sin(dlon/2)**2
    c = 2 * math.asin(math.sqrt(a)) 
    r = 6371.0088 # Radius der Erde
    return c * r

# CSV auslesen
file = open(csv_path, 'r')
lines = file.readlines()

file.close()

header = lines[0].strip().split(';')
if header[1].lower() == 'lat' and header[2].lower() == 'lon':
    lines = lines[1:]

for line in lines:
    line = line.strip("\n")
    
    # Split line mit Semikolon:
    csvInfo = line.split(';')
    lat = float(csvInfo[1])
    lon = float(csvInfo[2])
    distance = haversine(target_lat, target_lon, lat, lon) 
    if distance < shortest_distance:
            shortest_distance = distance
            nearest_station_url = csvInfo[3]
# ---------- end python ----------
panel_2 = Panel(python.nearest_station_url)
num_3 = Number(python.shortest_distance)
panel_3 = Panel(num_3)

# ---- group: Input Klimazone
klimazone = GetString("Dfc Cold-Withouth_dry_season-Cold_Summer", AtLeast=1, AtMost=1, Prompt="Klimazone", TreeAccess=False)
panel_4 = Panel(klimazone)
txt = Text(panel_4)

# ---- group: Berechnung Dämmstärke
# Länge Wand mit Holzst.
beton_leitfähigkeit_w_m_k = Panel("2.3")
holzleitfähigkeit_w_m_k = Panel("0.13")
zwischenlattendämmung_leitfähigkeit_w_m = Panel("0.034")  # "Zwischenlattendämmung Leitfähigkeit (W/m-K)"
abdichtung_leitfähigkeit_w_m_k = Panel("0.17")
außenschicht_leitfähigkeit_w_m_k = Panel("0.51")
panel_5 = Panel("Anzahl Holzständer")
putz_leitfähigkeit_w_m_k = Panel("0.51")
panel_6 = Panel("Dicke Zwischenlattendämmung(m)")
panel_7 = Panel("Dicke Betonwand (m)")
panel_8 = Panel("Dicke Holzständer (m)")
panel_9 = Panel("Dicke Abdichtung (m)")
panel_10 = Panel("Dicke Außenschicht (m)")
panel_11 = Panel("Dicke Putz (m)")
num_4 = Number(beton_leitfähigkeit_w_m_k)
num_5 = Number(holzleitfähigkeit_w_m_k)
num_6 = Number(zwischenlattendämmung_leitfähigkeit_w_m)
num_7 = Number(abdichtung_leitfähigkeit_w_m_k)
num_8 = Number(außenschicht_leitfähigkeit_w_m_k)
num_9 = Number(putz_leitfähigkeit_w_m_k)

# ---- group: Wind und Schnee Flachdach Logik
panel_12 = Panel("EPW-File")

# ---- group: Berechnung Dämmstärke
panel_13 = Panel("Daten aus EPW")

panel_14 = Panel("Breite Holzständer")
present_worth_factor = Panel("21.1")
kosten_strom_kwh = Panel("\t0.2236")
λ_dämmung_eps = Panel("0.034")
kosten_dämmung_m³ = Panel("263.78")
system_effizienz_η = Panel("2.50")
system_effizienz_ε = Panel("3.0")

# Auswahl Bauweise Aus CSV
# Auswahl Bauweise Aus CSV
# Logik Ist Belüftung Gewollt?
num_10 = Number()
wärmedurchlasswiderstand_außenluft_rse = Panel("0.040")
wärmedurchlasswiderstand_luftschicht = Panel("0.16")
wärmedurchlasswiderstand_innenluft_rsi = Panel("0.1")
panel_15 = Panel("Anteil Holz")
panel_16 = Panel("Anteil Dämmstoff")
num_11 = Number(wärmedurchlasswiderstand_innenluft_rsi)
dicke_latte_luftschicht = Number(wärmedurchlasswiderstand_außenluft_rse)

# ---- group: Wind und Schnee Flachdach Logik
toggle = BooleanToggle(True)
cutoff_flachdach_wind = Panel("8")
cutoff_flachdach_schnee = Panel("25")
cutoff_flachdach_regen = Panel("65")

# ----
# Daten aus:
# https://www.sciencedirect.com/science/article/pii/S0038092X16002188#:~:text=Window%2Dto%2Dwall%20ratio%20(,not%20for%20south%2Dfacing%20fa%C3%A7ades.
# Auswahl Bauweise Aus CSV
panel_17 = Panel("C:\Users\mfls\OneDrive\Uni\Master\Code\Tinyhouse Generator\files\ClimateLookupTable.csv")
python_2 = GhPythonScript(csv_path=panel_17, Klimazone=txt)  # -> Temperatur, Feuchtigkeit, Tragwerk, Dämmung, Belüftet, Dach, Dachüberstand, WWR_Nord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
# ---------- python_2: Python ----------
__author__ = "mfls"
__version__ = "2024.06.07"

import rhinoscriptsyntax as rs

# Function to search for a specific climate zone in the CSV and return its values
def search_climate_zone(csv_path, target_klimazone):
    # Initialize variables for output
    Temperatur = None
    Feuchtigkeit = None
    Tragwerk = None
    Dämmung = None
    Belüftet = None
    Dach = None
    Dachüberstand = None
    WWR_Nord = None
    WWR_Ost = None
    WWR_Süd = None
    WWR_West = None
    Seitenverhältnis_y_x = None
    Dachneigung = None
    Fundamenttiefe = None

    # Open and read the CSV file
    file = open(csv_path, 'r')
    lines = file.readlines()
    file.close()

    # Skip the header row
    header = lines[0].strip().split(';')
    lines = lines[1:]

    # Iterate through the CSV lines
    for line in lines:
        line = line.strip("\n")
        
        # Split the line into individual fields
        csvInfo = line.split(';')
        
        # Check if the Klimazone matches the target Klimazone
        if csvInfo[0] == target_klimazone:
            Temperatur = csvInfo[1]
            Feuchtigkeit = csvInfo[2]
            Tragwerk = csvInfo[3]
            Dämmung = csvInfo[4]
            Belüftet = csvInfo[5]
            Dach = csvInfo[6]
            Dachüberstand = csvInfo[7]
            WWR_Nord = csvInfo[8]
            WWR_Ost = csvInfo[9]
            WWR_Süd = csvInfo[10]
            WWR_West = csvInfo[11]
            Seitenverhältnis_y_x = csvInfo[12]
            Dachneigung = csvInfo[13]
            Fundamenttiefe = csvInfo[14]
            break

    # Outputs
    return Temperatur, Feuchtigkeit, Tragwerk, Dämmung, Belüftet, Dach, Dachüberstand, WWR_Nord, WWR_Ost, WWR_Süd, WWR_West, Seitenverhältnis_y_x, Dachneigung, Fundamenttiefe

target_klimazone = Klimazone

# Call the function and get the outputs
Temperatur, Feuchtigkeit, Tragwerk, Dämmung, Belüftet, Dach, Dachüberstand, WWR_Nord, WWR_Ost, WWR_Süd, WWR_West, Seitenverhältnis_y_x, Dachneigung, Fundamenttiefe = search_climate_zone(csv_path, target_klimazone)

# Set the outputs for Grasshopper
Temperatur = Temperatur
Feuchtigkeit = Feuchtigkeit
Tragwerk = Tragwerk
Dämmung = Dämmung
Belüftet = Belüftet
Dach = Dach
Dachüberstand = Dachüberstand
WWR_Nord = WWR_Nord
WWR_Ost = WWR_Ost
WWR_Süd = WWR_Süd
WWR_West = WWR_West
Seitenverhältnis_y_x = Seitenverhältnis_y_x
Dachneigung = Dachneigung
Fundamenttiefe= Fundamenttiefe
# ---------- end python_2 ----------
ziel_m² = Slider(35, range=0..100)
num_12 = Number(python_2.Seitenverhältnis_y_x)
python_3 = GhPythonScript(seitenverhältnis_y_x=num_12, grundrissfläche=ziel_m²)  # -> x, y
# ---------- python_3: Python ----------
__author__ = "mfls"
__version__ = "2024.06.07"

import rhinoscriptsyntax as rs

def calculate_dimensions(seitenverhältnis_y_x, area):
    """
    Berechnet die Dimensionen x und y eines Rechtecks basierend auf dem Seitenverhältnis y/x und der Grundrissfläche.

    Args:
    y_x_ratio (float): Das Seitenverhältnis y/x.
    area (float): Die gewünschte Grundrissfläche.

    Returns:
    tuple: Die berechneten Werte für x und y.
    """
    # y = ratio * x
    # area = x * y
    # area = x * (y_x_ratio * x)
    # area = y_x_ratio * x^2
    # x^2 = area / y_x_ratio
    # x = sqrt(area / y_x_ratio)
    
    import math
    x = math.sqrt(area / seitenverhältnis_y_x)
    y = seitenverhältnis_y_x * x
    
    return x, y

# Beispielhafte Verwendung
seitenverhältnis_y_x = seitenverhältnis_y_x
area = grundrissfläche
# Berechne x und y
x, y = calculate_dimensions(seitenverhältnis_y_x, area)

# Setze die Ausgaben für Grasshopper
x = x
y = y
# ---------- end python_3 ----------
tmatch = MatchText(Text=python_2.Tragwerk, Pattern="Holz", Case=True)
rectangle = Rectangle(Plane=PlaneXY(0, 0, 0), XSize=python_3.x, YSize=python_3.y, Radius=0)  # -> Rectangle, Length
bool = Boolean(tmatch)
bool_2 = Boolean(python_2.Belüftet)
num_13 = Number(python_2.Dachüberstand)
num_14 = Number(python_2.WWR_Nord)
num_15 = Number(python_2.WWR_Ost)
num_16 = Number(python_2.WWR_Süd)
num_17 = Number(python_2.WWR_West)
crv = Curve(rectangle.Rectangle)
num_18 = Number(python_2.Fundamenttiefe)
area = Area(Geometry=crv)  # -> Area, Centroid
offset = OffsetCurve(Curve=crv, Distance="0.5", Corners=1)
dom = ConstructDomain(DomainStart="0", DomainEnd="360")
dom_2 = ConstructDomain(DomainStart="0", DomainEnd="1")
num_19 = Number(num_2)
remap = RemapNumbers(Value=num_19, Source=dom, Target=dom_2)  # -> Mapped, Clipped
xy = XYPlane(Origin=area.Centroid)
cir = Circle(Plane=area.Centroid, Radius=area.Area)
flip = FlipCurve(Curve=cir)  # -> Curve, Flag
rad = Radians(Degrees="90")
rotate = Rotate(Geometry=flip.Curve, Angle=rad, Plane=xy)  # -> Geometry, Transform
eval = EvaluateCurve(Curve=reparameterize(rotate.Geometry), Parameter=remap.Mapped)  # -> Point, Tangent, Angle
roominstance = RoomInstance()
crv_cp = CurveClosestPoint(Point=eval.Point, Curve=offset)  # -> Point, Parameter, Distance
roominstance_2 = RoomInstance()
roominstance_3 = RoomInstance()
panel_18 = Panel("Richtung Eingang")
panel_19 = Panel("Form Vorschlag")
crv_2 = Curve(crv)
pt = Point(crv_cp.Point)
roominstance_4 = RoomInstance()
area_2 = Area(Geometry=crv_2)  # -> Area, Centroid
houseinstance = HouseInstance(Boundary=crv_2, EntrancePoint=pt)
panel_20 = Panel(area_2.Area)
magnetizing_fpg = MagnetizingRooms_ES(
    HouseInstance=houseinstance,
    Iterations=Slider(400, range=0..1000),
    MaxAdjDistance=Slider(3, range=0..10),
    CellSizeM=Slider(0.8, range=0..1))  # -> Corridors, RoomBreps, RoomNames, Adjacencies, MissingAdjacences, Boundary, BoundaryOffset
bool_3 = Boolean(bool)
pt_2 = Point(Point(-12.63179392, 1.296357165, 0))
brep = Brep(magnetizing_fpg.Corridors)
brep_2 = Brep(magnetizing_fpg.RoomBreps)
compass = LBCompass(center=pt_2, scale=Slider(0.2, range=0..1))  # -> compass; plug-in component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
join = BrepJoin(Breps=flatten([brep, brep_2]))  # -> Breps, Closed
edges = BrepEdges(Brep=join.Breps)  # -> Naked, Interior, NonManifold
join_2 = JoinCurves(Curves=edges.Naked, Preserve=False)
crv_3 = Curve(join_2)
fsettings = FitSettings(
    WidthInterior=100,
    WidthExterior="120",
    DownScaling=Slider(0.9, range=0..1),
    UpScaling=Slider(1.1, range=0..10),
    ThresholdScore=0,
    AmountOptions=3,
    UnitSystem=4)
Y = UnitY(Factor=1)
Z = UnitZ(Factor=1)
X = UnitX(Factor=1)
fit = PlanFit(Boundary=crv_3, EntranceS=pt, Beds=-1, Baths=-1, Country=26, FitSettings=fsettings, InHousePlans=False)

# ---- group: Textverarbeitung
num_20 = Number(num_14)
panel_21 = Panel("100")
num_21 = Number(num_15)
num_22 = Number(num_16)
panel_22 = Panel("100")
num_23 = Number(num_17)
panel_23 = Panel("100")
panel_24 = Panel("100")

# ----
data = Data(compass)

# ----
# Weiter an Positionsinformationen Wände und Möbel
item = ListItem(List=fit, Index=0, Wrap=True)
data_2 = Data(item)

panel_25 = Panel("Aus PlanFinder oben")
data_3 = Data(data_2)

# ----
# Positionsinformationen Wände und Möbel
deplan = DeconstructPlan(Plan=data_3)  # -> InteriorWalls, ExteriorWalls, DoorCurves, Glass, WindowFrames, Furniture, Score, Rooms
crv_4 = Curve(deplan.WindowFrames)
crv_5 = Curve(deplan.InteriorWalls)
crv_6 = Curve(deplan.ExteriorWalls)

# ---- group: Grundrisstransformation
explode = Explode(Curve=crv_4, Recursive=True)  # -> flatten(Segments), Vertices
explode_2 = Explode(Curve=crv_6, Recursive=True)  # -> flatten(Segments), Vertices
len = Length(Curve=explode.Segments)
len_2 = Length(Curve=explode_2.Segments)
number_slider = Slider(0.2, range=0..1)
bnd = Bounds(Numbers=len)
bnd_2 = Bounds(Numbers=len_2)
dedomain = DeconstructDomain(Domain=bnd)  # -> Start, End
dedomain_2 = DeconstructDomain(Domain=bnd_2)  # -> Start, End
equalst = EqualityWithinTolerance(FirstNumber=dedomain.Start, SecondNumber=len, Tolerance=0.01)  # -> Equality, Inequality
equalst_2 = EqualityWithinTolerance(FirstNumber=len_2, SecondNumber=dedomain_2.Start, Tolerance=0.01)  # -> Equality, Inequality
cull = CullPattern(List=explode_2.Segments, CullPattern=equalst_2.Inequality)
cull_2 = CullPattern(List=explode.Segments, CullPattern=equalst.Inequality)
join_3 = JoinCurves(Curves=[cull, cull_2], Preserve=False)
len_3 = Length(Curve=join_3)
bnd_3 = Bounds(Numbers=len_3)
dedomain_3 = DeconstructDomain(Domain=bnd_3)  # -> Start, End
equals = Equality(FirstNumber=len_3, SecondNumber=dedomain_3.End)  # -> Equality, Inequality
cull_3 = CullPattern(List=join_3, CullPattern=equals.Equality)
clscrv = CloseCurve(Curve=cull_3, CloseType=0, Bulge=0.5, Tolerance=0)  # -> Closed, R
num_24 = Number("120")
division = Division(A=num_24, B="1000")
neg = Negative(Value=division)
offset_2 = OffsetCurve(Curve=clscrv.Closed, Distance=neg, Corners=1)
simplify = SimplifyCurve(Curve=offset_2)  # -> Curve, Simplified

# ----
crv_7 = Curve([deplan.InteriorWalls, deplan.DoorCurves, deplan.Furniture, simplify.Curve, clscrv.Closed])
join_4 = JoinCurves(Curves=flatten(crv_7), Preserve=False)
panel_26 = Panel("Output Data Grundriss")
data_4 = Data(simplify(flatten(join_4)))

area_3 = Area(Geometry=offset_2)  # -> Area, Centroid
panel_27 = Panel(area_3.Area)

# ---- group: Innenwände
panel_28 = Panel("Innenwände")
crv_8 = Curve(crv_5)

# ---- group: Berechnung Dämmstärke (continued)
p_n_c = PickNChoose(Pattern=bool_2, Stream0="0", Stream1=wärmedurchlasswiderstand_luftschicht)
bool_4 = Boolean(bool)
bool_5 = Boolean(bool)
dicke_latte_luftschicht_2 = Number(p_n_c)

# ---- group: Eingangstür Position
crv_9 = Curve(deplan.DoorCurves)
cls = Closed(Curve=crv_9)  # -> Closed, Periodic
crvlinr = IsCurveLinear(Curve=crv_9)
cull_4 = CullPattern(List=crv_9, CullPattern=crvlinr)
cull_5 = CullPattern(List=crv_9, CullPattern=cls.Closed)
area_4 = Area(Geometry=cull_5)  # -> Area, Centroid
crv_10 = Curve(cull_5)
bnd_4 = Bounds(Numbers=area_4.Area)
dedomain_4 = DeconstructDomain(Domain=bnd_4)  # -> Start, End
equalst_3 = EqualityWithinTolerance(FirstNumber=area_4.Area, SecondNumber=dedomain_4.End, Tolerance=0.01)  # -> Equality, Inequality
cull_6 = CullPattern(List=area_4.Centroid, CullPattern=equalst_3.Inequality)
cull_7 = CullPattern(List=crv_10, CullPattern=equalst_3.Inequality)
crv_cp_2 = CurveClosestPoint(Point=cull_6, Curve=clscrv.Closed)  # -> Point, Parameter, Distance
sort = SortList(Keys=crv_cp_2.Distance, ValuesA=cull_7)  # -> Keys, ValuesA
sort_2 = SortList(Keys=crv_cp_2.Distance, ValuesA=crv_cp_2.Point)  # -> Keys, ValuesA
split = SplitList(List=sort_2.ValuesA, Index="2")  # -> ListA, ListB
split_2 = SplitList(List=sort.ValuesA, Index="2")  # -> ListA, ListB
pt_3 = Point(split.ListA)
item_2 = ListItem(List=pt_3, Index="0", Wrap=True)
item_3 = ListItem(List=pt_3, Index="1", Wrap=True)

# ---- group: Innentüre und Wände
# Kurven Türzarge (nicht außen)
panel_29 = Panel("Linien Türausgabe")
crv_11 = Curve(split_2.ListB)
line = Line(graft(cull_4))

# ---- group: Wind und Schnee Flachdach Logik / Dachneigung
panel_30 = Panel("Cutoff Flachdach Schnee")
maximum_winkel_schnee = Panel("70")
maximum_winkel_regen = Panel("130")
panel_31 = Panel("Cutoff Flachdach Regen")
num_25 = Number(cutoff_flachdach_schnee)
num_26 = Number(cutoff_flachdach_regen)
dom_3 = ConstructDomain(DomainStart=num_25, DomainEnd=maximum_winkel_regen)
dom_4 = ConstructDomain(DomainStart=num_26, DomainEnd=maximum_winkel_schnee)
panel_32 = Panel("Menge Schnee")
panel_33 = Panel("Menge Regen")
dom_5 = ConstructDomain(DomainStart="25", DomainEnd="40")
dom_6 = ConstructDomain(DomainStart="25", DomainEnd="45")

# ---- group: Textverarbeitung
multiplication = Multiplication(A=num_20, B=panel_21)
multiplication_2 = Multiplication(A=num_21, B=panel_22)
multiplication_3 = Multiplication(A=num_22, B=panel_23)
multiplication_4 = Multiplication(A=num_23, B=panel_24)
panel_34 = Panel(multiplication)
panel_35 = Panel(multiplication_2)
panel_36 = Panel(multiplication_3)
panel_37 = Panel(multiplication_4)
join_5 = TextJoin(Text=["WWR Nord", panel_34], Join=" = ")
join_6 = TextJoin(Text=["WWR Ost", panel_35], Join=" = ")
join_7 = TextJoin(Text=["WWR Süd", panel_36], Join=" = ")
join_8 = TextJoin(Text=["WWR West", panel_37], Join=" = ")
python_4 = GhPythonScript(csv_path=panel_17, Klimazone=txt)  # -> Erklärung_Tragwerk, Erklärung_Belüftet, Erklärung_Dach, Erklärung_WWR, Erklärung_Seitenverältnis_y_x
# ---------- python_4: Python ----------
__author__ = "mfls"
__version__ = "2024.06.07"

import rhinoscriptsyntax as rs

# Function to search for a specific climate zone in the CSV and return its values
def search_climate_zone(csv_path, target_klimazone):
    # Initialize variables for output
    Erklärung_Tragwerk = None
    Erklärung_Belüftet = None
    Erklärung_Dach = None
    Erklärung_WWR = None
    Erklärung_Seitenverältnis_y_x = None

    # Open and read the CSV file
    file = open(csv_path, 'r')
    lines = file.readlines()
    file.close()

    # Skip the header row
    header = lines[0].strip().split(';')
    lines = lines[1:]

    # Iterate through the CSV lines
    for line in lines:
        line = line.strip("\n")
        
        # Split the line into individual fields
        csvInfo = line.split(';')
        
        # Check if the Klimazone matches the target Klimazone
        if csvInfo[0] == target_klimazone:
            Erklärung_Tragwerk = csvInfo[15]
            Erklärung_Belüftet = csvInfo[16]
            Erklärung_Dach = csvInfo[17]
            Erklärung_WWR = csvInfo[18]
            Erklärung_Seitenverältnis_y_x = csvInfo[19]
            break

    # Outputs
    return Erklärung_Tragwerk, Erklärung_Belüftet, Erklärung_Dach, Erklärung_WWR, Erklärung_Seitenverältnis_y_x

target_klimazone = Klimazone

# Call the function and get the outputs
Erklärung_Tragwerk, Erklärung_Belüftet, Erklärung_Dach, Erklärung_WWR, Erklärung_Seitenverältnis_y_x = search_climate_zone(csv_path, target_klimazone)

# Set the outputs for Grasshopper
Erklärung_Tragwerk = Erklärung_Tragwerk
Erklärung_Belüftet = Erklärung_Belüftet
Erklärung_Dach = Erklärung_Dach
Erklärung_WWR = Erklärung_WWR
Erklärung_Seitenverältnis_y_x = Erklärung_Seitenverältnis_y_x
# ---------- end python_4 ----------
join_9 = TextJoin(Text=[join_8, python_4.Erklärung_Seitenverältnis_y_x], Join=" weil ")

panel_38 = Panel("Dachneigung")
panel_39 = Panel(python_2.Fundamenttiefe)
panel_40 = Panel("Seitenverhältnis")
panel_41 = Panel(python_2.Seitenverhältnis_y_x)
panel_42 = Panel("Fundamenttiefe")

panel_43 = Panel(panel_27)
panel_44 = Panel("Grundfläche")
panel_45 = Panel("Dachform")
panel_46 = Panel("Feuchtigkeit")
panel_47 = Panel(python_2.Feuchtigkeit)
panel_48 = Panel("U-Wert Wandaufbau")
panel_49 = Panel("Belüftet")
panel_50 = Panel(python_2.Belüftet)
panel_51 = Panel("Temperatur")
panel_52 = Panel(python_2.Temperatur)
panel_53 = Panel("Tragwerk")
panel_54 = Panel(python_2.Tragwerk)
panel_55 = Panel("Klimazone")
panel_56 = Panel(txt)

join_10 = TextJoin(Text=[panel_42, panel_39], Join=" = ")
join_11 = TextJoin(Text=[panel_40, panel_41], Join=" = ")
join_12 = TextJoin(Text=[panel_46, panel_47], Join=" = ")
join_13 = TextJoin(Text=[panel_49, panel_50], Join=" = ")
join_14 = TextJoin(Text=[panel_51, panel_52], Join=" = ")
join_15 = TextJoin(Text=[panel_53, panel_54], Join=" = ")
join_16 = TextJoin(Text=flatten([panel_44, panel_43]), Join=" = ")
join_17 = TextJoin(Text=[panel_55, panel_56], Join=" = ")
join_18 = TextJoin(Text=[join_15, python_4.Erklärung_Tragwerk], Join=" weil ")
join_19 = TextJoin(Text=[join_11, python_4.Erklärung_Seitenverältnis_y_x], Join=" weil ")
join_20 = TextJoin(Text=[join_13, python_4.Erklärung_Belüftet], Join=" weil ")

# ---- group: Eingangstür Position
panel_57 = Panel("Positionsinformationen Eingangstür")

# ----
crv_12 = Curve(simplify.Curve)
flip_2 = FlipCurve(Curve=simplify.Curve)  # -> Curve, Flag
cls_2 = Closed(Curve=offset_2)  # -> Closed, Periodic
panel_58 = Panel(cls_2.Closed)
crv_13 = Curve(flip_2.Curve)
dispatch = Dispatch(List=flip_2.Curve, DispatchPattern=bool_3)  # -> ListA, ListB

# ---- group: Eingangstür Position (continued)
crv_cp_3 = CurveClosestPoint(Point=item_2, Curve=crv_12)  # -> Point, Parameter, Distance
crv_cp_4 = CurveClosestPoint(Point=item_3, Curve=crv_12)  # -> Point, Parameter, Distance
ln = Line(StartPoint=crv_cp_3.Point, EndPoint=crv_cp_4.Point)

midpt = CurveMiddle(Curve=ln)
len_4 = Length(Curve=ln)
line_2 = Line(ln)
pt_4 = Point(midpt)
num_27 = Number(len_4)

# ---- group: Fenster
panel_59 = Panel("Kurve Original Grundriss")
crv_14 = Curve(crv_13)

# ---- group: Eingangstür
panel_60 = Panel("Kurve Grundriss")
panel_61 = Panel("Mitte Linie Tür")
crv_15 = Curve(crv_13)
pt_5 = Point(pt_4)

# ---- group: Innenwände
panel_62 = Panel("Außenwand")
crv_16 = Curve(crv_12)

# ---- group: Textverarbeitung
panel_63 = Panel("Text Konstrution")

# ---- group: Verteilung für Wanddicken
# Boolean Switch Holz Stein
# Boolean Switch Holz Stein
# Boolean Switch Holz Stein
# Boolean Switch Holz Stein
# Dicke zweite Dämmschicht Holz
# Boolean Switch Holz Stein
# Boolean Switch Holz Stein
# Dicke OSB + GK Holz
panel_64 = Panel("Dicke Putz Massiv")
panel_65 = Panel("Dicke Abdichtung Massiv")
panel_66 = Panel("Dicke Diffusionsof. S. Holz")
panel_67 = Panel("Dicke Dämmschicht Massiv")
panel_68 = Panel("Dicke Luftschicht Massiv")
panel_69 = Panel("Dicke Luftschicht Holz")
panel_70 = Panel("Dicke Wand Massiv")
panel_71 = Panel("Dicke Holständer Holz")
panel_72 = Panel("Dicke Putz Massiv")
panel_73 = Panel("Dicke Putz Holz")
panel_74 = Panel("Dicke Wand Tragend")
panel_75 = Panel("Dicke Putz")
panel_76 = Panel("Dicke Abdichtung")
panel_77 = Panel("Dicke Aüßere Dämmschicht")
bool_6 = Boolean(bool_3)
bool_7 = Boolean(bool_3)
bool_8 = Boolean(bool_3)
panel_78 = Panel("Dicke Luftschicht")
panel_79 = Panel("Dicke Wandaufbau Gesamt")
bool_9 = Boolean(bool_3)
bool_10 = Boolean(bool_3)
panel_80 = Panel("Dicke Außenhaut")
bool_11 = Boolean(bool_3)

# ---- group: Verteilung für Wand Kurven
# Boolean Switch Holz Stein
# Boolean Switch Holz Stein
# Boolean Switch Holz Stein
# Boolean Switch Holz Stein
panel_81 = Panel("Kurve Massiv")
panel_82 = Panel("Kurve Holz")
panel_83 = Panel("Kurve Massiv")
panel_89 = Panel("Innenkurve Abdichtung")
panel_90 = Panel("Innenkurve Dämmung")
panel_91 = Panel("Innenkurve Putz")
panel_92 = Panel("Innenkurve Wand")
bool_12 = Boolean(bool_3)
bool_13 = Boolean(bool_3)
bool_14 = Boolean(bool_3)
panel_93 = Panel("Außenkurve Rand")
bool_15 = Boolean(bool_3)
crv_17 = Curve(crv_13)

# ---- group: Eingangstür
explode_3 = Explode(Curve=crv_15, Recursive=True)  # -> Segments, Vertices
crv_cp_5 = CurveClosestPoint(Point=pt_5, Curve=explode_3.Segments)  # -> Point, Parameter, Distance
bnd_5 = Bounds(Numbers=crv_cp_5.Distance)
dedomain_5 = DeconstructDomain(Domain=bnd_5)  # -> Start, End
equals_2 = Equality(FirstNumber=crv_cp_5.Distance, SecondNumber=dedomain_5.Start)  # -> Equality, Inequality
cull_8 = CullPattern(List=explode_3.Segments, CullPattern=equals_2.Equality)
wo_tür = Slider(0.5, range=0..1)
panel_94 = Panel("Linie Tür")
Z_2 = UnitZ(Factor=1)
line_3 = Line(line_2)
eval_2 = EvaluateCurve(Curve=reparameterize(cull_8), Parameter="0.5")  # -> Point, Tangent, Angle
md_slider = MDSlider(SliderMode=0, slider_value=Point(0.5, 0.5, 0.5), x_domain=Domain(0, 1), y_domain=Domain(0, 1), z_domain=Domain(0, 1))
extr = Extrude(Base=cull_8, Direction=Z_2)
höhe_tür = Slider(2, range=0..2)
eval_3 = EvaluateCurve(Curve=reparameterize(line_3), Parameter=wo_tür)  # -> Point, Tangent, Angle
panel_95 = Panel("Länge Linie Tür")
vec = Vector(eval_2.Tangent)
evalsrf = EvaluateSurface(Surface=reparameterize(extr), Point=md_slider)  # -> Point, Normal, UDirection, VDirection, Frame
num_28 = Number(num_27)
pt_6 = Point(eval_3.Point)
multiplication_5 = Multiplication(A=num_28, B="-0.5")
vec_2 = Vector(vec)
panel_96 = Panel("Dicke Wandaufbau gesamt")
multiplication_6 = Multiplication(A=vec, B=multiplication_5)
pl = ConstructPlane(Origin=pt_6, XAxis=vec, YAxis=evalsrf.Normal)
num_29 = Number(höhe_tür)
vec_3 = Vector(evalsrf.Normal)
dicke_rahmen = Slider(0.05, range=0..0.1)
number_slider_2 = Slider(0.01, range=0..0.01)
Z_3 = UnitZ(Factor=number_slider_2)
neg_2 = Negative(Value=dicke_rahmen)
panel_98 = Panel("Normal Vektor Wand")
vec_4 = Vector(evalsrf.Normal)
md_slider_2 = MDSlider(
    SliderMode=0,
    slider_value=Point(0.4426410044, 0.2189917471, 0.5),
    x_domain=Domain(0, 1),
    y_domain=Domain(0, 1),
    z_domain=Domain(0, 1))
number_slider_3 = Slider(0.02, range=0..0.1)
neg_3 = Negative(Value=number_slider_3)

# ---- group: Innentüre und Wände
ccx = CurveCurve(CurveA=crv_11, CurveB=line)  # -> Points, ParamsA, ParamsB
trim = TrimTree(Tree=ccx.Points, Depth=1)
srf = Surface(crv_11)
türhöhe = Slider(2, range=0..10)
item_4 = ListItem(List=trim, Index="0", Wrap=True)
item_5 = ListItem(List=trim, Index="1", Wrap=True)
area_5 = Area(Geometry=srf)  # -> Area, Centroid
num_30 = Number(türhöhe)
Z_4 = UnitZ(Factor=num_30)
move = Move(Geometry=item_4, Motion=Z_4)  # -> Geometry, Transform
move_2 = Move(Geometry=item_5, Motion=Z_4)  # -> Geometry, Transform
merge = Merge(Data1=item_4, Data2=move.Geometry, Data3=move_2.Geometry, Data4=item_5)
pline = PolyLine(Vertices=merge, Closed=False)
clscrv_2 = CloseCurve(Curve=pline, CloseType=0, Bulge=0.5, Tolerance=0)  # -> Closed, R
shatter = Shatter(Curve=reparameterize(pline), Parameters="0.5")
boundary = BoundarySurfaces(Edges=clscrv_2.Closed)
crv_cp_6 = CurveClosestPoint(Point=area_5.Centroid, Curve=graft(shatter))  # -> Point, Parameter, Distance
bnd_6 = Bounds(Numbers=crv_cp_6.Distance)
dedomain_6 = DeconstructDomain(Domain=bnd_6)  # -> Start, End
equals_3 = Equality(FirstNumber=crv_cp_6.Distance, SecondNumber=dedomain_6.Start)  # -> Equality, Inequality
cull_9 = CullPattern(List=srf, CullPattern=equals_3.Equality)
swp1 = Sweep1(Rail=graft(shatter), Sections=graft(cull_9), Miter=1)
trim_2 = TrimTree(Tree=swp1, Depth="2")
join_21 = BrepJoin(Breps=trim_2)  # -> Breps, Closed
cap = CapHoles(Brep=join_21.Breps)
data_5 = Data(cap)
bbox = BoundingBox(Content=data_5, Plane=PlaneXY(0, 0, 0))  # -> Box, Box_2
debox = DeconstructBox(Box=bbox.Box)  # -> Plane, X, Y, Z
num_31 = Number(debox.Z)
Z_5 = UnitZ(Factor=num_31)
rectangle_2 = Rectangle(Plane=debox.Plane, XSize=debox.X, YSize=debox.Y, Radius=0)  # -> Rectangle, Length
move_3 = Move(Geometry=rectangle_2.Rectangle, Motion=Z_5)  # -> Geometry, Transform
srf_2 = Surface(move_3.Geometry)
panel_100 = Panel("Logik Dachform Wechsel")
panel_101 = Panel("Unten-> Schrägdach")
panel_102 = Panel("Raumhöhe")
panel_103 = Panel("Türhöhe")
num_32 = Number(num)
num_33 = Number(türhöhe)
subtraction = Subtraction(A=num_32, B=num_33)
Z_6 = UnitZ(Factor=subtraction)

# ---- group: Innentüre und Wände / Türblatt
md_slider_3 = MDSlider(SliderMode=0, slider_value=Point(0.5, 0.5, 0.5), x_domain=Domain(0, 1), y_domain=Domain(0, 1), z_domain=Domain(0, 1))
number_slider_4 = Slider(0.03, range=0..0.1)
evalsrf_2 = EvaluateSurface(Surface=reparameterize(boundary), Point=md_slider_3)  # -> Point, Normal, UDirection, VDirection, Frame
neg_4 = Negative(Value=number_slider_4)
division_2 = Division(A=number_slider_4, B="2")
amp = Amplitude(Vector=evalsrf_2.Normal, Amplitude=division_2)
move_4 = Move(Geometry=boundary, Motion=amp)  # -> Geometry, Transform
offsetbrep = OffsetBrep(Brep=move_4.Geometry, OffsetDistance=neg_4, Solid=Toggle(True), SharpEdges=True, Tolerance=0.01)

# ---- group: Fenster
# Daten für Trim "Wo ist Tür"
debrep = DeconstructBrep(Brep=crv_14)  # -> Faces, Edges, Vertices
Z_7 = UnitZ(Factor=1)
md_slider_4 = MDSlider(SliderMode=0, slider_value=Point(0.5, 0.5, 0.5), x_domain=Domain(0, 1), y_domain=Domain(0, 1), z_domain=Domain(0, 1))
extr_2 = Extrude(Base=debrep.Edges, Direction=Z_7)
evalsrf_3 = EvaluateSurface(Surface=reparameterize(extr_2), Point=md_slider_4)  # -> Point, Normal, UDirection, VDirection, Frame
xy_2 = XYPlane(Origin=Point(0, 0, 0))
Y_2 = UnitY(Factor=1)
angle = Angle(VectorA=evalsrf_3.Normal, VectorB=Y_2, Plane=xy_2)  # -> Angle, Reflex
deg = Degrees(Radians=angle.Angle)
innenwandbreite = Slider(0.1, range=0..0.1)
num_34 = Number(num_14)
num_35 = Number(num_16)
num_36 = Number(num_15)
num_37 = Number(num_17)

# ---- group: Fenster / Süden
larger = LargerThan(FirstNumber=deg, SecondNumber="135")  # -> LargerThan, OrEqualTo
smaller = SmallerThan(FirstNumber=deg, SecondNumber="225")  # -> SmallerThan, OrEqualTo
and = GateAnd(A=larger.LargerThan, B=smaller.OrEqualTo)
dispatch_2 = Dispatch(List=debrep.Edges, DispatchPattern=and)  # -> ListA, ListB
data_6 = Data(dispatch_2.ListA)

# ---- group: Fenster / Osten
smaller_2 = SmallerThan(FirstNumber=deg, SecondNumber="135")  # -> SmallerThan, OrEqualTo
larger_2 = LargerThan(FirstNumber=deg, SecondNumber="45")  # -> LargerThan, OrEqualTo
and_2 = GateAnd(A=larger_2.LargerThan, B=smaller_2.OrEqualTo)
dispatch_3 = Dispatch(List=debrep.Edges, DispatchPattern=and_2)  # -> ListA, ListB
data_7 = Data(dispatch_3.ListA)

# ---- group: Fenster / Norden
smaller_3 = SmallerThan(FirstNumber=deg, SecondNumber="45")  # -> SmallerThan, OrEqualTo
larger_3 = LargerThan(FirstNumber=deg, SecondNumber="315")  # -> LargerThan, OrEqualTo
or = GateOr(A=smaller_3.OrEqualTo, B=larger_3.LargerThan)
dispatch_4 = Dispatch(List=debrep.Edges, DispatchPattern=or)  # -> ListA, ListB
data_8 = Data(dispatch_4.ListA)

# ---- group: Fenster / Westen
larger_4 = LargerThan(FirstNumber=deg, SecondNumber="225")  # -> LargerThan, OrEqualTo
smaller_4 = SmallerThan(FirstNumber=deg, SecondNumber="315")  # -> SmallerThan, OrEqualTo
and_3 = GateAnd(A=larger_4.LargerThan, B=smaller_4.OrEqualTo)
dispatch_5 = Dispatch(List=debrep.Edges, DispatchPattern=and_3)  # -> ListA, ListB
data_9 = Data(dispatch_5.ListA)

# ---- group: Eingangstür / Punkttransformation Tür
pt_7 = Point(pt_6)
num_38 = Number(höhe_tür)
Z_8 = UnitZ(Factor=num_38)
multiplication_7 = Multiplication(A=vec_2, B="0.5")
multiplication_8 = Multiplication(A=vec_2, B="-0.5")
panel_105 = Panel("Innere Ecken Oben")
panel_106 = Panel("Innere Ecken Unten")
move_5 = Move(Geometry=pt_7, Motion=multiplication_7)  # -> Geometry, Transform
move_6 = Move(Geometry=pt_7, Motion=multiplication_8)  # -> Geometry, Transform
move_7 = Move(Geometry=move_5.Geometry, Motion=Z_8)  # -> Geometry, Transform
move_8 = Move(Geometry=move_6.Geometry, Motion=Z_8)  # -> Geometry, Transform
panel_107 = Panel("Äußere Ecken Oben")
panel_108 = Panel("Äußere Ecken Unten")
panel_109 = Panel("Unten")
panel_110 = Panel("Oben")
panel_111 = Panel("1")
panel_112 = Panel("2")

# ---- group: Eingangstür / Türblatt
panel_113 = Panel("Tangente Vektor")
vec_5 = Vector(vec)
panel_114 = Panel("Dicke Fußplatte")
move_9 = Move(Geometry=move_6.Geometry, Motion=Z_3)  # -> Geometry, Transform
move_10 = Move(Geometry=move_5.Geometry, Motion=Z_3)  # -> Geometry, Transform
multiplication_9 = Multiplication(A=vec_5, B=dicke_rahmen)
panel_117 = Panel("Dicke Rahmen")
vec_6 = Vector(multiplication_9)
rev = Reverse(Vector=vec_6)
num_39 = Number(number_slider_2)
num_40 = Number(dicke_rahmen)
move_11 = Move(Geometry=move_10.Geometry, Motion=rev)  # -> Geometry, Transform
move_12 = Move(Geometry=move_9.Geometry, Motion=vec_6)  # -> Geometry, Transform
num_41 = Number(höhe_tür)
addition = Addition(A=num_39, B=num_40)
subtraction_2 = Subtraction(A=num_41, B=addition)
panel_119 = Panel("Türblatt Grundform")
Z_9 = UnitZ(Factor=subtraction_2)
move_13 = Move(Geometry=move_12.Geometry, Motion=Z_9)  # -> Geometry, Transform
move_14 = Move(Geometry=move_11.Geometry, Motion=Z_9)  # -> Geometry, Transform
pline_2 = PolyLine(Vertices=[move_12.Geometry, move_11.Geometry, move_14.Geometry, move_13.Geometry], Closed=Toggle(True))
fpatch = FragmentPatch(Boundary=pline_2)

# ---- group: Eingangstür
panel_120 = Panel("Box Position Tür")

# ---- group: Innentüre und Wände (continued)
data_10 = Data(offsetbrep)

panel_121 = Panel("Output Data Holz")
data_11 = Data([data_5, data_10])

# ---- group: Fenster
panel_122 = Panel("Output Data Metall")
panel_123 = Panel("Output Data Glas")

# ---- group: Innenwände
panel_124 = Panel("Surface Wandbauteil")
panel_125 = Panel("Vektor Raumhöhe")

# Weiterleitung an Fenster Cutoff
cp = ControlPoints(Curve=crv_8)  # -> Points, Weights, Knots
boundary_2 = BoundarySurfaces(Edges=crv_8)
Z_10 = UnitZ(Factor="15")
panel_127 = Panel("Dach Brep")
crv_cp_7 = CurveClosestPoint(Point=cp.Points, Curve=crv_16)  # -> Point, Parameter, Distance
equalst_4 = EqualityWithinTolerance(FirstNumber=crv_cp_7.Distance, SecondNumber="0", Tolerance=0.01)  # -> Equality, Inequality
cull_10 = CullPattern(List=cp.Points, CullPattern=equalst_4.Equality)
pt_8 = Point(cull_10)
panel_129 = Panel("Unten-> Walmdach")

srf_3 = Surface(boundary_2)

# ---- group: Innentüre und Wände / Dachteil
Z_11 = UnitZ(Factor="10")

# ---- group: Innenwände
panel_131 = Panel("Output Data Putz")

# ---- group: Fundament
# Randkure Innenputz
# für Bodenbelag beginn
dicke_fußbodendämmung = Slider(0.12, range=0.12..0.25)
dicke_bodenbelag = Slider(0.05, range=0..0.1)
dicke_estrich = Slider(0.08, range=0.025..0.1)
dicke_dampfsperre = Slider(0.01, range=0.005..0.01)
dicke_bodenplatte = Slider(0.3, range=0.25..0.5)

# ---- group: Massivkonstruktion
# Logik Ist Belüftung Gewollt?
panel_135 = Panel("Dach Brep Unterseite")
panel_136 = Panel("Dicke Dämmschicht CSV")
dicke_innenputz = Slider(0.02, range=0..0.02)
dicke_außenputz = Slider(0.02, range=0.01..0.02)
dicke_wand = Slider(0.2, range=0.1..0.4)
dicke_abdichtung = Slider(0.011, range=0.011..0.02)
dicke_latte_luftschicht_3 = Slider(0.05, range=0..0.8)
raumhöhe_3 = Number(num)
crv_18 = Curve(dispatch.ListB)
p_n_c_2 = PickNChoose(Pattern=bool_2, Stream0="0", Stream1=dicke_latte_luftschicht_3)
dicke_latte_luftschicht_4 = Number(p_n_c_2)

# ---- group: Verteilung für Wanddicken (continued)
data_12 = Data(dicke_außenputz)
data_13 = Data(dicke_wand)
data_14 = Data(dicke_innenputz)
data_15 = Data(dicke_abdichtung)
data_16 = Data(dicke_latte_luftschicht_4)

# ---- group: Innenwände (continued)
num_42 = Number(raumhöhe_3)
Z_12 = UnitZ(Factor=num_42)
extr_3 = Extrude(Base=boundary_2, Direction=Z_12)

# ---- group: Holzkonstruktion
# Grundriss nach tragender Wand
# Grundriss vor tragender Wand
# Extrusions höhe Dämmung minus Ringbalken höhe
# Grundriss nach tragender Wand
# Grundriss nach Zweiter Dämmschicht
panel_137 = Panel("Gipskarton")
panel_138 = Panel("Zweite Dämmschicht")
panel_139 = Panel("""Kurve Dämmung
Hochgeschoben Ringbalken""")
panel_140 = Panel("Abdichtung")
panel_141 = Panel("Dicke Latte Luftschicht")
panel_142 = Panel("Außenhaut")
höhe_ringbalken_unten = Slider(0.2, range=0..1)
panel_143 = Panel("Ringbalken Holz unten")
panel_144 = Panel("Kurve Dämmung")
panel_145 = Panel("Innenputz")
panel_146 = Panel("Grundriss Ganz innen")
panel_147 = Panel("Y Holzständer")
panel_148 = Panel("Grundriss nach Abdichtung")
panel_149 = Panel("Dicke Innenputz")
panel_150 = Panel("Grundriss nach OSB")
panel_152 = Panel("Dicke Zweite Dämmschicht")
num_43 = Number(raumhöhe_3)
panel_154 = Panel("Dicke OSB")
panel_157 = Panel("Dicke Diff Schicht")
Z_13 = UnitZ(Factor=höhe_ringbalken_unten)
num_44 = Number(raumhöhe_3)
Z_14 = UnitZ(Factor=num_43)
num_45 = Number(raumhöhe_3)
Z_15 = UnitZ(Factor=num_44)
num_46 = Number(raumhöhe_3)
Z_16 = UnitZ(Factor=num_45)
num_47 = Number(raumhöhe_3)
panel_161 = Panel("Tür Rechteck")
Z_17 = UnitZ(Factor=num_46)
Z_18 = UnitZ(Factor=num_47)
Z_19 = UnitZ(Factor=höhe_ringbalken_unten)
panel_167 = Panel("X Holzständer")
panel_170 = Panel("Grundriss nach Inneputz")
panel_171 = Panel("Oben -> Flachdach")
Z_20 = UnitZ(Factor=1)
Z_21 = UnitZ(Factor=1)
panel_205 = Panel("Höhe Ringbalken Unten")

# ---- group: Innenwände (continued)
vec_7 = Vector(Z_16)

move_15 = Move(Geometry=srf_3, Motion=vec_7)  # -> Geometry, Transform
extr_4 = Extrude(Base=move_15.Geometry, Direction=Z_10)

# ---- group: Holzkonstruktion
panel_222 = Panel("Kurve OSB")
Z_22 = UnitZ(Factor=1)
panel_223 = Panel("Breite Latte")
panel_224 = Panel("Dach Brep Unterseite")
panel_227 = Panel("Dicke Diffusionsoffene Schicht")
rad_2 = Radians(Degrees="90")
panel_230 = Panel("Dicke zweite Dämmschicht")
panel_232 = Panel("Höhe Attika")

# ---- group: Massivkonstruktion
panel_238 = Panel("Grundriss nach Dämmung")
Z_23 = UnitZ(Factor=1)
rad_3 = Radians(Degrees="90")

# ---- group: Holzkonstruktion
# Dach Brep Unterseite
# Verteilung
# Verwenden bei händischer Angabe der Dämmstärke
# Logik Dicke zweite Dämmschicht Holz
# Logik Ist Belüftung Gewollt?
panel_251 = Panel("Dämmstärke aus CSV")
dicke_diffusionsoffene_schicht = Slider(0.011, range=0.011..0.02)
dicke_latte_luftschicht_5 = Slider(0.05, range=0..0.8)
dicke_osb = Slider(0.02, range=0.01..0.02)
dicke_gipskarton = Slider(0.02, range=0.01..0.02)
dicke_innenputz_2 = Slider(0.02, range=0..0.02)
y_holzständer = Slider(0.2, range=0..0.8)
x_holzständer = Slider(0.06, range=0..0.5)
grundriss = Curve(dispatch.ListA)
raumhöhe_4 = Number(num)
panel_252 = Panel("""Raumhöhe
Verteilung""")
dicke_innenputz_3 = Number(dicke_innenputz_2)
dicke_diffusionsoffene_schicht_2 = Number(dicke_diffusionsoffene_schicht)
dicke_wand_2 = Number(y_holzständer)
num_48 = Number(dicke_wand_2)
dicke_gk = Number(dicke_gipskarton)
num_49 = Number(x_holzständer)
dicke_osb_2 = Number(dicke_osb)
p_n_c_3 = PickNChoose(Pattern=bool_2, Stream0="0", Stream1=dicke_latte_luftschicht_5)
dicke_latte_luftschicht_6 = Number(p_n_c_3)

# ---- group: Verteilung für Wanddicken (continued)
data_17 = Data(dicke_osb_2)
data_18 = Data(dicke_gk)
addition_2 = Addition(A=data_17, B=data_18)
data_19 = Data(dicke_wand_2)
data_20 = Data(dicke_innenputz_3)
data_21 = Data(dicke_diffusionsoffene_schicht_2)
data_22 = Data(dicke_latte_luftschicht_6)
p_n_c_4 = PickNChoose(Pattern=bool_7, Stream0=data_14, Stream1=data_20)
p_n_c_5 = PickNChoose(Pattern=bool_6, Stream0=data_13, Stream1=data_19)
p_n_c_6 = PickNChoose(Pattern=bool_8, Stream0=data_15, Stream1=data_21)
p_n_c_7 = PickNChoose(Pattern=bool_10, Stream0=data_16, Stream1=data_22)
p_n_c_8 = PickNChoose(Pattern=bool_11, Stream0=data_12, Stream1=addition_2)

data_23 = Data(p_n_c_4)
data_24 = Data(p_n_c_5)
data_25 = Data(p_n_c_7)
data_26 = Data(p_n_c_8)
data_27 = Data(p_n_c_6)

# ---- group: Berechnung Dämmstärke (continued)
num_50 = Number(data_24)
num_51 = Number(data_24)
num_52 = Number(data_24)
num_53 = Number(data_27)
num_54 = Number(data_27)
num_55 = Number(data_23)

division_3 = Division(A=num_50, B=num_4)
division_4 = Division(A=num_52, B=num_6)
division_5 = Division(A=num_53, B=num_7)
division_6 = Division(A=num_51, B=num_5)
division_7 = Division(A=num_54, B=num_8)
division_8 = Division(A=num_55, B=num_9)
wärmewiderstand_m²_k_w = Panel(division_3)
wärmewiderstand_m²_k_w_2 = Panel(division_5)
wärmewiderstand_m²_k_w_3 = Panel(division_7)
wärmewiderstand_m²_k_w_4 = Panel(division_8)
dispatch_6 = Dispatch(List=wärmewiderstand_m²_k_w, DispatchPattern=bool_4)  # -> ListA, ListB
dicke_latte_luftschicht_7 = Number(wärmewiderstand_m²_k_w_3)
dicke_latte_luftschicht_8 = Number(wärmewiderstand_m²_k_w_2)
num_56 = Number(wärmewiderstand_m²_k_w_4)

# ---- group: Massivkonstruktion
# Grundriss nach tragender Wand
# Grundriss vor tragender Wand
# Grundriss nach tragender Wand
panel_253 = Panel("Innenputz")
panel_256 = Panel("Dämmung")
num_57 = Number(dicke_latte_luftschicht_4)
num_58 = Number(raumhöhe_3)
num_59 = Number(raumhöhe_3)
crv_19 = Curve(crv_18)
Z_24 = UnitZ(Factor=num_58)
Z_25 = UnitZ(Factor=num_59)
Z_26 = UnitZ(Factor=1)
Z_27 = UnitZ(Factor=1)
offset_3 = OffsetCurve(Curve=crv_19, Distance=dicke_innenputz, Corners=1)
panel_264 = Panel("Dicke Dämmung")
boundary_3 = BoundarySurfaces(Edges=flatten([crv_19, offset_3]))
num_60 = Number(raumhöhe_3)
panel_267 = Panel("Dicke Außenputz")
panel_269 = Panel("Dicke Wand")
crv_20 = Curve(offset_3)
edges_2 = BrepEdges(Brep=crv_20)  # -> Naked, Interior, NonManifold
midpt_2 = CurveMiddle(Curve=edges_2.Naked)
line_4 = LineSDL(Start=midpt_2, Direction=Z_26, Length=Slider(100000000, range=0..100000000))
Z_28 = UnitZ(Factor=num_60)
panel_270 = Panel("Tragende Wand")
panel_271 = Panel("Außenputz")
offset_4 = OffsetCurve(Curve=crv_20, Distance=dicke_wand, Corners=1)
edges_3 = BrepEdges(Brep=offset_4)  # -> Naked, Interior, NonManifold
midpt_3 = CurveMiddle(Curve=edges_3.Naked)
line_5 = LineSDL(Start=midpt_3, Direction=Z_27, Length=Slider(100000000, range=0..100000000))
crv_21 = Curve(offset_4)
offset_5 = OffsetCurve(Curve=crv_21, Distance=dicke_abdichtung, Corners=1)
crv_22 = Curve(offset_5)
num_61 = Number(raumhöhe_3)
num_62 = Number(raumhöhe_3)
boundary_4 = BoundarySurfaces(Edges=flatten([crv_21, offset_5]))
extr_5 = Extrude(Base=boundary_3, Direction=Z_24)
Z_29 = UnitZ(Factor=num_61)
num_63 = Number(raumhöhe_3)
Z_30 = UnitZ(Factor=num_62)
boundary_5 = BoundarySurfaces(Edges=flatten([crv_20, offset_4]))
num_64 = Number(raumhöhe_3)
num_65 = Number(raumhöhe_3)
Z_31 = UnitZ(Factor=num_63)
Z_32 = UnitZ(Factor=num_65)
Z_33 = UnitZ(Factor=num_64)
num_66 = Number(raumhöhe_3)
Z_34 = UnitZ(Factor=num_66)
extr_6 = Extrude(Base=boundary_4, Direction=Z_31)
panel_302 = Panel("Dämmdicke CSV")
panel_303 = Panel("Logik Dämmstärke = 0")

# ---- group: Verteilung für Wand Kurven (continued)
data_28 = Data(offset_4)
data_29 = Data(offset_3)
data_30 = Data(offset_5)

# ---- group: Massivkonstruktion (continued)
edges_4 = BrepEdges(Brep=crv_22)  # -> Naked, Interior, NonManifold
len_5 = Length(Curve=edges_4.Naked)
divide = DivideCurve(Curve=edges_4.Naked, Count=len_5, Kinks=False)  # -> Points, Tangents, Parameters
item_6 = ListItem(List=divide.Points, Index="0", Wrap=True)
item_7 = ListItem(List=divide.Points, Index="0", Wrap=True)
item_8 = ListItem(List=divide.Tangents, Index="0", Wrap=True)
dist = Distance(PointA=item_6, PointB=divide.Points)
align = AlignPlane(Plane=item_7, Direction=item_8)  # -> Plane, Angle
breite_der_latte = Number(num_49)
bnd_7 = Bounds(Numbers=dist)
dedom2num = DeconstructDomain²(Domain=bnd_7)  # -> UMin, UMax, VMin, VMax
subtraction_3 = Subtraction(A=dedom2num.UMax, B=breite_der_latte)
dom_7 = ConstructDomain(DomainStart=0, DomainEnd=subtraction_3)
rectangle_3 = Rectangle(Plane=align.Plane, XSize=breite_der_latte, YSize=dicke_latte_luftschicht_4, Radius=0)  # -> Rectangle, Length
remap_2 = RemapNumbers(Value=dist, Source=bnd_7, Target=dom_7)  # -> Mapped, Clipped
multiplication_10 = Multiplication(A=remap_2.Mapped, B=item_8)
move_16 = Move(Geometry=rectangle_3.Rectangle, Motion=multiplication_10)  # -> Geometry, Transform
vec_8 = Vector(divide.Tangents)
rotate_2 = Rotate(Geometry=vec_8, Angle=rad_3, Plane=PlaneXY(0, 0, 0))  # -> Geometry, Transform
num_67 = Number(raumhöhe_4)

# ---- group: Massivkonstruktion / Dachteil
srf_4 = Surface(boundary_3)
vec_9 = Vector(Z_24)
move_17 = Move(Geometry=srf_4, Motion=vec_9)  # -> Geometry, Transform
Z_35 = UnitZ(Factor="15")
extr_7 = Extrude(Base=move_17.Geometry, Direction=Z_35)

# ---- group: Holzkonstruktion / Dachteil
vec_10 = Vector(Z_16)
Z_36 = UnitZ(Factor="15")

vec_11 = Vector(Z_17)
Z_37 = UnitZ(Factor="15")

vec_12 = Vector(Z_15)
Z_38 = UnitZ(Factor="15")

# ---- group: Massivkonstruktion / Dachteil
vec_13 = Vector(Z_32)
Z_39 = UnitZ(Factor="15")

# ---- group: Holzkonstruktion / Dachteil
vec_14 = Vector(Z_18)
Z_40 = UnitZ(Factor="15")

# ---- group: Massivkonstruktion / Dachteil
vec_15 = Vector(Z_33)
Z_41 = UnitZ(Factor="15")

srf_5 = Surface(boundary_4)
vec_16 = Vector(Z_31)
move_18 = Move(Geometry=srf_5, Motion=vec_16)  # -> Geometry, Transform
Z_42 = UnitZ(Factor="15")
extr_8 = Extrude(Base=move_18.Geometry, Direction=Z_42)

# ---- group: Holzkonstruktion / Dachteil
vec_17 = Vector(Z_14)
Z_43 = UnitZ(Factor="15")

# ---- group: Holzkonstruktion (continued)
num_68 = Number(dicke_latte_luftschicht_6)
crv_23 = Curve(grundriss)
offset_6 = OffsetCurve(Curve=crv_23, Distance=dicke_innenputz_3, Corners=1)
crv_24 = Curve(offset_6)
offset_7 = OffsetCurve(Curve=crv_24, Distance=dicke_wand_2, Corners=1)
boundary_6 = BoundarySurfaces(Edges=flatten([crv_24, offset_7]))
crv_25 = Curve(offset_7)
boundary_7 = BoundarySurfaces(Edges=flatten([crv_23, offset_6]))
Z_44 = UnitZ(Factor=raumhöhe_4)
crv_26 = Curve(offset_6)
offset_8 = OffsetCurve(Curve=crv_25, Distance=dicke_diffusionsoffene_schicht_2, Corners=1)
crv_27 = Curve(offset_8)
extr_9 = Extrude(Base=boundary_6, Direction=Z_13)
move_19 = Move(Geometry=crv_26, Motion=Z_44)  # -> Geometry, Transform
boundary_8 = BoundarySurfaces(Edges=flatten([crv_25, offset_8]))
num_69 = Number(raumhöhe_4)
num_70 = Number(raumhöhe_4)
Z_45 = UnitZ(Factor=num_69)
num_71 = Number(raumhöhe_4)
Z_46 = UnitZ(Factor=num_70)
Z_47 = UnitZ(Factor=num_71)
extr_10 = Extrude(Base=boundary_8, Direction=Z_17)
num_72 = Number(raumhöhe_4)
move_20 = Move(Geometry=crv_24, Motion=Z_19)  # -> Geometry, Transform
edges_5 = BrepEdges(Brep=move_20.Geometry)  # -> Naked, Interior, NonManifold
len_6 = Length(Curve=edges_5.Naked)
divide_2 = DivideCurve(Curve=edges_5.Naked, Count=len_6, Kinks=False)  # -> Points, Tangents, Parameters
item_9 = ListItem(List=divide_2.Points, Index="0", Wrap=True)
item_10 = ListItem(List=divide_2.Tangents, Index="0", Wrap=True)
item_11 = ListItem(List=divide_2.Points, Index="0", Wrap=True)
align_2 = AlignPlane(Plane=item_9, Direction=item_10)  # -> Plane, Angle
dist_2 = Distance(PointA=item_11, PointB=divide_2.Points)
bnd_8 = Bounds(Numbers=dist_2)
num_73 = Number(raumhöhe_4)
dedom2num_2 = DeconstructDomain²(Domain=bnd_8)  # -> UMin, UMax, VMin, VMax
num_74 = Number(num_49)
Z_48 = UnitZ(Factor=num_72)
extr_11 = Extrude(Base=boundary_7, Direction=Z_14)
Z_49 = UnitZ(Factor=num_73)
subtraction_4 = Subtraction(A=dedom2num_2.UMax, B=num_74)
crv_28 = Curve(move_20.Geometry)
edges_6 = BrepEdges(Brep=crv_28)  # -> Naked, Interior, NonManifold
midpt_4 = CurveMiddle(Curve=edges_6.Naked)
line_6 = LineSDL(Start=midpt_4, Direction=Z_20, Length=Slider(100000000, range=0..100000000))
dom_8 = ConstructDomain(DomainStart=0, DomainEnd=subtraction_4)
offset_9 = OffsetCurve(Curve=crv_28, Distance=dicke_wand_2, Corners=1)
edges_7 = BrepEdges(Brep=offset_9)  # -> Naked, Interior, NonManifold
midpt_5 = CurveMiddle(Curve=edges_7.Naked)
line_7 = LineSDL(Start=midpt_5, Direction=Z_21, Length=Slider(100000000, range=0..100000000))
rectangle_4 = Rectangle(Plane=align_2.Plane, XSize=num_74, YSize=dicke_wand_2, Radius=0)  # -> Rectangle, Length
remap_3 = RemapNumbers(Value=dist_2, Source=bnd_8, Target=dom_8)  # -> Mapped, Clipped
boundary_9 = BoundarySurfaces(Edges=flatten([crv_28, offset_9]))
multiplication_11 = Multiplication(A=remap_3.Mapped, B=item_10)
num_75 = Number(raumhöhe_4)
move_21 = Move(Geometry=rectangle_4.Rectangle, Motion=multiplication_11)  # -> Geometry, Transform
num_76 = Number(raumhöhe_4)
subtraction_5 = Subtraction(A=num_75, B=höhe_ringbalken_unten)
subtraction_6 = Subtraction(A=num_76, B=höhe_ringbalken_unten)
Z_50 = UnitZ(Factor=subtraction_5)
Z_51 = UnitZ(Factor=subtraction_6)
extr_12 = Extrude(Base=boundary_9, Direction=Z_50)

# ---- group: Berechnung Dämmstärke (continued)
lng = ListLength(List=divide_2.Points)
num_77 = Number(len_6)

division_9 = Division(A=num_77, B=lng)  # -> flatten(Result)
avr = Average(Input=division_9)
division_10 = Division(A=avr, B=num_10)
num_78 = Number(division_10)
multiplication_12 = Multiplication(A=division_6, B=num_78)
subtraction_7 = Subtraction(A="1", B=num_78)
num_79 = Number(subtraction_7)
multiplication_13 = Multiplication(A=division_4, B=num_79)
addition_3 = Addition(A=multiplication_12, B=multiplication_13)
wärmewiderstand_m²_k_w_5 = Panel(addition_3)
dispatch_7 = Dispatch(List=wärmewiderstand_m²_k_w_5, DispatchPattern=bool_5)  # -> ListA, ListB
num_80 = Number([dispatch_6.ListB, dispatch_7.ListA])
ma = MassAddition(Input=flatten([num_11, num_56, num_80, dicke_latte_luftschicht_2, dicke_latte_luftschicht_8, dicke_latte_luftschicht_7, dicke_latte_luftschicht]))  # -> Result, PartialResults
berechnet_r_m2_k_w_wand = Panel(ma.Result)

berechnet_r_m2_k_w_wand_2 = Panel(berechnet_r_m2_k_w_wand)

# ---- group: Verteilung für Wand Kurven (continued)
data_31 = Data(offset_7)
data_32 = Data(offset_6)
data_33 = Data(offset_8)
p_n_c_9 = PickNChoose(Pattern=bool_13, Stream0=data_29, Stream1=data_32)
p_n_c_10 = PickNChoose(Pattern=bool_12, Stream0=data_28, Stream1=data_31)
p_n_c_11 = PickNChoose(Pattern=bool_14, Stream0=data_30, Stream1=data_33)

data_34 = Data(p_n_c_10)
data_35 = Data(p_n_c_11)
data_36 = Data(p_n_c_9)

# ---- group: Fundament (continued)
crv_29 = Curve(data_36)

# ---- group: Flachdach
# Boolean Switch Holz Stein
dicke_betondecke = Slider(0.2, range=0.07..0.25)
dicke_dampfsperre_2 = Slider(0.011, range=0.011..0.02)
dicke_dämmung = Slider(0.1, range=0..0.25)
überstand_attika = Slider(0.3, range=0.3..0.5)
ma_2 = MassAddition(Input=[dicke_betondecke, data_27, überstand_attika, dicke_dampfsperre_2, dicke_dämmung])  # -> Result, PartialResults
data_37 = Data(data_36)
höhe_attika = Number(ma_2.Result)
num_81 = Number(num)

# ---- group: Holzkonstruktion (continued)
edges_8 = BrepEdges(Brep=offset_6)  # -> Naked, Interior, NonManifold
len_7 = Length(Curve=edges_8.Naked)
divide_3 = DivideCurve(Curve=edges_8.Naked, Count=len_7, Kinks=False)  # -> Points, Tangents, Parameters
item_12 = ListItem(List=divide_3.Points, Index="0", Wrap=True)
item_13 = ListItem(List=divide_3.Points, Index="0", Wrap=True)
item_14 = ListItem(List=divide_3.Tangents, Index="0", Wrap=True)
dist_3 = Distance(PointA=item_12, PointB=divide_3.Points)
align_3 = AlignPlane(Plane=item_13, Direction=item_14)  # -> Plane, Angle
breite_der_latte_2 = Number(num_49)
bnd_9 = Bounds(Numbers=dist_3)
dedom2num_3 = DeconstructDomain²(Domain=bnd_9)  # -> UMin, UMax, VMin, VMax
subtraction_8 = Subtraction(A=dedom2num_3.UMax, B=breite_der_latte_2)
dom_9 = ConstructDomain(DomainStart=0, DomainEnd=subtraction_8)
rectangle_5 = Rectangle(Plane=align_3.Plane, XSize=breite_der_latte_2, YSize=dicke_latte_luftschicht_6, Radius=0)  # -> Rectangle, Length
remap_4 = RemapNumbers(Value=dist_3, Source=bnd_9, Target=dom_9)  # -> Mapped, Clipped
multiplication_14 = Multiplication(A=remap_4.Mapped, B=item_14)
move_22 = Move(Geometry=rectangle_5.Rectangle, Motion=multiplication_14)  # -> Geometry, Transform
vec_18 = Vector(divide_3.Tangents)
rotate_3 = Rotate(Geometry=vec_18, Angle=rad_2, Plane=PlaneXY(0, 0, 0))  # -> Geometry, Transform
addition_4 = Addition(A=dicke_diffusionsoffene_schicht_2, B=dicke_wand_2)
num_82 = Number(raumhöhe_4)
num_83 = Number(höhe_attika)
ma_3 = MassAddition(Input=[num_82, num_83])  # -> Result, PartialResults

# ---- group: Holzkonstruktion / Dachteil (continued)
srf_6 = Surface(boundary_8)
move_23 = Move(Geometry=srf_6, Motion=vec_11)  # -> Geometry, Transform
extr_13 = Extrude(Base=move_23.Geometry, Direction=Z_37)

srf_7 = Surface(boundary_7)
move_24 = Move(Geometry=srf_7, Motion=vec_17)  # -> Geometry, Transform
extr_14 = Extrude(Base=move_24.Geometry, Direction=Z_43)

# ---- group: Fundament
# Frostsicheres Fundament mind 80cm
# Mass Addition Dicke Bodenaufbau
# Mass Addition Dicke Bodenaufbau
# Mass Addition Dicke Bodenaufbau
# Mass Addition Dicke Bodenaufbau
fpatch_2 = FragmentPatch(Boundary=crv_29)
Z_52 = UnitZ(Factor=dicke_bodenbelag)
Z_53 = UnitZ(Factor=dicke_estrich)
Z_54 = UnitZ(Factor=dicke_fußbodendämmung)
Z_55 = UnitZ(Factor=dicke_dampfsperre)
Z_56 = UnitZ(Factor=dicke_bodenplatte)
neg_5 = Negative(Value=Z_52)
neg_6 = Negative(Value=Z_53)
neg_7 = Negative(Value=Z_54)
neg_8 = Negative(Value=Z_55)
neg_9 = Negative(Value=Z_56)
ma_4 = MassAddition(Input=[dicke_bodenbelag, dicke_estrich, dicke_fußbodendämmung, dicke_dampfsperre, dicke_bodenplatte])  # -> Result, PartialResults
crv_30 = Curve(crv_29)
panel_334 = Panel("Fundamenttiefe aus CSV")
move_25 = Move(Geometry=fpatch_2, Motion=neg_5)  # -> Geometry, Transform
srf_8 = Surface(move_25.Geometry)
move_26 = Move(Geometry=srf_8, Motion=neg_6)  # -> Geometry, Transform
srf_9 = Surface(move_26.Geometry)
extr_15 = Extrude(Base=fpatch_2, Direction=neg_5)
extr_16 = Extrude(Base=srf_8, Direction=neg_6)
move_27 = Move(Geometry=srf_9, Motion=neg_7)  # -> Geometry, Transform
srf_10 = Surface(move_27.Geometry)
extr_17 = Extrude(Base=srf_9, Direction=neg_7)
move_28 = Move(Geometry=srf_10, Motion=neg_8)  # -> Geometry, Transform
srf_11 = Surface(move_28.Geometry)
move_29 = Move(Geometry=srf_11, Motion=neg_9)  # -> Geometry, Transform
extr_18 = Extrude(Base=srf_10, Direction=neg_8)
extr_19 = Extrude(Base=srf_11, Direction=neg_9)
num_84 = Number(data_24)
num_85 = Number(num_18)
offset_10 = OffsetCurve(Curve=crv_30, Distance=num_84, Corners=1)
neg_10 = Negative(Value=num_85)
boundary_10 = BoundarySurfaces(Edges=flatten([crv_30, offset_10]))
Z_57 = UnitZ(Factor=neg_10)
extr_20 = Extrude(Base=boundary_10, Direction=Z_57)
data_38 = Data(extr_20)
move_30 = Move(Geometry=offset_10, Motion=Z_57)  # -> Geometry, Transform
subtraction_9 = Subtraction(A=num_85, B=ma_4.Result)
panel_337 = Panel("Kurve Abdichtung")
panel_338 = Panel("Kurve Abdichtung Außen")
panel_341 = Panel("Kurve Putz")
num_86 = Number(data_26)
num_87 = Number(data_25)
num_88 = Number(data_27)
crv_31 = Curve(data_34)
crv_32 = Curve(data_35)
num_89 = Number(data_26)
addition_5 = Addition(A=num_86, B=num_87)
offset_11 = OffsetCurve(Curve=crv_31, Distance=num_88, Corners=1)
neg_11 = Negative(Value=ma_4.Result)
neg_12 = Negative(Value=ma_4.Result)
neg_13 = Negative(Value=ma_4.Result)
Z_58 = UnitZ(Factor=subtraction_9)
boundary_11 = BoundarySurfaces(Edges=flatten([crv_31, offset_11]))
neg_14 = Negative(Value=ma_4.Result)
Z_59 = UnitZ(Factor=neg_11)
Z_60 = UnitZ(Factor=neg_12)
Z_61 = UnitZ(Factor=neg_13)
Z_62 = UnitZ(Factor=neg_14)
extr_21 = Extrude(Base=boundary_11, Direction=Z_59)
panel_345 = Panel("Logik Holzbau Wechsel")
panel_346 = Panel("Oben -> Holzbau")

panel_350 = Panel("Dampfsperre")
panel_351 = Panel("Bodenplatte")
panel_352 = Panel("Fußbodendämmung")
panel_353 = Panel("Bodenbelag")
panel_354 = Panel("Estrich")
data_39 = Data(extr_15)
data_40 = Data(extr_16)
data_41 = Data(extr_18)
data_42 = Data(extr_19)
data_43 = Data(extr_17)

panel_355 = Panel("Output Data Abdichtung")
data_44 = Data(extr_21)

# ---- group: Holzkonstruktion / Dachteil
Z_63 = UnitZ(Factor="15")

# ---- group: Fundament
# Summe aus allen Bauteilen nach Wand bilden
num_90 = Number(data_25)
num_91 = Number(data_27)
num_92 = Number(data_26)

# ---- group: Massivkonstruktion / Satteldach Randbalken
panel_361 = Panel("Nord Süd Kurven")
num_93 = Number(data_23)
neg_15 = Negative(Value=num_93)
data_45 = Data([data_7, data_9])
offset_12 = OffsetCurve(Curve=data_45, Distance=neg_15, Corners=1)
num_94 = Number(data_24)
neg_16 = Negative(Value=num_94)
offset_13 = OffsetCurve(Curve=offset_12, Distance=neg_16, Corners=1)
rulesrf = RuledSurface(CurveA=offset_12, CurveB=offset_13)
Z_64 = UnitZ(Factor=Slider(10, range=0..10))
extr_22 = Extrude(Base=rulesrf, Direction=Z_64)

# ---- group: Massivkonstruktion / Dachteil
srf_12 = Surface(boundary_3)
vec_19 = Vector(Z_24)
move_31 = Move(Geometry=srf_12, Motion=vec_19)  # -> Geometry, Transform
Z_65 = UnitZ(Factor="15")
extr_23 = Extrude(Base=move_31.Geometry, Direction=Z_65)

# ---- group: Holzkonstruktion
panel_366 = Panel("Output Data Dämmung")

panel_367 = Panel("Output Data Außenwand")

# ---- group: Massivkonstruktion
panel_368 = Panel("Output Data Dichtung")

num_95 = Number(höhe_attika)
ma_5 = MassAddition(Input=[num_67, num_95])  # -> Result, PartialResults

# ---- group: Fundament
panel_375 = Panel("Output Data Beton")

# ---- group: Massivkonstruktion
panel_382 = Panel("Logik Bauart Wechsel")
panel_383 = Panel("Oben -> Holz")

# ----
# EPW Path aus Script
# Dach Brep Joined Oben
# Logik Dachauswahl
panel_387 = Panel("Flachdach Brep")
panel_388 = Panel("Flachdach Context (Abdichtung)")
downloadepw = LBDownloadWeather(weather_URL=panel_2)  # -> epw_file, stat_file, ddy_file; plug-in component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

# ---- group: Wind und Schnee Flachdach Logik (continued)
data_46 = Data(downloadepw.epw_file)

importepw = LBImportEPW(epw_file=data_46)  # -> location, dry_bulb_temperature, dew_point_temperature, relative_humidity, wind_speed, wind_direction, direct_normal_rad, diffuse_horizontal_rad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; plug-in component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
decnstrloc = LBDeconstructLocation(location=importepw.location)  # -> name, latitude, longitude, time_zone, elevation; plug-in component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
timeop = LBTimeIntervalOperation(data=importepw.dry_bulb_temperature, operation="25")  # -> daily, monthly, mon_per_hr; plug-in component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
timeop_2 = LBTimeIntervalOperation(data=importepw.wind_speed, operation="85")  # -> daily, monthly, mon_per_hr; plug-in component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
xdata = LBDeconstructData(data=timeop.monthly)  # -> header, values; plug-in component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
xdata_2 = LBDeconstructData(data=timeop_2.monthly)  # -> header, values; plug-in component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
bnd_10 = Bounds(Numbers=xdata_2.values)
temperatur_unteres_1_4_perzentil = Panel(xdata.values)
dedomain_7 = DeconstructDomain(Domain=bnd_10)  # -> Start, End
larger_5 = LargerThan(FirstNumber=dedomain_7.End, SecondNumber=cutoff_flachdach_wind)  # -> LargerThan, OrEqualTo
smaller_5 = SmallerThan(FirstNumber=temperatur_unteres_1_4_perzentil, SecondNumber="0")  # -> SmallerThan, OrEqualTo

# Source:
# https://discourse.ladybug.tools/t/rainfall-data-component/2197/34
downloadrainfall = DownloadRainfallData(download=toggle, locationName=decnstrloc.name, latitude=decnstrloc.latitude, longitude=decnstrloc.longitude)  # -> readMe, Header, Rainfall_inch, Rainfall_mm; plug-in component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

regenmenge = Panel(downloadrainfall.Rainfall_mm)
sift = SiftPattern(List=regenmenge, SiftPattern=smaller_5.SmallerThan)  # -> Output0, Output1
nullrep = ReplaceNulls(Items=sift.Output1, Replacements="0")  # -> Items, Count
schneemenge = Panel(nullrep.Items)
bnd_11 = Bounds(Numbers=regenmenge)
bnd_12 = Bounds(Numbers=schneemenge)
dedomain_8 = DeconstructDomain(Domain=bnd_11)  # -> Start, End
dedomain_9 = DeconstructDomain(Domain=bnd_12)  # -> Start, End
larger_6 = LargerThan(FirstNumber=dedomain_8.End, SecondNumber=cutoff_flachdach_regen)  # -> LargerThan, OrEqualTo
larger_7 = LargerThan(FirstNumber=dedomain_9.End, SecondNumber=cutoff_flachdach_schnee)  # -> LargerThan, OrEqualTo
or_2 = GateOr(A=larger_6.LargerThan, B=larger_7.LargerThan)

# ----
data_47 = Data(schneemenge)
data_48 = Data(data_47)
data_49 = Data(data_47)
data_50 = Data(data_47)
data_51 = Data(data_47)
data_52 = Data(data_47)
data_53 = Data(data_47)
data_54 = Data(data_47)
data_55 = Data(data_47)
data_56 = Data(data_47)
data_57 = Data(data_47)
data_58 = Data(data_47)
data_59 = Data(data_47)
item_15 = ListItem(List=data_48, Index="4", Wrap=True)  # -> flatten(Item)
item_16 = ListItem(List=data_49, Index="3", Wrap=True)  # -> flatten(Item)
item_17 = ListItem(List=data_50, Index="5", Wrap=True)  # -> flatten(Item)
item_18 = ListItem(List=data_52, Index="11", Wrap=True)  # -> flatten(Item)
item_19 = ListItem(List=data_51, Index="2", Wrap=True)  # -> flatten(Item)
item_20 = ListItem(List=data_53, Index="10", Wrap=True)  # -> flatten(Item)
item_21 = ListItem(List=data_54, Index="0", Wrap=True)  # -> flatten(Item)
item_22 = ListItem(List=data_55, Index="1", Wrap=True)  # -> flatten(Item)
item_23 = ListItem(List=data_56, Index="7", Wrap=True)  # -> flatten(Item)
item_24 = ListItem(List=data_57, Index="8", Wrap=True)  # -> flatten(Item)
item_25 = ListItem(List=data_58, Index="9", Wrap=True)  # -> flatten(Item)
item_26 = ListItem(List=data_59, Index="7", Wrap=True)  # -> flatten(Item)
join_22 = TextJoin(Text=["Schneefall Mai [mm]", item_15], Join=" = ")
join_23 = TextJoin(Text=["Schneefall April [mm]", item_16], Join=" = ")
join_24 = TextJoin(Text=["Schneefall Juni [mm]", item_17], Join=" = ")
join_25 = TextJoin(Text=["Schneefall Dezember [mm]", item_18], Join=" = ")
join_26 = TextJoin(Text=["Schneefall März [mm]", item_19], Join=" = ")
join_27 = TextJoin(Text=["Schneefall November [mm]", item_20], Join=" = ")
join_28 = TextJoin(Text=["Schneefall Januar [mm]", item_21], Join=" = ")
join_29 = TextJoin(Text=["Schneefall Februar [mm]", item_22], Join=" = ")
join_30 = TextJoin(Text=["Schneefall August [mm]", item_23], Join=" = ")
join_31 = TextJoin(Text=["Schneefall September [mm]", item_24], Join=" = ")
join_32 = TextJoin(Text=["Schneefall Oktober [mm]", item_25], Join=" = ")
join_33 = TextJoin(Text=["Schneefall Juli [mm]", item_26], Join=" = ")
panel_395 = Panel(join_22)
panel_396 = Panel(join_23)
panel_397 = Panel(join_24)
panel_398 = Panel(join_26)
panel_399 = Panel(join_25)
panel_400 = Panel(join_27)
panel_401 = Panel(join_28)
panel_402 = Panel(join_29)
panel_403 = Panel(join_30)
panel_404 = Panel(join_33)
panel_405 = Panel(join_31)
panel_406 = Panel(join_32)
join_34 = TextJoin(Text=[panel_401, panel_402, panel_398, panel_396, panel_395, panel_397, panel_404, panel_403, panel_405, panel_406, panel_400, panel_399])
data_60 = Data(regenmenge)
data_61 = Data(data_60)
data_62 = Data(data_60)
data_63 = Data(data_60)
data_64 = Data(data_60)
data_65 = Data(data_60)
data_66 = Data(data_60)
data_67 = Data(data_60)
data_68 = Data(data_60)
data_69 = Data(data_60)
data_70 = Data(data_60)
data_71 = Data(data_60)
data_72 = Data(data_60)
item_27 = ListItem(List=data_61, Index="4", Wrap=True)  # -> flatten(Item)
item_28 = ListItem(List=data_62, Index="3", Wrap=True)  # -> flatten(Item)
item_29 = ListItem(List=data_63, Index="5", Wrap=True)  # -> flatten(Item)
item_30 = ListItem(List=data_65, Index="11", Wrap=True)  # -> flatten(Item)
item_31 = ListItem(List=data_64, Index="2", Wrap=True)  # -> flatten(Item)
item_32 = ListItem(List=data_66, Index="10", Wrap=True)  # -> flatten(Item)
item_33 = ListItem(List=data_67, Index="0", Wrap=True)  # -> flatten(Item)
item_34 = ListItem(List=data_68, Index="1", Wrap=True)  # -> flatten(Item)
item_35 = ListItem(List=data_69, Index="7", Wrap=True)  # -> flatten(Item)
item_36 = ListItem(List=data_70, Index="8", Wrap=True)  # -> flatten(Item)
item_37 = ListItem(List=data_71, Index="9", Wrap=True)  # -> flatten(Item)
item_38 = ListItem(List=data_72, Index="7", Wrap=True)  # -> flatten(Item)
join_35 = TextJoin(Text=["Niederschlag Mai [mm]", item_27], Join=" = ")
join_36 = TextJoin(Text=["Niederschlag April [mm]", item_28], Join=" = ")
join_37 = TextJoin(Text=["Niederschlag Juni [mm]", item_29], Join=" = ")
join_38 = TextJoin(Text=["Niederschlag Dezember [mm]", item_30], Join=" = ")
join_39 = TextJoin(Text=["Niederschlag März [mm]", item_31], Join=" = ")
join_40 = TextJoin(Text=["Niederschlag November [mm]", item_32], Join=" = ")
join_41 = TextJoin(Text=["Niederschlag Januar [mm]", item_33], Join=" = ")
join_42 = TextJoin(Text=["Niederschlag Februar [mm]", item_34], Join=" = ")
join_43 = TextJoin(Text=["Niederschlag August [mm]", item_35], Join=" = ")
join_44 = TextJoin(Text=["Niederschlag September [mm]", item_36], Join=" = ")
join_45 = TextJoin(Text=["Niederschlag Oktober [mm]", item_37], Join=" = ")
join_46 = TextJoin(Text=["Niederschlag Juli [mm]", item_38], Join=" = ")
panel_407 = Panel(join_35)
panel_408 = Panel(join_36)
panel_409 = Panel(join_37)
panel_410 = Panel(join_39)
panel_411 = Panel(join_38)
panel_412 = Panel(join_40)
panel_413 = Panel(join_41)
panel_414 = Panel(join_42)
panel_415 = Panel(join_43)
panel_416 = Panel(join_44)
panel_417 = Panel(join_45)
panel_418 = Panel(join_46)
join_47 = TextJoin(Text=[panel_413, panel_414, panel_410, panel_408, panel_407, panel_409, panel_418, panel_415, panel_416, panel_417, panel_412, panel_411])

# ---- group: Wind und Schnee Flachdach Logik / Dachneigung (continued)
remap_5 = RemapNumbers(Value=dedomain_9.End, Source=dom_4, Target=dom_5)  # -> Mapped, Clipped
remap_6 = RemapNumbers(Value=dedomain_8.Start, Source=dom_3, Target=dom_6)  # -> Mapped, Clipped
max = Maximum(A=remap_5.Mapped, B="25")
max_2 = Maximum(A=remap_6.Mapped, B="25")
min = Minimum(A=max, B="40")
min_2 = Minimum(A=max_2, B="45")

# ---- group: Wind und Schnee Flachdach Logik
or_3 = GateOr(A=or_2, B=larger_5.LargerThan)
p_n_c_12 = PickNChoose(Pattern=or_3, Stream0="Flachdach", Stream1="Schrägdach")  # -> flatten(Result)
invbool = InvertBoolean(Boolean=or_3)  # -> Inverted, Number
python_5 = GhPythonScript(bool_regen=larger_6.LargerThan, bool_schnee=larger_7.LargerThan, bool_wind=larger_5.LargerThan)  # -> out, flatten(text); inputs bool_regen: Boolean, bool_schnee: Boolean
# ---------- python_5: Python ----------
__author__ = "mfls"
__version__ = "2024.10.03"

import rhinoscriptsyntax as rs

# Eingabe-Parameter:
# bool_regen: Boolean, ob Regenverhältnisse relevant sind
# bool_schnee: Boolean, ob Schnee-Verhältnisse relevant sind
# bool_wind: Boolean, ob Windverhältnisse relevant sind

# Leere Liste zum Speichern der Bedingungen
gründe = []

# Überprüfen der Wetterbedingungen und Hinzufügen der entsprechenden Gründe
if bool_regen:
    gründe.append("Regen")
if bool_schnee:
    gründe.append("Schnee")
if bool_wind:
    gründe.append("Wind")

# Logik für die Dachauswahl basierend auf den Wetterbedingungen
if len(gründe) == 0:
    dach = "Es wurde ein Flachdach gewählt, da die Wetterbedingungen kein Schrägdach erforderlich machen."
elif len(gründe) == 1:
    dach = "Es wurde ein Satteldach gewählt, da die {}verhältnisse es erfordern.".format(gründe[0])
elif len(gründe) == 2:
    dach = "Es wurde ein Satteldach gewählt, da die {}- und {}verhältnisse es erfordern.".format(gründe[0], gründe[1])
else:
    dach = "Es wurde ein Satteldach gewählt, da sowohl Regen-, Schnee- als auch die Windverhältnisse es erfordern."

# Ausgabe des Strings
print(dach)  # Debug-Ausgabe (optional)
text = dach
# ---------- end python_5 ----------
bool_16 = Boolean(invbool.Inverted)

# ---- group: Wind und Schnee Flachdach Logik / Dachneigung
max_3 = Maximum(A=min, B=min_2)
num_96 = Number(flatten(max_3))

# ---- group: Textverarbeitung (continued)
panel_419 = Panel(num_96)

# ---- group: Innentüre und Wände (continued)
dispatch_8 = Dispatch(List=srf_2, DispatchPattern=bool_16)  # -> ListA, ListB
srf_13 = Surface(dispatch_8.ListA)
extr_24 = Extrude(Base=srf_13, Direction=Z_6)
data_73 = Data(extr_24)

# ---- group: Flachdach / Holz Attika
# Nur Aktiv wenn Holz Aktiv
# Boolean Switch Holz Stein
# Raumhöhe - Höhe Ringbalken Unten
panel_420 = Panel("Höhe Attika")
num_97 = Number(höhe_attika)
panel_421 = Panel("Höhe Deckenplatte")
subtraction_10 = Subtraction(A=num_97, B=dicke_betondecke)
panel_425 = Panel("Kuve Dämmung Oben")
addition_6 = Addition(A=num_81, B=dicke_betondecke)
crv_33 = Curve(move_19.Geometry)
dispatch_9 = Dispatch(List=data_36, DispatchPattern=bool_16)  # -> ListA, ListB
Z_66 = UnitZ(Factor=addition_6)
dispatch_10 = Dispatch(List=move_21.Geometry, DispatchPattern=bool_3)  # -> ListA, ListB
dispatch_11 = Dispatch(List=crv_33, DispatchPattern=bool_16)  # -> ListA, ListB
move_32 = Move(Geometry=dispatch_9.ListA, Motion=Z_66)  # -> Geometry, Transform
dispatch_12 = Dispatch(List=dispatch_10.ListA, DispatchPattern=bool_16)  # -> ListA, ListB
panel_436 = Panel("Dicke Abschlussbrett")
crv_34 = Curve(move_32.Geometry)
num_98 = Number(data_24)
num_99 = Number(höhe_attika)
num_100 = Number(subtraction_6)
Z_67 = UnitZ(Factor=num_99)
offset_14 = OffsetCurve(Curve=crv_34, Distance=num_98, Corners=1)
Z_68 = UnitZ(Factor=num_100)
dicke_abschlussbrett = Slider(0.03, range=0..0.1)
subtraction_11 = Subtraction(A=subtraction_10, B=dicke_abschlussbrett)
move_33 = Move(Geometry=dispatch_11.ListA, Motion=Z_67)  # -> Geometry, Transform
subtraction_12 = Subtraction(A=höhe_attika, B=dicke_abschlussbrett)
boundary_12 = BoundarySurfaces(Edges=flatten([crv_34, offset_14]))
move_34 = Move(Geometry=dispatch_12.ListA, Motion=Z_68)  # -> Geometry, Transform
Z_69 = UnitZ(Factor=subtraction_11)
panel_440 = Panel("Dicke Ringbalken / Decke")
crv_35 = Curve(move_33.Geometry)
dicke_wand_3 = Number(dicke_wand_2)
extr_25 = Extrude(Base=boundary_12, Direction=Z_69)
offset_15 = OffsetCurve(Curve=crv_35, Distance=dicke_wand_3, Corners=1)
num_101 = Number(dicke_betondecke)
Z_70 = UnitZ(Factor=dicke_abschlussbrett)
subtraction_13 = Subtraction(A=subtraction_12, B=num_101)
Z_71 = UnitZ(Factor=num_101)
boundary_13 = BoundarySurfaces(Edges=flatten([crv_35, offset_15]))
move_35 = Move(Geometry=move_34.Geometry, Motion=Z_71)  # -> Geometry, Transform
extr_26 = Extrude(Base=boundary_13, Direction=Z_70)
Z_72 = UnitZ(Factor=subtraction_13)
data_74 = Data(extr_26)
extr_27 = Extrude(Base=move_35.Geometry, Direction=Z_72)
cap_2 = CapHoles(Brep=extr_27)
cap_3 = CapHoles(Brep=data_74)
fastsdiff = FastSolidDifference(
    SubtractFrom=extr_25,
    SubtractWith=cap_2,
    Tolerance=0.01,
    computeBBFastSolidDiff=True,
    retainFastSolidDiff=True,
    strictFastSolidDiff=True,
    trueIntFastSolidDiff=False)

# ---- group: Flachdach / Massivbau Attika
dispatch_13 = Dispatch(List=data_37, DispatchPattern=bool_16)  # -> ListA, ListB
Z_73 = UnitZ(Factor=num_81)
move_36 = Move(Geometry=dispatch_13.ListA, Motion=Z_73)  # -> Geometry, Transform
offset_16 = OffsetCurve(Curve=move_36.Geometry, Distance=data_24, Corners=1)
boundary_14 = BoundarySurfaces(Edges=flatten([offset_16, move_36.Geometry]))
Z_74 = UnitZ(Factor=höhe_attika)
extr_28 = Extrude(Base=boundary_14, Direction=Z_74)
dispatch_14 = Dispatch(List=extr_28, DispatchPattern=bool_3)  # -> ListA, ListB

# ---- group: Flachdach / Abdichtung
# Randkurve Wand für Sweep Innere Abdichtung
# Brep Mauer für Abdichtung Oberseite Mauer
panel_448 = Panel("Innenkurve Abdichtung")
dispatch_15 = Dispatch(List=data_34, DispatchPattern=bool_16)  # -> ListA, ListB
Z_75 = UnitZ(Factor=num_81)
num_102 = Number(data_27)
move_37 = Move(Geometry=dispatch_15.ListA, Motion=Z_75)  # -> Geometry, Transform
num_103 = Number(höhe_attika)
offset_17 = OffsetCurve(Curve=move_37.Geometry, Distance=num_102, Corners=1)
addition_7 = Addition(A=num_103, B=num_102)
boundary_15 = BoundarySurfaces(Edges=flatten([move_37.Geometry, offset_17]))
Z_76 = UnitZ(Factor=addition_7)
extr_29 = Extrude(Base=boundary_15, Direction=Z_76)
Z_77 = UnitZ(Factor=höhe_attika)
brep_3 = Brep(boundary_14)
move_38 = Move(Geometry=brep_3, Motion=Z_77)  # -> Geometry, Transform
Z_78 = UnitZ(Factor=num_102)
extr_30 = Extrude(Base=move_38.Geometry, Direction=Z_78)
addition_8 = Addition(A=höhe_attika, B=num_81)
num_104 = Number(data_27)
crv_36 = Curve(data_36)
addition_9 = Addition(A=addition_8, B=num_104)
dispatch_16 = Dispatch(List=crv_36, DispatchPattern=bool_16)  # -> ListA, ListB
Z_79 = UnitZ(Factor=addition_9)
panel_460 = Panel("Dicke Deckenplatte")
move_39 = Move(Geometry=dispatch_16.ListA, Motion=Z_79)  # -> Geometry, Transform
num_105 = Number(höhe_attika)
neg_17 = Negative(Value=num_104)
subtraction_14 = Subtraction(A=num_105, B=dicke_betondecke)
offset_18 = OffsetCurve(Curve=move_39.Geometry, Distance=neg_17, Corners=1)
neg_18 = Negative(Value=subtraction_14)
boundary_16 = BoundarySurfaces(Edges=flatten([offset_18, move_39.Geometry]))
Z_80 = UnitZ(Factor=neg_18)
extr_31 = Extrude(Base=boundary_16, Direction=Z_80)
data_75 = Data(extr_31)

# ---- group: Flachdach / Massivbau Attika
data_76 = Data(dispatch_14.ListB)

# ---- group: Flachdach / Holz Attika
data_77 = Data([cap_2, cap_3])

data_78 = Data(fastsdiff)

# ---- group: Flachdach / Abdichtung
data_79 = Data([data_75, extr_29, extr_30])

# ---- group: Textverarbeitung (continued)
panel_466 = Panel(p_n_c_12)

join_48 = TextJoin(Text=[panel_38, panel_419], Join=" = ")
join_49 = TextJoin(Text=[panel_45, panel_466], Join=" = ")
join_50 = TextJoin(Text=[join_49, python_5.text], Join=" weil ")

# ---- group: Innentüre und Wände / Dachteil (continued)
extr_32 = Extrude(Base=dispatch_8.ListB, Direction=Z_11)

# ---- group: Massivkonstruktion (continued)
dispatch_17 = Dispatch(List=Z_25, DispatchPattern=bool_16)  # -> ListA, ListB
dispatch_18 = Dispatch(List=Z_28, DispatchPattern=bool_16)  # -> ListA, ListB
extr_33 = Extrude(Base=boundary_3, Direction=dispatch_17.ListA)
dispatch_19 = Dispatch(List=Z_29, DispatchPattern=bool_16)  # -> ListA, ListB
dispatch_20 = Dispatch(List=Z_30, DispatchPattern=bool_16)  # -> ListA, ListB
dispatch_21 = Dispatch(List=Z_34, DispatchPattern=bool_16)  # -> ListA, ListB
extr_34 = Extrude(Base=boundary_4, Direction=dispatch_19.ListA)

# ---- group: Holzkonstruktion (continued)
dispatch_22 = Dispatch(List=Z_45, DispatchPattern=bool_16)  # -> ListA, ListB
dispatch_23 = Dispatch(List=Z_46, DispatchPattern=bool_16)  # -> ListA, ListB
dispatch_24 = Dispatch(List=Z_47, DispatchPattern=bool_16)  # -> ListA, ListB
extr_35 = Extrude(Base=boundary_7, Direction=dispatch_22.ListA)
dispatch_25 = Dispatch(List=Z_48, DispatchPattern=bool_16)  # -> ListA, ListB
dispatch_26 = Dispatch(List=Z_49, DispatchPattern=bool_16)  # -> ListA, ListB
extr_36 = Extrude(Base=boundary_8, Direction=dispatch_25.ListA)
dispatch_27 = Dispatch(List=Z_51, DispatchPattern=bool_16)  # -> ListA, ListB
extr_37 = Extrude(Base=move_21.Geometry, Direction=dispatch_27.ListA)
cap_4 = CapHoles(Brep=extr_37)

dispatch_28 = Dispatch(List=ma_3.Result, DispatchPattern=bool_16)  # -> ListA, ListB
Z_81 = UnitZ(Factor=dispatch_28.ListA)

# ---- group: Massivkonstruktion (continued)
dispatch_29 = Dispatch(List=ma_5.Result, DispatchPattern=bool_16)  # -> ListA, ListB
Z_82 = UnitZ(Factor=dispatch_29.ListA)

# ---- group: Satteldach
panel_468 = Panel("Dachüberstand")
Z_83 = UnitZ(Factor=num)

# Logik Dicke zweite Dämmschicht Holz
panel_470 = Panel("Dämmstärke aus CSV")
dicke_unterspannbahn = Slider(0.005, range=0.001..0.1)
dicke_vorverdeckung = Slider(0.005, range=0.001..0.1)
dicke_lattung = Slider(0.03, range=0.01..0.1)
breite_balken = Slider(0.05, range=0..1)
höhe_balken = Slider(0.2, range=0..1)
num_106 = Number(höhe_balken)
num_107 = Number(höhe_balken)
num_108 = Number(dicke_unterspannbahn)
dicke_vorverdeckung_2 = Number(dicke_vorverdeckung)
num_109 = Number(breite_balken)
num_110 = Number(dicke_lattung)

# ---- group: Flachdach
# Boolean Switch Holz Stein
panel_472 = Panel("Außenkurve Rand")
panel_473 = Panel("Dicke Aufbau Attika")
num_111 = Number(data_27)
num_112 = Number(data_27)
num_113 = Number(dicke_dämmung)
num_114 = Number(data_24)
num_115 = Number(dicke_dampfsperre_2)
num_116 = Number(data_25)
num_117 = Number(data_26)
panel_474 = Panel("Abdichtung 2 mal")
num_118 = Number(num_111)
num_119 = Number(num_111)
panel_475 = Panel("Dicke Dichtung")
panel_476 = Panel("Dicke Dach Dämmung")
panel_479 = Panel("Dachneigung Flachdach")
addition_10 = Addition(A=höhe_attika, B=num_81)
num_120 = Number(data_27)
num_121 = Number(dicke_dämmung)
addition_11 = Addition(A=addition_10, B=num_120)
addition_12 = Addition(A=num_121, B=addition_11)
addition_13 = Addition(A=addition_12)
Z_84 = UnitZ(Factor=addition_13)
num_122 = Number(höhe_attika)
division_11 = Division(A=num_122, B="4")
neg_19 = Negative(Value=division_11)
Z_85 = UnitZ(Factor=neg_19)
num_123 = Number(höhe_attika)
division_12 = Division(A=num_123, B="4")
neg_20 = Negative(Value=division_12)
Z_86 = UnitZ(Factor=neg_20)
abdeckung_dach_dicke = Slider(0.015, range=0.01..0.02)

# ---- group: Satteldach
Z_87 = UnitZ(Factor=1)
md_slider_5 = MDSlider(SliderMode=0, slider_value=Point(0.5, 0.5, 0.5), x_domain=Domain(0, 1), y_domain=Domain(0, 1), z_domain=Domain(0, 1))
xy_3 = XYPlane(Origin=Point(0, 0, 0))
Y_3 = UnitY(Factor=1)
list = ValueList({"Round : Constant slope (sand)": 0, "Butt  : Angular (roof)": 1, "Square : Simple": 2, "Ellipse : Constant slope (sand)": 3}, selected="Butt  : Angular (roof)")

# ---- group: Flachdach / Dämmung
# Randkurve Wand für Sweep Innere Dämmung
# Kurve Abdichtung Dach Oben Außen
panel_484 = Panel("Innenkurve Dämmung")
dispatch_30 = Dispatch(List=data_35, DispatchPattern=bool_16)  # -> ListA, ListB
Z_88 = UnitZ(Factor=num_81)
move_40 = Move(Geometry=dispatch_30.ListA, Motion=Z_88)  # -> Geometry, Transform
panel_488 = Panel("Dicke Aüßere Dämmung")
num_124 = Number(höhe_attika)
num_125 = Number(dicke_dämmung)
addition_14 = Addition(A=num_124, B=num_125)
Z_89 = UnitZ(Factor=addition_14)
num_126 = Number(data_27)
multiplication_15 = Multiplication(A=num_126, B="2")
crv_37 = Curve(offset_18)
num_127 = Number(data_24)
addition_15 = Addition(A=num_127, B=multiplication_15)
offset_19 = OffsetCurve(Curve=crv_37, Distance=addition_15, Corners=1)
num_128 = Number(dicke_dämmung)
num_129 = Number(data_27)
boundary_17 = BoundarySurfaces(Edges=flatten([crv_37, offset_19]))
subtraction_15 = Subtraction(A=num_128, B=num_129)
Z_90 = UnitZ(Factor=subtraction_15)
extr_38 = Extrude(Base=boundary_17, Direction=Z_90)
addition_16 = Addition(A=höhe_attika, B=num_81)
num_130 = Number(dicke_dämmung)
num_131 = Number(data_27)
crv_38 = Curve(data_36)
addition_17 = Addition(A=addition_16, B=num_130)
dispatch_31 = Dispatch(List=crv_38, DispatchPattern=bool_16)  # -> ListA, ListB
Z_91 = UnitZ(Factor=addition_17)
move_41 = Move(Geometry=dispatch_31.ListA, Motion=Z_91)  # -> Geometry, Transform
neg_21 = Negative(Value=num_131)
offset_20 = OffsetCurve(Curve=move_41.Geometry, Distance=neg_21, Corners=1)
neg_22 = Negative(Value=num_130)
num_132 = Number(höhe_attika)
offset_21 = OffsetCurve(Curve=offset_20, Distance=neg_22, Corners=1)
subtraction_16 = Subtraction(A=num_132, B=dicke_betondecke)
neg_23 = Negative(Value=subtraction_16)
boundary_18 = BoundarySurfaces(Edges=flatten([offset_21, offset_20]))
Z_92 = UnitZ(Factor=neg_23)
extr_39 = Extrude(Base=boundary_18, Direction=Z_92)
data_80 = Data(extr_39)
panel_506 = Panel("Abzug Abdichtung")
fastsdiff_2 = FastSolidDifference(
    SubtractFrom=data_80,
    SubtractWith=data_75,
    Tolerance=0.01,
    computeBBFastSolidDiff=True,
    retainFastSolidDiff=True,
    strictFastSolidDiff=True,
    trueIntFastSolidDiff=False)

# ---- group: Flachdach / Abdichtung
# Kurve Dämmung Dach Oben Außen
panel_507 = Panel("Innenkurve Putz")
Z_93 = UnitZ(Factor=num_81)
num_133 = Number(dicke_dämmung)
num_134 = Number(höhe_attika)
num_135 = Number(data_26)
ma_6 = MassAddition(Input=[num_134, num_133])  # -> Result, PartialResults
Z_94 = UnitZ(Factor=ma_6.Result)
num_136 = Number(höhe_attika)
num_137 = Number(dicke_dämmung)
addition_18 = Addition(A=num_136, B=num_137)
Z_95 = UnitZ(Factor=addition_18)
crv_39 = Curve(offset_21)
num_138 = Number(data_27)
Z_96 = UnitZ(Factor=num_138)
move_42 = Move(Geometry=crv_39, Motion=Z_96)  # -> Geometry, Transform
num_139 = Number(höhe_attika)
num_140 = Number(data_27)
subtraction_17 = Subtraction(A=num_139, B=dicke_betondecke)
neg_24 = Negative(Value=num_140)
offset_22 = OffsetCurve(Curve=move_42.Geometry, Distance=neg_24, Corners=1)
addition_19 = Addition(A=subtraction_17, B=num_140)
neg_25 = Negative(Value=addition_19)
boundary_19 = BoundarySurfaces(Edges=flatten([offset_22, move_42.Geometry]))
Z_97 = UnitZ(Factor=neg_25)
extr_40 = Extrude(Base=boundary_19, Direction=Z_97)

# ---- group: Flachdach / Deckenaufbau Flachdach
dispatch_32 = Dispatch(List=data_37, DispatchPattern=bool_16)  # -> ListA, ListB
Z_98 = UnitZ(Factor=num_81)
move_43 = Move(Geometry=dispatch_32.ListA, Motion=Z_98)  # -> Geometry, Transform
panel_524 = Panel("Dicke Betondecke")
Z_99 = UnitZ(Factor=dicke_betondecke)
fpatch_3 = FragmentPatch(Boundary=move_43.Geometry)
number_slider_5 = Slider(2.86, range=1..5)
extr_41 = Extrude(Base=fpatch_3, Direction=Z_99)
move_44 = Move(Geometry=move_43.Geometry, Motion=Z_99)  # -> Geometry, Transform
list_2 = ValueList({"Round : Constant slope (sand)": 0, "Butt  : Angular (roof)": 1, "Square : Simple": 2, "Ellipse : Constant slope (sand)": 3}, selected="Round : Constant slope (sand)")
rad_4 = Radians(Degrees=number_slider_5)
flip_3 = FlipCurve(Curve=move_44.Geometry)  # -> Curve, Flag
panel_525 = Panel("Dicke Dampfsperre")
Z_100 = UnitZ(Factor=dicke_dampfsperre_2)
Z_101 = UnitZ(Factor=dicke_dämmung)
Z_102 = UnitZ(Factor=data_27)
panel_529 = Panel("""Abzug Abdichtung
+ Dämmung""")

# Credit: Laurent Delrieu
# 
# https://discourse.mcneel.com/u/laurent_delrieu/summary
# 
# Modified by Maximilian Schäfer to work with Rhino compute
modified_c = CSharpScript(polyline=flip_3.Curve, angles=rad_4, type=list_2)  # -> out, roofs; inputs polyline: Polyline, angles: list of Double, type: Int32
# ---------- modified_c: C# usings ----------
using System.IO;
using System.Linq;
using System.Data;
using System.Drawing;
using System.Reflection;
using System.Windows.Forms;
using System.Xml;
using System.Xml.Linq;
using System.Runtime.InteropServices;

using Rhino.Collections;
using GH_IO;
using GH_IO.Serialization;
# ---------- modified_c: C# ----------
    //Medial Axis
    //Laurent Delrieu
    //31 / 12 / 2017
    //l.delrieu@neuf.fr

    if (angles.Count < (polyline.Count - 1))
    {
      double defaultAngle = Math.PI / 4;
      if (angles.Count > 0)
      {
        defaultAngle = angles[angles.Count - 1];
        Component.AddRuntimeMessage(GH_RuntimeMessageLevel.Warning, "Not enough angles, by default " + RhinoMath.ToDegrees(angles[angles.Count - 1]) + "° taken");
      }
      else
      {
        Component.AddRuntimeMessage(GH_RuntimeMessageLevel.Warning, "Not enough angles, by default 45° is taken");
      }

      for(int i = angles.Count ; i < (polyline.Count - 1); i++)
      {
        angles.Add(defaultAngle);
      }
    }
    roofs = SandDune(polyline, angles, type, false, true);
# ---------- modified_c: C# additional code ----------
  //Calculation of 45° roof with differents valley
  //Type = 0 => Round : Constant slope (sand)
  //Type = 1 => Butt  : Angular (roof)
  //Type = 2 => Square : Simple
  //Type = 3 => Ellipse : Constant slope (sand)
  public List<Brep> SandDune(Polyline polyline, List<double> angles, int type, bool isV6, bool parallel)
  {
    List<Brep> output = new List<Brep>();

    //By default round type
    if (type < 0) type = 0;
    if (type > 3) type = 0;

    if (polyline != null)
    {
      double tol = 0.01;
      bool isClosed = polyline.IsClosedWithinTolerance(tol);
      //Polyline is closed if not closed
      if (!isClosed)
      {
        polyline.Add(polyline[0]);
      }
      //Just in case
      polyline.CollapseShortSegments(tol * 2);
      Curve polylineCurve = polyline.ToNurbsCurve();

      //Definition of orientation of polyline
      int orientation = 1;
      if (isV6)
      {
        //CurveOrientation (inverted in RH5 vs RH6
        // Undefined          0 Orientation is undefined.
        // Clockwise         -1 The curve's orientation is clockwise in the xy plane.
        // CounterClockwise   1 The curve's orientation is counter clockwise in the xy plane
        CurveOrientation curveOrientation = polylineCurve.ClosedCurveOrientation(Plane.WorldXY);
        if (curveOrientation == CurveOrientation.Clockwise) orientation = -1;
        else orientation = 1;
      }
      else
      {
        //Use of classical surface calculation of polyline
        if (SurfaceOnXYplane(polyline) > 0)  orientation = -1;
        else orientation = 1;
      }

      //Bounding box calculation in order to have the max horizontal distances for the roofs surfaces (before cut)
      BoundingBox bb = polylineCurve.GetBoundingBox(false);
      double maxLength = bb.Diagonal.Length;

      //List of brep representing the roof before cut
      List<Brep> breps = new List<Brep>();
      //Side of roof
      for (int i = 0; i < (polyline.Count - 1); i++)
      {
        //Calculate direction of line
        Point3d p1 = polyline[i];
        Point3d p2 = polyline[(i + 1)];
        Vector3d direction12 = (p2 - p1) * orientation;
        direction12.Unitize();
        //Calculate a perpendicular
        Vector3d perp12 = Vector3d.CrossProduct(direction12, Vector3d.ZAxis);
        perp12.Unitize();
        //Because move is one unit horizontal (per12) + one unit in Z => 45°
        //if you want other angle put a coefficient on perp12 (0 => 90°)
        Vector3d move = perp12 * Math.Tan(Math.PI / 2 - angles[i]) + Vector3d.ZAxis;
        move *= maxLength;

        //Make a sweep
        var sweep = new Rhino.Geometry.SweepOneRail();
        sweep.AngleToleranceRadians = 0.0174533;
        sweep.ClosedSweep = false;
        sweep.SweepTolerance = 0.01;

        Brep[] sideBreps = sweep.PerformSweep(new LineCurve(p1, p1 + move), new LineCurve(p1, p2));
        if (sideBreps.Length > 0) breps.Add(sideBreps[0]);
      }

      //Valley parts of the roof
      for (int i = 0; i < (polyline.Count - 1); i++)
      {
        //Calculate direction of line
        int index;
        if (i == 0)
        {
          index = polyline.Count - 2;
        }
        else
        {
          index = i - 1;
        }
        Point3d p1 = polyline[index];
        Point3d p2 = polyline[i];
        Point3d p3 = polyline[i + 1];

        Vector3d direction12 = (p2 - p1);
        direction12.Unitize();
        Vector3d direction23 = (p3 - p2);
        direction23.Unitize();

        Brep rp = new Brep();
        //Round type
        if (type == 0)
        {
          rp = ValleyRound(p2, direction12, direction23, angles[index], angles[i], maxLength, orientation);
          if (rp.IsValid) breps.Add(rp);
        }
        //Butt type
        if (type == 1)
        {
          Brep[] vv = ValleyButt(p2, direction12, direction23, angles[index], angles[i], maxLength, orientation);
          if (vv.Length >= 2)
          {
            if (vv[0].IsValid) breps.Add(vv[0]);
            if (vv[1].IsValid) breps.Add(vv[1]);
          }
        }
        //Square type
        if (type == 2)
        {
          rp = ValleySquare(p2, direction12, direction23, angles[index], angles[i], maxLength, orientation);
          if (rp.IsValid) breps.Add(rp);
        }
        //Square type
        if (type == 3)
        {
          rp = ValleyRound2(p2, direction12, direction23, angles[index], angles[i], maxLength, orientation);
          if (rp.IsValid) breps.Add(rp);
        }
      }
      output = CutBreps(breps, tol, polylineCurve, parallel);
    }
    return output;
  }
  public Brep ValleyRound(Point3d p2, Vector3d v12, Vector3d v23, double angle12, double angle23, double maxLength, int orientation)
  {
    Brep output = new Brep();
    Vector3d vv = Vector3d.CrossProduct(v12, v23);
    if (vv.Z * orientation > 0)
    {
      Vector3d perp12 = Vector3d.CrossProduct(v12, Vector3d.ZAxis * orientation);
      perp12.Unitize();
      Vector3d move12 = perp12 * Math.Tan(Math.PI / 2 - angle12) + Vector3d.ZAxis;
      move12 *= maxLength;

      Vector3d perp23 = Vector3d.CrossProduct(v23, Vector3d.ZAxis * orientation);
      perp23.Unitize();
      Vector3d move23 = perp23 * Math.Tan(Math.PI / 2 - angle23) + Vector3d.ZAxis;
      move23 *= maxLength;

      Arc arc = new Arc(p2 + move12, v12, p2 + move23);

      var sweep = new Rhino.Geometry.SweepTwoRail();
      sweep.AngleToleranceRadians = 0.0174533;
      sweep.ClosedSweep = false;
      sweep.SweepTolerance = 0.01;

      Brep[] sideBreps = sweep.PerformSweep(new LineCurve(p2 + move12, p2), new LineCurve(p2 + move23, p2), arc.ToNurbsCurve());
      if (sideBreps.Length > 0) output = sideBreps[0];
    }
    return output;
  }

  //Butt valley
  public Brep ValleyRound2(Point3d p2, Vector3d v12, Vector3d v23, double angle12, double angle23, double maxLength, int orientation)
  {
    Brep output = new Brep();
    Vector3d vv = Vector3d.CrossProduct(v12, v23);
    if (vv.Z * orientation > 0)
    {
      Vector3d perp12 = Vector3d.CrossProduct(v12, Vector3d.ZAxis * orientation);
      perp12.Unitize();
      Vector3d move12 = perp12 * Math.Tan(Math.PI / 2 - angle12) + Vector3d.ZAxis;
      move12 *= maxLength;

      Vector3d perp23 = Vector3d.CrossProduct(v23, Vector3d.ZAxis * orientation);
      perp23.Unitize();
      Vector3d move23 = perp23 * Math.Tan(Math.PI / 2 - angle23) + Vector3d.ZAxis;
      move23 *= maxLength;

      // Arc arc = new Arc(p2 + move12, v12, p2 + move23);
      Line l12 = new Line(p2 + move12, v12);
      Line l23 = new Line(p2 + move23, v23);
      Point3d pmid = p2 + (move23 + move12) / 2;
      double a, b;
      if (Rhino.Geometry.Intersect.Intersection.LineLine(l12, l23, out a, out b, 0.01, false))
      {
        pmid = l12.PointAt(a);
      }
      else
      {
        MessageBox.Show("pas passage");
      }
      var sweep = new Rhino.Geometry.SweepTwoRail();
      sweep.AngleToleranceRadians = 0.0174533;
      sweep.ClosedSweep = false;
      sweep.SweepTolerance = 0.01;

      // Brep[] sideBreps = sweep.PerformSweep(new LineCurve(p2 + move12, p2), new LineCurve(p2 + move23, p2), arc.ToNurbsCurve());
      Brep[] sideBreps = sweep.PerformSweep(new LineCurve(p2 + move12, p2), new LineCurve(p2 + move23, p2), ThreePointsToArc(p2 + move12, pmid, p2 + move23));
      if (sideBreps.Length > 0) output = sideBreps[0];
    }
    return output;


  }


  //Butt valley
  public Brep[] ValleyButt(Point3d p2, Vector3d v12, Vector3d v23, double angle12, double angle23, double maxLength, int orientation)
  {
    Brep[] output = new Brep[2];
    output[0] = new Brep();
    output[1] = new Brep();

    Vector3d vv = Vector3d.CrossProduct(v12, v23);
    if (vv.Z * orientation > 0)
    {
      Vector3d perp12 = Vector3d.CrossProduct(v12, Vector3d.ZAxis * orientation);
      perp12.Unitize();
      Vector3d move12 = perp12 * Math.Tan(Math.PI / 2 - angle12) + Vector3d.ZAxis;
      move12 *= maxLength;

      Vector3d perp23 = Vector3d.CrossProduct(v23, Vector3d.ZAxis * orientation);
      perp23.Unitize();
      Vector3d move23 = perp23 * Math.Tan(Math.PI / 2 - angle23) + Vector3d.ZAxis;
      move23 *= maxLength;

      Line l12 = new Line(p2 + move12, v12);
      Line l23 = new Line(p2 + move23, v23);

      Point3d pmid = p2 + (move23 + move12) / 2;
      double a, b;
      if (Rhino.Geometry.Intersect.Intersection.LineLine(l12, l23, out a, out b, 0.01, false))
      {
        pmid = l12.PointAt(a);
      }
      var sweep = new Rhino.Geometry.SweepTwoRail();
      sweep.AngleToleranceRadians = 0.0174533;
      sweep.ClosedSweep = false;
      sweep.SweepTolerance = 0.01;

      Brep[] sideBreps = sweep.PerformSweep(new LineCurve(p2 + move12, p2), new LineCurve(pmid, p2), new LineCurve(p2 + move12, pmid));
      if (sideBreps.Length > 0) output[0] = sideBreps[0];

      sideBreps = sweep.PerformSweep(new LineCurve(pmid, p2), new LineCurve(p2 + move23, p2), new LineCurve(pmid, p2 + move23));
      if (sideBreps.Length > 0) output[1] = sideBreps[0];
    }
    return output;
  }

  //Square Valley
  public Brep ValleySquare(Point3d p2, Vector3d v12, Vector3d v23, double angle12, double angle23, double maxLength, int orientation)
  {
    Brep output = new Brep();
    Vector3d vv = Vector3d.CrossProduct(v12, v23);
    if (vv.Z * orientation > 0)
    {
      Vector3d perp12 = Vector3d.CrossProduct(v12, Vector3d.ZAxis * orientation);
      perp12.Unitize();
      Vector3d move12 = perp12 * Math.Tan(Math.PI / 2 - angle12) + Vector3d.ZAxis;
      move12 *= maxLength;

      Vector3d perp23 = Vector3d.CrossProduct(v23, Vector3d.ZAxis * orientation);
      perp23.Unitize();
      Vector3d move23 = perp23 * Math.Tan(Math.PI / 2 - angle23) + Vector3d.ZAxis;
      move23 *= maxLength;


      var sweep = new Rhino.Geometry.SweepTwoRail();
      sweep.AngleToleranceRadians = 0.0174533;
      sweep.ClosedSweep = false;
      sweep.SweepTolerance = 0.01;

      Brep[] sideBreps = sweep.PerformSweep(new LineCurve(p2 + move12, p2), new LineCurve(p2 + move23, p2), new LineCurve(p2 + move12, p2 + move23));
      if (sideBreps.Length > 0) output = sideBreps[0];
    }
    return output;
  }

  //Cut the roof complete surface with curves
  //Example here
  //  https://discourse.mcneel.com/t/splitting-a-brep-by-a-curve-rhinocommon/17435/2
  public List<Brep> CutBreps(List<Brep> breps, double tol, Curve curve, bool parallel)
  {
    List<Brep> output = new List<Brep>();

    if (parallel)
    {
      System.Threading.Tasks.Parallel.For(0, breps.Count,
        i => {
        List<Curve> curves = BrepsCurvesIntersection(breps, i, tol, parallel);

        List<Brep> bb = new List<Brep>();
        BrepFace bf = breps[i].Faces[0];
        Brep split = bf.Split(curves, tol);
        if (split != null)
        {
          foreach(BrepFace splitFace in split.Faces)
          {
            bb.Add(splitFace.DuplicateFace(false));
          }
        }
        output.AddRange(LowerBrep(bb, curve, tol));
        });
    }
    else
    {
      //Not parallel
      for (int i = 0; i < breps.Count; i++)
      {
        List<Curve> curves = BrepsCurvesIntersection(breps, i, tol, parallel);

        List<Brep> bb = new List<Brep>();
        BrepFace bf = breps[i].Faces[0];
        Brep split = bf.Split(curves, tol);
        if (split != null)
        {
          foreach(BrepFace splitFace in split.Faces)
          {
            bb.Add(splitFace.DuplicateFace(false));
          }
        }
        output.AddRange(LowerBrep(bb, curve, tol));
      }
    }
    return output;
  }

  //Determine the intersection between the roofs
  public List<Curve> BrepsCurvesIntersection(List<Brep> breps, int index, double tol, bool parallel)
  {
    List<Curve> output = new List<Curve> ();
    if (parallel)
    {
      System.Threading.Tasks.Parallel.For(0, breps.Count,
        i => {
        if (i != index)
        {
          Curve[] intersectionCurves;
          Point3d[] intersectionPoints;
          if (Rhino.Geometry.Intersect.Intersection.BrepBrep(breps[i], breps[index], tol, out intersectionCurves, out intersectionPoints))
          {
            foreach (Curve curve in intersectionCurves)
            {
              output.Add(curve);
            }
          }
        }
        });
    }
      //Not parallel
    else
    {
      for (int i = 0; i < (breps.Count - 0); i++)
      {
        if (i != index)
        {
          Curve[] intersectionCurves;
          Point3d[] intersectionPoints;
          if (Rhino.Geometry.Intersect.Intersection.BrepBrep(breps[i], breps[index], tol, out intersectionCurves, out intersectionPoints))
          {
            foreach (Curve curve in intersectionCurves)
            {
              output.Add(curve);
            }
          }
        }
      }
    }
    return output;
  }
  //Search for the lower breps, if brep touch the contour of the roof (roofCurve)
  public List<Brep> LowerBrep(List<Brep> breps, Curve roofCurve, double tol)
  {
    List<Brep> output = new List<Brep>();
    int index = -1;
    if (breps.Count == 1)
    {
      output.Add(breps[0]);
    }
    else
    {
      for (int i = 0; i < breps.Count; i++)
      {
        Curve[] overlapCurves;
        Point3d[] intersectionPoints;
        bool test = Rhino.Geometry.Intersect.Intersection.CurveBrep(roofCurve, breps[i], tol, out overlapCurves, out  intersectionPoints);

        if (test)
        {
          //If the overlap is on the curve it is the part we want
          if (overlapCurves.Length >= 1)
          {
            output.Add(breps[i]);
          }
          if (intersectionPoints.Length >= 1)
          {
            index = i;
          }
        }
      }
      //If there is just a point of contact, it must be a Valley
      if ((output.Count == 0) && (index != -1))
      {
        output.Add(breps[index]);
      }
    }
    return output;
  }
  //Calculate the surface of a flat closed polygon on XY plane
  //The polygon could be on whatever height (allowed by substraction of polyline[0])
  // Positive if CounterClockwise
  // Negative if Clockwise
  public double SurfaceOnXYplane(Polyline polyline)
  {
    Vector3d sum = Vector3d.Zero;
    for (int i = 0; i < (polyline.Count - 1); i++)
    {
      Vector3d cross = Vector3d.CrossProduct((Vector3d) (polyline[i] - polyline[0]), (Vector3d) (polyline[i + 1] - polyline[0]));
      sum = sum + cross;
    }
    return sum.Z;
  }

  public Curve ThreePointsToArc(Point3d p0, Point3d p1, Point3d p2)
  {
    List<Point3d> pts = new  List<Point3d>();
    pts.Add(p0);
    pts.Add(p1);
    pts.Add(p2);
    Rhino.Geometry.NurbsCurve nc = Rhino.Geometry.NurbsCurve.Create(false, 2, pts);
    Point4d p41 = new Point4d(p1);
    p41.W = 0.707107;
    nc.Points.SetPoint(1, p41);
    return nc;
  }
# ---------- end modified_c ----------
join_51 = BrepJoin(Breps=modified_c.roofs)  # -> Breps, Closed
bbox_2 = BoundingBox(Content=join_51.Breps, Plane=PlaneXY(0, 0, 0))  # -> Box, Box_2
debox_2 = DeconstructBox(Box=bbox_2.Box)  # -> Plane, X, Y, Z
Z_103 = UnitZ(Factor=debox_2.Z)
rev_2 = Reverse(Vector=Z_103)
extr_42 = Extrude(Base=join_51.Breps, Direction=rev_2)
brep_4 = Brep(join_51.Breps)
fastsdiff_3 = FastSolidDifference(
    SubtractFrom=extr_42,
    SubtractWith=extr_41,
    Tolerance=0.01,
    computeBBFastSolidDiff=True,
    retainFastSolidDiff=True,
    strictFastSolidDiff=True,
    trueIntFastSolidDiff=False)
move_45 = Move(Geometry=brep_4, Motion=Z_100)  # -> Geometry, Transform
extr_43 = Extrude(Base=brep_4, Direction=Z_100)
extr_44 = Extrude(Base=move_45.Geometry, Direction=Z_101)
move_46 = Move(Geometry=move_45.Geometry, Motion=Z_101)  # -> Geometry, Transform
fastsdiff_4 = FastSolidDifference(
    SubtractFrom=extr_44,
    SubtractWith=data_75,
    Tolerance=0.01,
    computeBBFastSolidDiff=True,
    retainFastSolidDiff=True,
    strictFastSolidDiff=True,
    trueIntFastSolidDiff=False)
extr_45 = Extrude(Base=move_46.Geometry, Direction=Z_102)
fastsdiff_5 = FastSolidDifference(
    SubtractFrom=extr_45,
    SubtractWith=[data_75, data_80],
    Tolerance=0.01,
    computeBBFastSolidDiff=True,
    retainFastSolidDiff=True,
    strictFastSolidDiff=True,
    trueIntFastSolidDiff=False)

data_81 = Data(extr_41)
panel_530 = Panel("Betondecke")
data_82 = Data(fastsdiff_3)
panel_531 = Panel("Gefälleestrich")
data_83 = Data(extr_43)
data_84 = Data(fastsdiff_4)
data_85 = Data(fastsdiff_5)

# ---- group: Wetterdaten Manipulation
importepw_2 = LBImportEPW(epw_file=downloadepw.epw_file)  # -> location, dry_bulb_temperature, dew_point_temperature, relative_humidity, wind_speed, wind_direction, direct_normal_rad, diffuse_horizontal_rad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; plug-in component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
skymatrix = LBCumulativeSkyMatrix(
    location=importepw_2.location,
    direct_rad=importepw_2.direct_normal_rad,
    diffuse_rad=importepw_2.diffuse_horizontal_rad,
    folder="C:\Users\mfls\AppData\Roaming\ladybug_tools\calc")  # -> report, sky_mtx; plug-in component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
decnstrloc_2 = LBDeconstructLocation(location=importepw_2.location)  # -> name, latitude, longitude, time_zone, elevation; plug-in component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
skydome = LBSkyDome(sky_mtx=skymatrix.sky_mtx)  # -> report, mesh, compass, legend, title, patch_vecs, patch_values, mesh_values, vis_set; plug-in component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
panel_536 = Panel(decnstrloc_2.latitude)
panel_537 = Panel(decnstrloc_2.name)
panel_538 = Panel(decnstrloc_2.longitude)
panel_539 = Panel(decnstrloc_2.elevation)
join_52 = TextJoin(Text=["Längengrad Wetterstation", panel_536], Join=" = ")
join_53 = TextJoin(Text=["Nächstgelegene Wetterstation", panel_537], Join=" = ")
join_54 = TextJoin(Text=["Breitengrad Wetterstation", panel_538], Join=" = ")
join_55 = TextJoin(Text=["Höhe ü. NN Wetterstation", panel_539], Join=" = ")
multiplication_16 = Multiplication(A=skydome.patch_vecs, B=skydome.patch_values)
panel_540 = Panel(skydome.mesh)
pdecon = Deconstruct(Point=multiplication_16)  # -> XComponent, YComponent, ZComponent
join_56 = TextJoin(Text=[join_53, join_52, join_54, join_55])
lng_2 = ListLength(List=multiplication_16)
ma_7 = MassAddition(Input=pdecon.XComponent)  # -> Result, PartialResults
ma_8 = MassAddition(Input=pdecon.YComponent)  # -> Result, PartialResults
ma_9 = MassAddition(Input=pdecon.ZComponent)  # -> Result, PartialResults
panel_541 = Panel(join_56)
division_13 = Division(A=ma_9.Result, B=lng_2)
division_14 = Division(A=ma_7.Result, B=lng_2)
division_15 = Division(A=ma_8.Result, B=lng_2)
vec_20 = VectorXYZ(XComponent=division_14, YComponent=division_15, ZComponent=division_13)  # -> Vector, Length
Y_4 = UnitY(Factor=1)
xy_4 = XYPlane(Origin=Point(0, 0, 0))
Z_104 = UnitZ(Factor=1)
angle_2 = Angle(VectorA=vec_20.Vector, VectorB=Z_104)  # -> Angle, Reflex
angle_3 = Angle(VectorA=vec_20.Vector, VectorB=Y_4, Plane=xy_4)  # -> Angle, Reflex
deg_2 = Degrees(Radians=angle_3.Angle)
deg_3 = Degrees(Radians=angle_2.Angle)
optimal_tilt = Panel(deg_3)
optimal_azimuth = Panel(deg_2)
panel_542 = Panel(optimal_tilt)
panel_543 = Panel(optimal_azimuth)
join_57 = TextJoin(Text=flatten(["Solarpanel optimaler Azimut", panel_543]), Join=" = ")
join_58 = TextJoin(Text=flatten(["Solarpanel optimale Neigung", panel_542]), Join=" = ")

# ---- group: Berechnung Dämmstärke (continued)
data_86 = Data(importepw_2.dry_bulb_temperature)

# ---- group: Wetterdaten Manipulation
panel_544 = Panel("Text Location")
txt_2 = Text(panel_541)

# ---- group: Berechnung Dämmstärke (continued)
hdd_cdd = LBDegreeDays(dry_bulb=data_86)  # -> hourly_heat, hourly_cool, heat_deg_days, cool_deg_days; plug-in component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

# Source:
# https://doi.org/10.1016/j.jobe.2023.107783
python_6 = GhPythonScript(
    HDD=hdd_cdd.heat_deg_days,
    CDD=hdd_cdd.cool_deg_days,
    Celec=kosten_strom_kwh,
    PWF=present_worth_factor,
    Lambda=λ_dämmung_eps,
    Cinsu=kosten_dämmung_m³,
    n=system_effizienz_η,
    e=system_effizienz_ε,
    R=berechnet_r_m2_k_w_wand_2)  # -> out, x_opt
# ---------- python_6: Python ----------
__author__ = "mfls"
__version__ = "2024.09.09"

import rhinoscriptsyntax as rs

HDD = HDD
CDD = CDD
Celec = Celec
PWF = PWF
Lambda = Lambda
Cinsu = Cinsu
n = n
e = e
R = R

def calculate_value(HDD, CDD, Celec, PWF, Lambda, Cinsu, n, e, R):
    # Convert inputs to floats to ensure numeric calculations
    HDD = float(HDD)
    CDD = float(CDD)
    Celec = float(Celec)
    PWF = float(PWF)
    Lambda = float(Lambda)
    Cinsu = float(Cinsu)
    n = float(n)
    e = float(e)
    R = float(R)
    
    # Calculate the terms
    term1 = 0.024 * ((HDD * Celec * PWF * Lambda) / (Cinsu * n))
    term2 = 0.024 * ((CDD * Celec * PWF * Lambda) / (Cinsu * e))
    
    # Apply the square root to the sum of term1 and term2
    result = (term1 + term2) ** (1 / 2) - R * Lambda
    return result
    
x_opt = calculate_value(HDD, CDD, Celec, PWF, Lambda, Cinsu, n, e, R)
# ---------- end python_6 ----------

panel_545 = Panel(python_6.x_opt)
abs = Absolute(Value=panel_545)
num_141 = Number(abs)

division_16 = Division(A=num_141, B=λ_dämmung_eps)
addition_20 = Addition(A=division_16, B=berechnet_r_m2_k_w_wand_2)
division_17 = Division(A="1", B=addition_20)

# ---- group: Textverarbeitung (continued)
panel_546 = Panel(division_17)

join_59 = TextJoin(Text=[panel_48, panel_546], Join=" = ")
join_60 = TextJoin(Text=[join_17, join_14, join_12, join_18, join_59, join_16, join_20, join_50, join_5, join_6, join_7, join_9, join_19, join_48, join_10])
panel_547 = Panel(join_60)

txt_3 = Text(panel_547)

# ---- group: Satteldach (continued)
subtraction_18 = Subtraction(A=num_141, B=num_106)
smaller_6 = SmallerThan(FirstNumber=subtraction_18, SecondNumber="0")  # -> SmallerThan, OrEqualTo
p_n_c_13 = PickNChoose(Pattern=smaller_6.OrEqualTo, Stream0=subtraction_18, Stream1="0")
num_142 = Number(p_n_c_13)

# ---- group: Holzkonstruktion (continued)
subtraction_19 = Subtraction(A=num_141, B=num_48)
smaller_7 = SmallerThan(FirstNumber=subtraction_19, SecondNumber="0")  # -> SmallerThan, OrEqualTo
p_n_c_14 = PickNChoose(Pattern=smaller_7.OrEqualTo, Stream0=subtraction_19, Stream1="0")
num_143 = Number(p_n_c_14)
dicke_zweite_dämmschicht = Number(num_141)

# ---- group: Verteilung für Wanddicken (continued)
data_87 = Data(dicke_zweite_dämmschicht)

# ---- group: Massivkonstruktion (continued)
num_144 = Number(num_141)

# ---- group: Verteilung für Wanddicken (continued)
data_88 = Data(num_144)
p_n_c_15 = PickNChoose(Pattern=bool_9, Stream0=data_88, Stream1=data_87)

data_89 = Data(p_n_c_15)

ma_10 = MassAddition(Input=[data_26, data_25, data_89, data_27, data_24, data_23])  # -> Result, PartialResults

data_90 = Data(ma_10.Result)

# ----
num_145 = Number(data_90)
offset_23 = OffsetCurve(Curve=flip_2.Curve, Distance=num_145, Corners=1)
offset_24 = OffsetCurve(Curve=offset_23, Distance=Slider(2, range=0..10), Corners=1)
boundary_20 = BoundarySurfaces(Edges=[offset_23, offset_24])
area_6 = Area(Geometry=boundary_20)  # -> Area, flatten(Centroid)
item_39 = ListItem(List=area_6.Centroid, Index="0", Wrap=True)

# ----
# Plane Output für Schnitte
pl_2 = ConstructPlane(Origin=item_39, XAxis=Y, YAxis=Z)
pl_3 = ConstructPlane(Origin=item_39, XAxis=X, YAxis=Z)
pln = Plane(pl_3)
pln_2 = Plane(pl_2)

# ---- group: Fundament (continued)
num_146 = Number(data_89)

# ---- group: Flachdach / Dämmung (continued)
num_147 = Number(data_89)
offset_25 = OffsetCurve(Curve=move_40.Geometry, Distance=num_147, Corners=1)
boundary_21 = BoundarySurfaces(Edges=flatten([move_40.Geometry, offset_25]))
extr_46 = Extrude(Base=boundary_21, Direction=Z_89)
num_148 = Number(data_89)
smaller_8 = SmallerThan(FirstNumber=num_148, SecondNumber="0")  # -> SmallerThan, OrEqualTo
data_91 = Data(extr_46)
dispatch_33 = Dispatch(List=data_91, DispatchPattern=smaller_8.OrEqualTo)  # -> ListA, ListB
data_92 = Data(dispatch_33.ListB)

data_93 = Data([fastsdiff_2, extr_38, data_92])

# ---- group: Schnittgenerierung
# Plane aus Mittelpunkt Fläche
# Schnitt Längs und Quer
pln_3 = Plane(graft([pln_2, pln]))

# ---- group: Verteilung für Wand Kurven (continued)
offset_26 = OffsetCurve(Curve=crv_17, Distance=data_90, Corners=1)

data_94 = Data(offset_26)

# ---- group: Satteldach (continued)
data_95 = Data(data_94)
dispatch_34 = Dispatch(List=data_95, DispatchPattern=bool_16)  # -> ListA, ListB
crv_40 = Curve(flatten(dispatch_34.ListB))
offset_27 = OffsetCurve(Curve=crv_40, Distance=num_13, Corners=1)

# ---- group: Flachdach (continued)
num_149 = Number(data_89)
dispatch_35 = Dispatch(List=data_94, DispatchPattern=bool_16)  # -> ListA, ListB
ma_11 = MassAddition(Input=[num_111, num_112, num_113, num_149, num_114, num_115, num_119, num_116, num_118, num_117])  # -> Result, PartialResults
rad_5 = Radians(Degrees=number_slider_5)
tan = Tangent(Value=rad_5)
multiplication_17 = Multiplication(A=tan, B=ma_11.Result)
neg_26 = Negative(Value=ma_11.Result)
Z_105 = UnitZ(Factor=multiplication_17)
move_47 = Move(Geometry=dispatch_35.ListA, Motion=Z_84)  # -> Geometry, Transform
offset_28 = OffsetCurve(Curve=move_47.Geometry, Distance=neg_26, Corners=1)
num_150 = Number(debox_2.Z)
move_48 = Move(Geometry=offset_28, Motion=Z_105)  # -> Geometry, Transform
move_49 = Move(Geometry=move_47.Geometry, Motion=Z_85)  # -> Geometry, Transform
loft = Loft(
    Curves=flatten([move_48.Geometry, move_47.Geometry]),
    Options={Adjust=False, Closed=False, LoftEnds=0, LoftSimp=0, LoftType=0, Rebuild=10, Refit=0.01})
loft_2 = Loft(
    Curves=flatten([move_47.Geometry, move_49.Geometry]),
    Options={Adjust=False, Closed=False, LoftEnds=0, LoftSimp=0, LoftType=0, Rebuild=10, Refit=0.01})
move_50 = Move(Geometry=move_48.Geometry, Motion=Z_86)  # -> Geometry, Transform
loft_3 = Loft(
    Curves=flatten([move_50.Geometry, move_48.Geometry]),
    Options={Adjust=False, Closed=False, LoftEnds=0, LoftSimp=0, LoftType=0, Rebuild=10, Refit=0.01})
join_61 = BrepJoin(Breps=[loft_2, loft, loft_3])  # -> Breps, Closed
offsrf = OffsetSurface(Surface=join_61.Breps, Distance=abdeckung_dach_dicke, BothSides=0, CreateSolid=True)

data_96 = Data(offsrf)

panel_550 = Panel("Brep Decke Unten")
panel_551 = Panel("Dicke Dach Flach")
brep_5 = Brep(fpatch_3)
ma_12 = MassAddition(Input=flatten([num_150, dicke_betondecke, dicke_dampfsperre_2, dicke_dämmung, data_27]))  # -> Result, PartialResults

Z_106 = UnitZ(Factor=ma_12.Result)
move_51 = Move(Geometry=brep_5, Motion=Z_106)  # -> Geometry, Transform
brep_6 = Brep(move_51.Geometry)

# ---- group: Eingangstür (continued)
num_151 = Number(data_90)
rectangle_6 = Rectangle(Plane=pl, XSize=num_28, YSize=num_151, Radius=0)  # -> Rectangle, Length
move_52 = Move(Geometry=rectangle_6.Rectangle, Motion=multiplication_6)  # -> Geometry, Transform
num_152 = Number(num_151)
multiplication_18 = Multiplication(A=vec_3, B=num_152)
num_153 = Number(num_151)
multiplication_19 = Multiplication(A=num_153, B=Slider(0.7, range=0..1))
multiplication_20 = Multiplication(A=vec_4, B=multiplication_19)
move_53 = Move(Geometry=fpatch, Motion=multiplication_20)  # -> Geometry, Transform
evalsrf_4 = EvaluateSurface(Surface=reparameterize(move_53.Geometry), Point=md_slider_2)  # -> Point, Normal, UDirection, VDirection, Frame
offsrf_2 = OffsetSurface(Surface=move_53.Geometry, Distance=Slider(0.04, range=0..0.1), BothSides=0, CreateSolid=True)
pl_4 = ConstructPlane(Origin=evalsrf_4.Point, XAxis=evalsrf_4.VDirection, YAxis=evalsrf_4.UDirection)
cyl = Cylinder(Base=pl_4, Radius=number_slider_3, Length=number_slider_3)
multiplication_21 = Multiplication(A=evalsrf_4.Normal, B=neg_3)
move_54 = Move(Geometry=evalsrf_4.Point, Motion=multiplication_21)  # -> Geometry, Transform
sph = Sphere(Base=move_54.Geometry, Radius=number_slider_3)

boxrec = BoxRectangle(Rectangle=move_52.Geometry, Height=num_29)

# ---- group: Fenster (continued)
data_97 = Data(boxrec)
trim_3 = TrimWithBreps(Curve=data_8, Brep=data_97)  # -> Inside, Outside
trim_4 = TrimWithBreps(Curve=data_6, Brep=data_97)  # -> Inside, Outside
trim_5 = TrimWithBreps(Curve=data_9, Brep=data_97)  # -> Inside, Outside
trim_6 = TrimWithBreps(Curve=data_7, Brep=data_97)  # -> Inside, Outside
crv_41 = Curve(trim_3.Outside)
crv_42 = Curve(trim_4.Outside)
crv_43 = Curve(trim_6.Outside)
crv_44 = Curve(trim_5.Outside)

fenster_generator = FensterGenerator(
    maximalhöhe_fester_tür=num_29,
    wwr_himmelsrichtung=num_34,
    kurven_himmelsrichtung=crv_41,
    num=num_151,
    pt=pt_8,
    num_2=innenwandbreite,
    num_8=data_90)  # -> G, output_glas_2, output_fensterrahmen_2, B
fenster_generator_2 = FensterGenerator(
    maximalhöhe_fester_tür=num_29,
    wwr_himmelsrichtung=num_36,
    kurven_himmelsrichtung=crv_43,
    num=num_151,
    pt=pt_8,
    num_2=innenwandbreite,
    num_8=data_90)  # -> G, output_glas_2, output_fensterrahmen_2, B
fenster_generator_3 = FensterGenerator(
    maximalhöhe_fester_tür=num_29,
    wwr_himmelsrichtung=num_35,
    kurven_himmelsrichtung=crv_42,
    num=num_151,
    pt=pt_8,
    num_2=innenwandbreite,
    num_8=data_90)  # -> G, output_glas_2, output_fensterrahmen_2, B
fenster_generator_4 = FensterGenerator(
    maximalhöhe_fester_tür=num_29,
    wwr_himmelsrichtung=num_37,
    kurven_himmelsrichtung=crv_44,
    num=num_151,
    pt=pt_8,
    num_2=innenwandbreite,
    num_8=data_90)  # -> G, output_glas_2, output_fensterrahmen_2, B

# ---- group: Eingangstür / Punkttransformation Tür (continued)
move_55 = Move(Geometry=move_5.Geometry, Motion=multiplication_18)  # -> Geometry, Transform
move_56 = Move(Geometry=move_55.Geometry, Motion=Z_8)  # -> Geometry, Transform
move_57 = Move(Geometry=move_6.Geometry, Motion=multiplication_18)  # -> Geometry, Transform
move_58 = Move(Geometry=move_57.Geometry, Motion=Z_8)  # -> Geometry, Transform
pline_3 = PolyLine(Vertices=[move_7.Geometry, move_56.Geometry, move_58.Geometry, move_8.Geometry], Closed=Toggle(True))
pline_4 = PolyLine(Vertices=[move_5.Geometry, move_6.Geometry, move_57.Geometry, move_55.Geometry], Closed=Toggle(True))
pline_5 = PolyLine(Vertices=[move_7.Geometry, move_56.Geometry, move_55.Geometry, move_5.Geometry], Closed=Toggle(True))
pline_6 = PolyLine(Vertices=[move_8.Geometry, move_58.Geometry, move_57.Geometry, move_6.Geometry], Closed=Toggle(True))
fpatch_4 = FragmentPatch(Boundary=pline_3)
fpatch_5 = FragmentPatch(Boundary=pline_4)
fpatch_6 = FragmentPatch(Boundary=pline_5)
fpatch_7 = FragmentPatch(Boundary=pline_6)

# ---- group: Fenster (continued)
data_98 = Data([fenster_generator.output_fensterrahmen_2, fenster_generator_2.output_fensterrahmen_2, fenster_generator_3.output_fensterrahmen_2, fenster_generator_4.output_fensterrahmen_2])
data_99 = Data([fenster_generator.output_glas_2, fenster_generator_2.output_glas_2, fenster_generator_3.output_glas_2, fenster_generator_4.output_glas_2])

# ---- group: Eingangstür (continued)
join_62 = BrepJoin(Breps=[fpatch_4, fpatch_6, fpatch_7])  # -> Breps, Closed
offsetbrep_2 = OffsetBrep(Brep=join_62.Breps, OffsetDistance=neg_2, Solid=Toggle(True), SharpEdges=True, Tolerance=0.01)
extr_47 = Extrude(Base=fpatch_5, Direction=Z_3)
data_100 = Data([offsetbrep_2, extr_47])

data_101 = Data(offsrf_2)

data_102 = Data([sph, cyl, data_100])

# ----
# Daten für Abzug Wand
data_103 = Data(flatten([boxrec, fenster_generator_3.B, fenster_generator.B, fenster_generator_2.B, fenster_generator_4.B]))

# ---- group: Holzkonstruktion (continued)
offset_29 = OffsetCurve(Curve=crv_27, Distance=dicke_zweite_dämmschicht, Corners=1)
crv_45 = Curve(offset_29)
offset_30 = OffsetCurve(Curve=crv_45, Distance=num_68, Corners=1)
boundary_22 = BoundarySurfaces(Edges=flatten([crv_27, offset_29]))
offset_31 = OffsetCurve(Curve=offset_30, Distance=dicke_osb_2, Corners=1)
crv_46 = Curve(offset_31)
offset_32 = OffsetCurve(Curve=crv_46, Distance=dicke_gk, Corners=1)
boundary_23 = BoundarySurfaces(Edges=flatten([crv_46, offset_32]))
boundary_24 = BoundarySurfaces(Edges=flatten([offset_30, offset_31]))
fastsdiff_6 = FastSolidDifference(
    SubtractFrom=graft(extr_9),
    SubtractWith=data_103,
    Tolerance=0.01,
    computeBBFastSolidDiff=True,
    retainFastSolidDiff=True,
    strictFastSolidDiff=True,
    trueIntFastSolidDiff=False)
extr_48 = Extrude(Base=boundary_22, Direction=Z_15)
extr_49 = Extrude(Base=boundary_23, Direction=Z_16)
extr_50 = Extrude(Base=boundary_24, Direction=Z_18)
data_104 = Data(fastsdiff_6)
extr_51 = Extrude(Base=boundary_22, Direction=dispatch_23.ListA)
extr_52 = Extrude(Base=boundary_23, Direction=dispatch_24.ListA)
extr_53 = Extrude(Base=boundary_24, Direction=dispatch_26.ListA)
fastsdiff_7 = FastSolidDifference(
    SubtractFrom=graft(extr_35),
    SubtractWith=data_103,
    Tolerance=0.01,
    computeBBFastSolidDiff=True,
    retainFastSolidDiff=True,
    strictFastSolidDiff=True,
    trueIntFastSolidDiff=False)
fastsdiff_8 = FastSolidDifference(
    SubtractFrom=graft(extr_52),
    SubtractWith=data_103,
    Tolerance=0.01,
    computeBBFastSolidDiff=True,
    retainFastSolidDiff=True,
    strictFastSolidDiff=True,
    trueIntFastSolidDiff=False)
fastsdiff_9 = FastSolidDifference(
    SubtractFrom=graft(extr_51),
    SubtractWith=data_103,
    Tolerance=0.01,
    computeBBFastSolidDiff=True,
    retainFastSolidDiff=True,
    strictFastSolidDiff=True,
    trueIntFastSolidDiff=False)
fastsdiff_10 = FastSolidDifference(
    SubtractFrom=graft(extr_36),
    SubtractWith=data_103,
    Tolerance=0.01,
    computeBBFastSolidDiff=True,
    retainFastSolidDiff=True,
    strictFastSolidDiff=True,
    trueIntFastSolidDiff=False)
fastsdiff_11 = FastSolidDifference(
    SubtractFrom=graft(extr_53),
    SubtractWith=data_103,
    Tolerance=0.01,
    computeBBFastSolidDiff=True,
    retainFastSolidDiff=True,
    strictFastSolidDiff=True,
    trueIntFastSolidDiff=False)
fastsdiff_12 = FastSolidDifference(
    SubtractFrom=graft(cap_4),
    SubtractWith=data_103,
    Tolerance=0.01,
    UseTasks=True,
    computeBBFastSolidDiff=True,
    retainFastSolidDiff=True,
    strictFastSolidDiff=True,
    trueIntFastSolidDiff=False)

# ---- group: Verteilung für Wand Kurven (continued)
data_105 = Data(offset_30)

# ---- group: Holzkonstruktion / Dachteil (continued)
srf_14 = Surface(boundary_23)
move_59 = Move(Geometry=srf_14, Motion=vec_10)  # -> Geometry, Transform
extr_54 = Extrude(Base=move_59.Geometry, Direction=Z_36)

srf_15 = Surface(boundary_22)
move_60 = Move(Geometry=srf_15, Motion=vec_12)  # -> Geometry, Transform
extr_55 = Extrude(Base=move_60.Geometry, Direction=Z_38)

srf_16 = Surface(boundary_24)
move_61 = Move(Geometry=srf_16, Motion=vec_14)  # -> Geometry, Transform
extr_56 = Extrude(Base=move_61.Geometry, Direction=Z_40)

# ---- group: Holzkonstruktion (continued)
edges_9 = BrepEdges(Brep=offset_30)  # -> Naked, Interior, NonManifold
midpt_6 = CurveMiddle(Curve=edges_9.Naked)
line_8 = LineSDL(Start=midpt_6, Direction=Z_22, Length=Slider(100000000, range=0..100000000))
addition_21 = Addition(A=dicke_zweite_dämmschicht, B=addition_4)
multiplication_22 = Multiplication(A=rotate_3.Geometry, B=addition_21)
move_62 = Move(Geometry=move_22.Geometry, Motion=multiplication_22)  # -> Geometry, Transform
extr_57 = Extrude(Base=move_62.Geometry, Direction=Z_81)
cap_5 = CapHoles(Brep=extr_57)
fastsdiff_13 = FastSolidDifference(
    SubtractFrom=graft(cap_5),
    SubtractWith=data_103,
    Tolerance=0.01,
    computeBBFastSolidDiff=True,
    retainFastSolidDiff=True,
    strictFastSolidDiff=True,
    trueIntFastSolidDiff=False)

# ---- group: Massivkonstruktion (continued)
offset_33 = OffsetCurve(Curve=crv_22, Distance=num_144, Corners=1)
crv_47 = Curve(offset_33)
offset_34 = OffsetCurve(Curve=crv_47, Distance=num_57, Corners=1)
crv_48 = Curve(offset_34)
offset_35 = OffsetCurve(Curve=crv_48, Distance=dicke_außenputz, Corners=1)
boundary_25 = BoundarySurfaces(Edges=flatten([crv_22, offset_33]))
boundary_26 = BoundarySurfaces(Edges=flatten([crv_48, offset_35]))
fastsdiff_14 = FastSolidDifference(
    SubtractFrom=graft(extr_33),
    SubtractWith=data_103,
    Tolerance=0.01,
    computeBBFastSolidDiff=True,
    retainFastSolidDiff=True,
    strictFastSolidDiff=True,
    trueIntFastSolidDiff=False)
extr_58 = Extrude(Base=boundary_25, Direction=dispatch_18.ListA)
extr_59 = Extrude(Base=boundary_25, Direction=Z_33)
extr_60 = Extrude(Base=boundary_26, Direction=Z_32)
extr_61 = Extrude(Base=boundary_26, Direction=dispatch_20.ListA)
fastsdiff_15 = FastSolidDifference(
    SubtractFrom=graft(extr_58),
    SubtractWith=data_103,
    Tolerance=0.01,
    computeBBFastSolidDiff=True,
    retainFastSolidDiff=True,
    strictFastSolidDiff=True,
    trueIntFastSolidDiff=False)
fastsdiff_16 = FastSolidDifference(
    SubtractFrom=graft(extr_61),
    SubtractWith=data_103,
    Tolerance=0.01,
    computeBBFastSolidDiff=True,
    retainFastSolidDiff=True,
    strictFastSolidDiff=True,
    trueIntFastSolidDiff=False)
fastsdiff_17 = FastSolidDifference(
    SubtractFrom=graft(extr_34),
    SubtractWith=data_103,
    Tolerance=0.01,
    computeBBFastSolidDiff=True,
    retainFastSolidDiff=True,
    strictFastSolidDiff=True,
    trueIntFastSolidDiff=False)
num_154 = Number(num_144)
smaller_9 = SmallerThan(FirstNumber=num_154, SecondNumber="0")  # -> SmallerThan, OrEqualTo

# ---- group: Verteilung für Wand Kurven (continued)
data_106 = Data(offset_34)
p_n_c_16 = PickNChoose(Pattern=bool_15, Stream0=data_106, Stream1=data_105)

data_107 = Data(p_n_c_16)

# ---- group: Fundament (continued)
ma_13 = MassAddition(Input=[num_91, num_146, num_90, num_92])  # -> Result, PartialResults
offset_36 = OffsetCurve(Curve=move_30.Geometry, Distance=ma_13.Result, Corners=1)
crv_49 = Curve(data_107)
num_155 = Number(data_89)
crv_50 = Curve(offset_33)
offset_37 = OffsetCurve(Curve=crv_32, Distance=num_155, Corners=1)
offset_38 = OffsetCurve(Curve=crv_49, Distance=num_89, Corners=1)
boundary_27 = BoundarySurfaces(Edges=flatten([offset_36, move_30.Geometry]))
offset_39 = OffsetCurve(Curve=crv_50, Distance=addition_5, Corners=1)
boundary_28 = BoundarySurfaces(Edges=flatten([crv_32, offset_37]))
boundary_29 = BoundarySurfaces(Edges=flatten([crv_49, offset_38]))
boundary_30 = BoundarySurfaces(Edges=flatten([crv_50, offset_39]))
extr_62 = Extrude(Base=boundary_27, Direction=Z_58)
extr_63 = Extrude(Base=boundary_28, Direction=Z_60)
extr_64 = Extrude(Base=boundary_29, Direction=Z_61)
extr_65 = Extrude(Base=boundary_30, Direction=Z_62)
num_156 = Number(num_144)
dispatch_36 = Dispatch(List=extr_64, DispatchPattern=bool_3)  # -> ListA, ListB
dispatch_37 = Dispatch(List=extr_65, DispatchPattern=bool_3)  # -> ListA, ListB
smaller_10 = SmallerThan(FirstNumber=num_156, SecondNumber="0")  # -> SmallerThan, OrEqualTo
data_108 = Data(extr_63)
dispatch_38 = Dispatch(List=data_108, DispatchPattern=smaller_10.OrEqualTo)  # -> ListA, ListB

data_109 = Data([extr_62, data_38])

data_110 = Data([dispatch_37.ListB, dispatch_36.ListA])

data_111 = Data(dispatch_38.ListB)

# ---- group: Flachdach / Abdichtung (continued)
dispatch_39 = Dispatch(List=data_107, DispatchPattern=bool_16)  # -> ListA, ListB
move_63 = Move(Geometry=dispatch_39.ListA, Motion=Z_93)  # -> Geometry, Transform
offset_40 = OffsetCurve(Curve=move_63.Geometry, Distance=num_135, Corners=1)
boundary_31 = BoundarySurfaces(Edges=flatten([offset_40, move_63.Geometry]))
extr_66 = Extrude(Base=boundary_31, Direction=Z_94)
move_64 = Move(Geometry=offset_40, Motion=Z_95)  # -> Geometry, Transform
boundary_32 = BoundarySurfaces(Edges=flatten([move_64.Geometry, crv_39]))
extr_67 = Extrude(Base=boundary_32, Direction=Z_96)

data_112 = Data(extr_66)

data_113 = Data([extr_67, extr_40])

# ---- group: Massivkonstruktion / Dachteil (continued)
srf_17 = Surface(boundary_26)
move_65 = Move(Geometry=srf_17, Motion=vec_13)  # -> Geometry, Transform
extr_68 = Extrude(Base=move_65.Geometry, Direction=Z_39)

srf_18 = Surface(boundary_25)
move_66 = Move(Geometry=srf_18, Motion=vec_15)  # -> Geometry, Transform
extr_69 = Extrude(Base=move_66.Geometry, Direction=Z_41)

# ---- group: Massivkonstruktion (continued)
edges_10 = BrepEdges(Brep=crv_48)  # -> Naked, Interior, NonManifold
midpt_7 = CurveMiddle(Curve=edges_10.Naked)
line_9 = LineSDL(Start=midpt_7, Direction=Z_23, Length=Slider(100000000, range=0..100000000))
multiplication_23 = Multiplication(A=rotate_2.Geometry, B=num_144)
move_67 = Move(Geometry=move_16.Geometry, Motion=multiplication_23)  # -> Geometry, Transform
extr_70 = Extrude(Base=move_67.Geometry, Direction=Z_82)
cap_6 = CapHoles(Brep=extr_70)
fastsdiff_18 = FastSolidDifference(
    SubtractFrom=graft(cap_6),
    SubtractWith=data_103,
    Tolerance=0.01,
    computeBBFastSolidDiff=True,
    retainFastSolidDiff=True,
    strictFastSolidDiff=True,
    trueIntFastSolidDiff=False)
data_114 = Data(fastsdiff_18)

# ---- group: Holzkonstruktion
data_115 = Data(fastsdiff_13)

# ----
brep_7 = Brep(brep_6)
flip_4 = Flip(Surface=brep_7)  # -> Surface, Result
data_116 = Data(data_113)
dispatch_40 = Dispatch(List=data_116, DispatchPattern=bool_16)  # -> ListA, ListB
dispatch_41 = Dispatch(List=flip_4.Surface, DispatchPattern=bool_16)  # -> ListA, ListB

# ---- group: Satteldach (continued)
move_68 = Move(Geometry=offset_27, Motion=Z_83)  # -> Geometry, Transform
simplify_2 = SimplifyCurve(Curve=move_68.Geometry, Tolerance="0.01", AngleTolerance="0.1")  # -> Curve, Simplified
explode_4 = Explode(Curve=simplify_2.Curve, Recursive=True)  # -> Segments, Vertices
extr_71 = Extrude(Base=explode_4.Segments, Direction=Z_87)
evalsrf_5 = EvaluateSurface(Surface=reparameterize(extr_71), Point=md_slider_5)  # -> Point, Normal, UDirection, VDirection, Frame
angle_4 = Angle(VectorA=evalsrf_5.Normal, VectorB=Y_3, Plane=xy_3)  # -> Angle, Reflex
deg_4 = Degrees(Radians=angle_4.Angle)
larger_8 = LargerThan(FirstNumber=deg_4, SecondNumber="225")  # -> LargerThan, OrEqualTo
smaller_11 = SmallerThan(FirstNumber=deg_4, SecondNumber="315")  # -> SmallerThan, OrEqualTo
smaller_12 = SmallerThan(FirstNumber=deg_4, SecondNumber="135")  # -> SmallerThan, OrEqualTo
larger_9 = LargerThan(FirstNumber=deg_4, SecondNumber="45")  # -> LargerThan, OrEqualTo
and_4 = GateAnd(A=larger_8.LargerThan, B=smaller_11.OrEqualTo)
and_5 = GateAnd(A=larger_9.LargerThan, B=smaller_12.OrEqualTo)
or_4 = GateOr(A=and_5, B=and_4)
winkel_shuffler = GhPythonScript(Dachneigung_N_S=num_96, Dachneigung_O_W=Slider(90, range=0..90), O_W_True=or_4)  # -> out, Winkel_Liste; inputs O_W_True: tree of Boolean
# ---------- winkel_shuffler: Python ----------
__author__ = "mfls"
__version__ = "2024.07.26"

import rhinoscriptsyntax as rs
import ghpythonlib.treehelpers as th
import itertools

# Inputs
# Dachneigung_N_S: Dachneigung_N_S (in Degrees)
# Dachneigung_O_W: Dachneigung_O_W (in Degrees)
# O_W_True: O_W_True (a list with true or false)

Dachneigung_N_S = Dachneigung_N_S
Dachneigung_O_W = Dachneigung_O_W

def flatten(nested_list):
    flat_list = []
    for item in nested_list:
        if isinstance(item, list):
            flat_list.extend(flatten(item))
        else:
            flat_list.append(item)
    return flat_list

# Convert tree to list
O_W_True = th.tree_to_list(O_W_True)

# Flatten the nested list
O_W_True = flatten(O_W_True)

print(O_W_True)  # Debug print to check the flattened list
print(len(O_W_True))  # Debug print to check the length of the flattened list

# Initialize the internal list
Liste = []

# Iterate over the O_W_True list and append the appropriate value to Liste
for value in O_W_True:
    if value:
        Liste.append(Dachneigung_O_W)
        print("O_W added")
    else:
        Liste.append(Dachneigung_N_S)
        print("N_W added")

print(Liste)  # Debug print to check the final list

# Output the result
Winkel_Liste = th.list_to_tree(Liste)

print(Winkel_Liste)
# ---------- end winkel_shuffler ----------
rad_6 = Radians(Degrees=winkel_shuffler.Winkel_Liste)

# Credit: Laurent Delrieu
# 
# https://discourse.mcneel.com/u/laurent_delrieu/summary
# 
# Modified by Maximilian Schäfer to work with Rhino compute
modified_c_2 = CSharpScript(polyline=simplify_2.Curve, angles=rad_6, type=list)  # -> out, roofs; inputs polyline: Polyline, angles: list of Double, type: Int32; same code as modified_c

join_63 = BrepJoin(Breps=modified_c_2.roofs)  # -> Breps, Closed
item_40 = ListItem(List=join_63.Breps, Index=Slider(0, range=0..1), Wrap=True)
brep_8 = Brep(item_40)

# ---- group: Massivkonstruktion (continued)
dach_brep_unterseite = Brep(brep_8)
null = NullItem(Item=dach_brep_unterseite)  # -> NullFlags, InvalidFlags, Description
invbool_2 = InvertBoolean(Boolean=null.NullFlags)  # -> Inverted, Number
cull_11 = CullPattern(List=dach_brep_unterseite, CullPattern=invbool_2.Inverted)  # -> flatten(List)
dach_brep_unterseite_2 = Brep(cull_11)

# ---- group: Holzkonstruktion (continued)
dach_brep_unterseite_3 = Brep(brep_8)
null_2 = NullItem(Item=dach_brep_unterseite_3)  # -> NullFlags, InvalidFlags, Description
invbool_3 = InvertBoolean(Boolean=null_2.NullFlags)  # -> Inverted, Number
cull_12 = CullPattern(List=dach_brep_unterseite_3, CullPattern=invbool_3.Inverted)  # -> flatten(List)
dach_brep_unterseite_4 = Brep(cull_12)

# ---- group: Innenwände (continued)
brep_9 = Brep(dach_brep_unterseite_4)
split_3 = SplitBrep(Brep=extr_4, Cutter=brep_9)
volume = Volume(Geometry=split_3)  # -> Volume, Centroid
bnd_13 = Bounds(Numbers=volume.Volume)
dedomain_10 = DeconstructDomain(Domain=bnd_13)  # -> Start, End
equals_4 = Equality(FirstNumber=volume.Volume, SecondNumber=dedomain_10.End)  # -> Equality, Inequality
cull_13 = CullPattern(List=split_3, CullPattern=equals_4.Inequality)
dispatch_42 = Dispatch(List=cull_13, DispatchPattern=bool_16)  # -> ListA, ListB

# ---- group: Innentüre und Wände / Dachteil (continued)
brep_10 = Brep(dach_brep_unterseite_4)
split_4 = SplitBrep(Brep=extr_32, Cutter=brep_10)
volume_2 = Volume(Geometry=split_4)  # -> Volume, Centroid
bnd_14 = Bounds(Numbers=volume_2.Volume)
dedomain_11 = DeconstructDomain(Domain=bnd_14)  # -> Start, End
equals_5 = Equality(FirstNumber=volume_2.Volume, SecondNumber=dedomain_11.End)  # -> Equality, Inequality
cull_14 = CullPattern(List=split_4, CullPattern=equals_5.Inequality)
data_117 = Data(cull_14)

# ---- group: Innenwände (continued)
data_118 = Data([dispatch_42.ListB, extr_3])

# ---- group: Innentüre und Wände
data_119 = Data([data_117, data_73])

# ---- group: Massivkonstruktion / Dachteil (continued)
brep_11 = Brep(dach_brep_unterseite_4)
split_5 = SplitBrep(Brep=extr_7, Cutter=brep_11)
volume_3 = Volume(Geometry=split_5)  # -> Volume, Centroid
bnd_15 = Bounds(Numbers=volume_3.Volume)
dedomain_12 = DeconstructDomain(Domain=bnd_15)  # -> Start, End
equals_6 = Equality(FirstNumber=volume_3.Volume, SecondNumber=dedomain_12.End)  # -> Equality, Inequality
cull_15 = CullPattern(List=split_5, CullPattern=equals_6.Inequality)
data_120 = Data(cull_15)

# ---- group: Holzkonstruktion / Dachteil (continued)
brep_12 = Brep(dach_brep_unterseite_4)
split_6 = SplitBrep(Brep=extr_54, Cutter=brep_12)
volume_4 = Volume(Geometry=split_6)  # -> Volume, Centroid
bnd_16 = Bounds(Numbers=volume_4.Volume)
dedomain_13 = DeconstructDomain(Domain=bnd_16)  # -> Start, End
equals_7 = Equality(FirstNumber=volume_4.Volume, SecondNumber=dedomain_13.End)  # -> Equality, Inequality
cull_16 = CullPattern(List=split_6, CullPattern=equals_7.Inequality)
data_121 = Data(cull_16)

brep_13 = Brep(dach_brep_unterseite_4)
split_7 = SplitBrep(Brep=extr_13, Cutter=brep_13)
volume_5 = Volume(Geometry=split_7)  # -> Volume, Centroid
bnd_17 = Bounds(Numbers=volume_5.Volume)
dedomain_14 = DeconstructDomain(Domain=bnd_17)  # -> Start, End
equals_8 = Equality(FirstNumber=volume_5.Volume, SecondNumber=dedomain_14.End)  # -> Equality, Inequality
cull_17 = CullPattern(List=split_7, CullPattern=equals_8.Inequality)
data_122 = Data(cull_17)

brep_14 = Brep(dach_brep_unterseite_4)
split_8 = SplitBrep(Brep=extr_55, Cutter=brep_14)
volume_6 = Volume(Geometry=split_8)  # -> Volume, Centroid
bnd_18 = Bounds(Numbers=volume_6.Volume)
dedomain_15 = DeconstructDomain(Domain=bnd_18)  # -> Start, End
equals_9 = Equality(FirstNumber=volume_6.Volume, SecondNumber=dedomain_15.End)  # -> Equality, Inequality
cull_18 = CullPattern(List=split_8, CullPattern=equals_9.Inequality)
data_123 = Data(cull_18)

# ---- group: Massivkonstruktion / Dachteil (continued)
brep_15 = Brep(dach_brep_unterseite_4)
split_9 = SplitBrep(Brep=extr_68, Cutter=brep_15)
volume_7 = Volume(Geometry=split_9)  # -> Volume, Centroid
bnd_19 = Bounds(Numbers=volume_7.Volume)
dedomain_16 = DeconstructDomain(Domain=bnd_19)  # -> Start, End
equals_10 = Equality(FirstNumber=volume_7.Volume, SecondNumber=dedomain_16.End)  # -> Equality, Inequality
cull_19 = CullPattern(List=split_9, CullPattern=equals_10.Inequality)
data_124 = Data(cull_19)

# ---- group: Holzkonstruktion / Dachteil (continued)
brep_16 = Brep(dach_brep_unterseite_4)
split_10 = SplitBrep(Brep=extr_56, Cutter=brep_16)
volume_8 = Volume(Geometry=split_10)  # -> Volume, Centroid
bnd_20 = Bounds(Numbers=volume_8.Volume)
dedomain_17 = DeconstructDomain(Domain=bnd_20)  # -> Start, End
equals_11 = Equality(FirstNumber=volume_8.Volume, SecondNumber=dedomain_17.End)  # -> Equality, Inequality
cull_20 = CullPattern(List=split_10, CullPattern=equals_11.Inequality)
data_125 = Data(cull_20)

# ---- group: Massivkonstruktion / Dachteil (continued)
brep_17 = Brep(dach_brep_unterseite_4)
split_11 = SplitBrep(Brep=extr_69, Cutter=brep_17)
volume_9 = Volume(Geometry=split_11)  # -> Volume, Centroid
bnd_21 = Bounds(Numbers=volume_9.Volume)
dedomain_18 = DeconstructDomain(Domain=bnd_21)  # -> Start, End
equals_12 = Equality(FirstNumber=volume_9.Volume, SecondNumber=dedomain_18.End)  # -> Equality, Inequality
cull_21 = CullPattern(List=split_11, CullPattern=equals_12.Inequality)
data_126 = Data(cull_21)

brep_18 = Brep(dach_brep_unterseite_4)
split_12 = SplitBrep(Brep=extr_8, Cutter=brep_18)
volume_10 = Volume(Geometry=split_12)  # -> Volume, Centroid
bnd_22 = Bounds(Numbers=volume_10.Volume)
dedomain_19 = DeconstructDomain(Domain=bnd_22)  # -> Start, End
equals_13 = Equality(FirstNumber=volume_10.Volume, SecondNumber=dedomain_19.End)  # -> Equality, Inequality
cull_22 = CullPattern(List=split_12, CullPattern=equals_13.Inequality)
data_127 = Data(cull_22)

# ---- group: Holzkonstruktion / Dachteil (continued)
brep_19 = Brep(dach_brep_unterseite_4)
split_13 = SplitBrep(Brep=extr_14, Cutter=brep_19)
volume_11 = Volume(Geometry=split_13)  # -> Volume, Centroid
bnd_23 = Bounds(Numbers=volume_11.Volume)
dedomain_20 = DeconstructDomain(Domain=bnd_23)  # -> Start, End
equals_14 = Equality(FirstNumber=volume_11.Volume, SecondNumber=dedomain_20.End)  # -> Equality, Inequality
cull_23 = CullPattern(List=split_13, CullPattern=equals_14.Inequality)
data_128 = Data(cull_23)

# ---- group: Holzkonstruktion (continued)
bcx = BrepCurve(Brep=dach_brep_unterseite_4, Curve=line_8, UseTasks=False)  # -> Curves, Points
trim_7 = TrimTree(Tree=bcx.Points, Depth=1)
dist_4 = Distance(PointA=trim_7, PointB=midpt_6)
bnd_24 = Bounds(Numbers=dist_4)
dedomain_21 = DeconstructDomain(Domain=bnd_24)  # -> Start, End
dispatch_43 = Dispatch(List=dedomain_21.Start, DispatchPattern=bool_16)  # -> ListA, ListB
Z_107 = UnitZ(Factor=dispatch_43.ListB)
extr_72 = Extrude(Base=move_62.Geometry, Direction=Z_107)
cap_7 = CapHoles(Brep=extr_72)
fastsdiff_19 = FastSolidDifference(
    SubtractFrom=graft(cap_7),
    SubtractWith=data_103,
    Tolerance=0.01,
    computeBBFastSolidDiff=True,
    retainFastSolidDiff=True,
    strictFastSolidDiff=True,
    trueIntFastSolidDiff=False)

# ---- group: Massivkonstruktion (continued)
bcx_2 = BrepCurve(Brep=dach_brep_unterseite_4, Curve=line_9, UseTasks=False)  # -> Curves, Points
trim_8 = TrimTree(Tree=bcx_2.Points, Depth=1)
dist_5 = Distance(PointA=graft(trim_8), PointB=midpt_7)  # -> flatten(Distance)
bnd_25 = Bounds(Numbers=dist_5)
dedomain_22 = DeconstructDomain(Domain=bnd_25)  # -> Start, End
dispatch_44 = Dispatch(List=dedomain_22.Start, DispatchPattern=bool_16)  # -> ListA, ListB
Z_108 = UnitZ(Factor=dispatch_44.ListB)
extr_73 = Extrude(Base=move_67.Geometry, Direction=Z_108)
cap_8 = CapHoles(Brep=extr_73)
fastsdiff_20 = FastSolidDifference(
    SubtractFrom=graft(cap_8),
    SubtractWith=data_103,
    Tolerance=0.01,
    computeBBFastSolidDiff=True,
    retainFastSolidDiff=True,
    strictFastSolidDiff=True,
    trueIntFastSolidDiff=False)
data_129 = Data(fastsdiff_20)

# ---- group: Massivkonstruktion / Dachteil (continued)
brep_20 = Brep(dach_brep_unterseite_4)
split_14 = SplitBrep(Brep=extr_23, Cutter=brep_20)
volume_12 = Volume(Geometry=split_14)  # -> Volume, Centroid
bnd_26 = Bounds(Numbers=volume_12.Volume)
dedomain_23 = DeconstructDomain(Domain=bnd_26)  # -> Start, End
equals_15 = Equality(FirstNumber=volume_12.Volume, SecondNumber=dedomain_23.End)  # -> Equality, Inequality
cull_24 = CullPattern(List=split_14, CullPattern=equals_15.Inequality)
data_130 = Data(cull_24)

# ---- group: Massivkonstruktion (continued)
bcx_3 = BrepCurve(Brep=dach_brep_unterseite_2, Curve=line_4, UseTasks=False)  # -> Curves, flatten(Points)
bcx_4 = BrepCurve(Brep=dach_brep_unterseite_2, Curve=line_5, UseTasks=False)  # -> Curves, flatten(Points)
dist_6 = Distance(PointA=midpt_2, PointB=bcx_3.Points)
dist_7 = Distance(PointA=midpt_3, PointB=bcx_4.Points)
bnd_27 = Bounds(Numbers=dist_6)
bnd_28 = Bounds(Numbers=dist_7)
dedomain_24 = DeconstructDomain(Domain=bnd_28)  # -> Start, End
Z_109 = UnitZ(Factor=dedomain_24.Start)
dedomain_25 = DeconstructDomain(Domain=bnd_27)  # -> Start, End
dispatch_45 = Dispatch(List=Z_109, DispatchPattern=bool_16)  # -> ListA, ListB
subtraction_20 = Subtraction(A=dedomain_25.Start, B=dedomain_24.Start)
Z_110 = UnitZ(Factor=dedomain_24.Start)
fastsdiff_21 = FastSolidDifference(
    SubtractFrom=graft([data_120, extr_5]),
    SubtractWith=data_103,
    Tolerance=0.01,
    computeBBFastSolidDiff=True,
    retainFastSolidDiff=True,
    strictFastSolidDiff=True,
    trueIntFastSolidDiff=False)
extr_74 = Extrude(Base=boundary_5, Direction=[dispatch_21.ListA, dispatch_45.ListB])
move_69 = Move(Geometry=boundary_5, Motion=Z_110)  # -> Geometry, Transform
Z_111 = UnitZ(Factor=subtraction_20)
dispatch_46 = Dispatch(List=fastsdiff_21, DispatchPattern=bool_16)  # -> ListA, ListB
dispatch_47 = Dispatch(List=[extr_59, data_126], DispatchPattern=bool_16)  # -> ListA, ListB
dispatch_48 = Dispatch(List=[data_124, extr_60], DispatchPattern=bool_16)  # -> ListA, ListB
extr_75 = Extrude(Base=move_69.Geometry, Direction=Z_111)
dispatch_49 = Dispatch(List=[extr_6, data_127], DispatchPattern=bool_16)  # -> ListA, ListB
fastsdiff_22 = FastSolidDifference(
    SubtractFrom=graft(extr_74),
    SubtractWith=data_103,
    Tolerance=0.01,
    computeBBFastSolidDiff=True,
    retainFastSolidDiff=True,
    strictFastSolidDiff=True,
    trueIntFastSolidDiff=False)
fastsdiff_23 = FastSolidDifference(
    SubtractFrom=graft(dispatch_47.ListB),
    SubtractWith=data_103,
    Tolerance=0.01,
    computeBBFastSolidDiff=True,
    retainFastSolidDiff=True,
    strictFastSolidDiff=True,
    trueIntFastSolidDiff=False)
fastsdiff_24 = FastSolidDifference(
    SubtractFrom=graft(dispatch_48.ListB),
    SubtractWith=data_103,
    Tolerance=0.01,
    computeBBFastSolidDiff=True,
    retainFastSolidDiff=True,
    strictFastSolidDiff=True,
    trueIntFastSolidDiff=False)
fastsdiff_25 = FastSolidDifference(
    SubtractFrom=graft(dispatch_49.ListB),
    SubtractWith=data_103,
    Tolerance=0.01,
    computeBBFastSolidDiff=True,
    retainFastSolidDiff=True,
    strictFastSolidDiff=True,
    trueIntFastSolidDiff=False)
data_131 = Data([fastsdiff_23, fastsdiff_15])
dispatch_50 = Dispatch(List=data_131, DispatchPattern=smaller_9.OrEqualTo)  # -> ListA, ListB
data_132 = Data([fastsdiff_22, data_130])

data_133 = Data([fastsdiff_14, dispatch_46.ListB])

data_134 = Data([fastsdiff_25, fastsdiff_17])

data_135 = Data([fastsdiff_24, fastsdiff_16])

data_136 = Data(dispatch_50.ListB)

# ---- group: Massivkonstruktion / Satteldach Randbalken (continued)
fastsdiff_26 = FastSolidDifference(
    SubtractFrom=extr_75,
    SubtractWith=flatten(extr_22),
    Tolerance=0.01,
    computeBBFastSolidDiff=True,
    retainFastSolidDiff=True,
    strictFastSolidDiff=True,
    trueIntFastSolidDiff=False)

# ---- group: Massivkonstruktion
data_137 = Data(fastsdiff_26)

data_138 = Data(data_132)
dispatch_51 = Dispatch(List=data_138, DispatchPattern=bool_3)  # -> ListA, ListB
data_139 = Data(dispatch_51.ListB)

# ---- group: Holzkonstruktion (continued)
data_140 = Data(fastsdiff_19)

# ---- group: Massivkonstruktion
data_141 = Data([data_114, data_129])

# ---- group: Satteldach
debrep_2 = DeconstructBrep(Brep=brep_8)  # -> Faces, Edges, Vertices
edges_11 = BrepEdges(Brep=brep_8)  # -> Naked, Interior, NonManifold
srf_19 = Surface(debrep_2.Faces)
crv_51 = Curve(edges_11.Naked)
crv_52 = Curve(edges_11.Interior)

# ---- group: Satteldach / Holzbalken
panel_554 = Panel("Outside Curves Roof")
crv_53 = Curve(crv_51)
Z_112 = UnitZ(Factor=1)
md_slider_6 = MDSlider(SliderMode=0, slider_value=Point(0.5, 0.5, 0.5), x_domain=Domain(0, 1), y_domain=Domain(0, 1), z_domain=Domain(0, 1))
panel_555 = Panel("Breps Split Roof")
extr_76 = Extrude(Base=crv_53, Direction=Z_112)
srf_20 = Surface(srf_19)
md_slider_7 = MDSlider(SliderMode=0, slider_value=Point(0.5, 0.5, 0.5), x_domain=Domain(0, 1), y_domain=Domain(0, 1), z_domain=Domain(0, 1))
evalsrf_6 = EvaluateSurface(Surface=reparameterize(extr_76), Point=md_slider_6)  # -> Point, Normal, UDirection, VDirection, Frame
evalsrf_7 = EvaluateSurface(Surface=reparameterize(srf_20), Point=md_slider_7)  # -> Point, Normal, UDirection, VDirection, Frame
xy_5 = XYPlane(Origin=Point(0, 0, 0))
Y_5 = UnitY(Factor=1)
Y_6 = UnitY(Factor=1)
xy_6 = XYPlane(Origin=Point(0, 0, 0))
angle_5 = Angle(VectorA=evalsrf_6.Normal, VectorB=Y_5, Plane=xy_5)  # -> Angle, Reflex
deg_5 = Degrees(Radians=angle_5.Angle)
angle_6 = Angle(VectorA=evalsrf_7.Normal, VectorB=Y_6, Plane=xy_6)  # -> Angle, Reflex
deg_6 = Degrees(Radians=angle_6.Angle)
larger_10 = LargerThan(FirstNumber=deg_5, SecondNumber="225")  # -> LargerThan, OrEqualTo
smaller_13 = SmallerThan(FirstNumber=deg_5, SecondNumber="315")  # -> SmallerThan, OrEqualTo
smaller_14 = SmallerThan(FirstNumber=deg_5, SecondNumber="135")  # -> SmallerThan, OrEqualTo
larger_11 = LargerThan(FirstNumber=deg_5, SecondNumber="45")  # -> LargerThan, OrEqualTo
larger_12 = LargerThan(FirstNumber=deg_6, SecondNumber="225")  # -> LargerThan, OrEqualTo
smaller_15 = SmallerThan(FirstNumber=deg_6, SecondNumber="315")  # -> SmallerThan, OrEqualTo
smaller_16 = SmallerThan(FirstNumber=deg_6, SecondNumber="135")  # -> SmallerThan, OrEqualTo
larger_13 = LargerThan(FirstNumber=deg_6, SecondNumber="45")  # -> LargerThan, OrEqualTo
and_6 = GateAnd(A=larger_10.LargerThan, B=smaller_13.OrEqualTo)
and_7 = GateAnd(A=larger_11.LargerThan, B=smaller_14.OrEqualTo)
and_8 = GateAnd(A=larger_12.LargerThan, B=smaller_15.OrEqualTo)
and_9 = GateAnd(A=larger_13.LargerThan, B=smaller_16.OrEqualTo)
or_5 = GateOr(A=and_7, B=and_6)
invbool_4 = InvertBoolean(Boolean=or_5)  # -> Inverted, Number
or_6 = GateOr(A=and_9, B=and_8)
cull_25 = CullPattern(List=crv_53, CullPattern=invbool_4.Inverted)
invbool_5 = InvertBoolean(Boolean=or_6)  # -> Inverted, Number
len_8 = Length(Curve=cull_25)
cull_26 = CullPattern(List=srf_20, CullPattern=or_6)
cull_27 = CullPattern(List=srf_20, CullPattern=invbool_5.Inverted)
divlength = DivideLength(Curve=cull_25, Length=Slider(0.4, range=0..1))  # -> Points, Tangents, Parameters
brep_21 = Brep(cull_26)
lng_3 = ListLength(List=divlength.Points)  # -> flatten(Length)
evalsrf_8 = EvaluateSurface(Surface=reparameterize(cull_27), Point="{0,1,0}")  # -> Point, Normal, UDirection, VDirection, Frame
division_18 = Division(A=len_8, B=lng_3)
contour = Contour(Shape=cull_27, Point=evalsrf_8.Point, Direction=evalsrf_8.VDirection, Distance=division_18)
breite_balken_2 = Number(num_109)
panel_556 = Panel("Breite Balken")
xy_7 = XYPlane(Origin=Point(0, 0, 0))
neg_27 = Negative(Value=breite_balken_2)
offset_41 = OffsetCurve(Curve=contour, Distance=neg_27, Plane=xy_7, Corners=1)
rulesrf_2 = RuledSurface(CurveA=contour, CurveB=offset_41)
srf_21 = Surface(rulesrf_2)
srf_22 = Surface(srf_21)
breite_balken_3 = Number(num_107)
panel_557 = Panel("Höhe Balken")
Z_113 = UnitZ(Factor=breite_balken_3)
extr_77 = Extrude(Base=srf_22, Direction=Z_113)

# ---- group: Satteldach / Dachaufbau
# Breps Nach Oben Roof
# Breps Nach Oben Roof
panel_558 = Panel("Breps Balken")
num_157 = Number(num_107)
srf_23 = Surface(srf_22)
brep_22 = Brep(cull_27)
brep_23 = Brep(cull_27)
Z_114 = UnitZ(Factor="-1")
Z_115 = UnitZ(Factor=num_157)
move_70 = Move(Geometry=srf_23, Motion=Z_114)  # -> Geometry, Transform
join_64 = BrepJoin(Breps=brep_22)  # -> Breps, Closed
Z_116 = UnitZ(Factor="5")
move_71 = Move(Geometry=join_64.Breps, Motion=Z_115)  # -> Geometry, Transform
extr_78 = Extrude(Base=join_64.Breps, Direction=Z_115)
extr_79 = Extrude(Base=move_70.Geometry, Direction=Z_116)  # -> flatten(Extrusion)
fastsdiff_27 = FastSolidDifference(
    SubtractFrom=extr_78,
    SubtractWith=extr_79,
    Tolerance=0.01,
    computeBBFastSolidDiff=True,
    retainFastSolidDiff=True,
    strictFastSolidDiff=True,
    trueIntFastSolidDiff=False)
abstand_konterlattung = Number(Slider(0.2, range=0..1))
data_142 = Data(fastsdiff_27)
panel_561 = Panel("Dicke Lattung")
num_158 = Number(num_110)
panel_562 = Panel("Brep Dachbalken")
dicke_unterspannbahn_2 = Number(num_108)
Z_117 = UnitZ(Factor=dicke_unterspannbahn_2)
brep_24 = Brep(move_71.Geometry)
brep_25 = Brep(srf_21)
ma_14 = MassAddition(Input=[num_107, num_108, num_142, dicke_vorverdeckung_2])  # -> Result, PartialResults
move_72 = Move(Geometry=brep_24, Motion=Z_117)  # -> Geometry, Transform
extr_80 = Extrude(Base=brep_24, Direction=Z_117)
Z_118 = UnitZ(Factor=ma_14.Result)
move_73 = Move(Geometry=brep_25, Motion=Z_118)  # -> Geometry, Transform
num_159 = Number(num_110)
ma_15 = MassAddition(Input=[num_107, num_108, num_142, dicke_vorverdeckung_2, num_159])  # -> Result, PartialResults
Z_119 = UnitZ(Factor=ma_15.Result)
move_74 = Move(Geometry=brep_23, Motion=Z_119)  # -> Geometry, Transform
evalsrf_9 = EvaluateSurface(Surface=reparameterize(move_74.Geometry), Point="{0,1,0}")  # -> Point, Normal, UDirection, VDirection, Frame
contour_2 = Contour(Shape=move_74.Geometry, Point=evalsrf_9.Point, Direction=evalsrf_9.UDirection, Distance=abstand_konterlattung)
trim_9 = TrimTree(Tree=contour_2, Depth=1)
multiplication_24 = Multiplication(A=evalsrf_9.UDirection, B=num_158)
move_75 = Move(Geometry=trim_9, Motion=graft(multiplication_24))  # -> Geometry, Transform
rulesrf_3 = RuledSurface(CurveA=trim_9, CurveB=move_75.Geometry)
cull_i = CullIndex(List=rulesrf_3, Indices="0", Wrap=True)
dicke_unterspannbahn_3 = Number(num_142)
md_slider_8 = MDSlider(SliderMode=0, slider_value=Point(0.5, 0.5, 0.5), x_domain=Domain(0, 1), y_domain=Domain(0, 1), z_domain=Domain(0, 1))
Z_120 = UnitZ(Factor=num_159)
Z_121 = UnitZ(Factor=dicke_unterspannbahn_3)
brep_26 = Brep(move_72.Geometry)
extr_81 = Extrude(Base=move_73.Geometry, Direction=Z_120)
evalsrf_10 = EvaluateSurface(Surface=reparameterize(rulesrf_3), Point=md_slider_8)  # -> Point, Normal, UDirection, VDirection, Frame
move_76 = Move(Geometry=brep_26, Motion=Z_121)  # -> Geometry, Transform
extr_82 = Extrude(Base=brep_26, Direction=Z_121)
num_160 = Number(num_110)
multiplication_25 = Multiplication(A=evalsrf_10.Normal, B=num_160)
rev_3 = Reverse(Vector=multiplication_25)
dicke_unterspannbahn_4 = Number(dicke_vorverdeckung_2)
Z_122 = UnitZ(Factor=dicke_unterspannbahn_4)
brep_27 = Brep(move_76.Geometry)
extr_83 = Extrude(Base=rulesrf_3, Direction=rev_3)
extr_84 = Extrude(Base=brep_27, Direction=Z_122)
item_41 = ListItem(List=extr_83, Index=0, Wrap=True)
bbox_3 = BoundingBox(Content=item_41, Plane=PlaneXY(0, 0, 0))  # -> Box, Box_2
debox_3 = DeconstructBox(Box=bbox_3.Box)  # -> Plane, X, Y, Z
item_42 = ListItem(List=flatten(debox_3.Z), Index="0", Wrap=True)
num_161 = Number(item_42)

# ---- group: Satteldach / Ziegel
# Breps Nach Oben Roof Joined
number_slider_6 = Slider(0.02, range=0..0.1)
ma_16 = MassAddition(Input=flatten([num_107, num_108, num_142, dicke_vorverdeckung_2, num_159, num_161]))  # -> Result, PartialResults
brep_28 = Brep(join_64.Breps)
edges_12 = BrepEdges(Brep=brep_28)  # -> Naked, Interior, NonManifold
addition_22 = Addition(A=ma_16.Result, B=number_slider_6)
Z_123 = UnitZ(Factor=ma_16.Result)
crv_54 = Curve(edges_12.Naked)
brep_29 = Brep(brep_22)
Z_124 = UnitZ(Factor=addition_22)
move_77 = Move(Geometry=brep_29, Motion=Z_123)  # -> Geometry, Transform
extr_85 = Extrude(Base=crv_54, Direction=Z_124)
brep_30 = Brep(move_77.Geometry)
Z_125 = UnitZ(Factor=number_slider_6)
neg_28 = Negative(Value=Slider(0.005, range=0..0.01))
neg_29 = Negative(Value="1")
move_78 = Move(Geometry=brep_30, Motion=Z_125)  # -> Geometry, Transform
extr_86 = Extrude(Base=brep_30, Direction=Z_125)
offsetbrep_3 = OffsetBrep(Brep=extr_85, OffsetDistance=neg_28, Solid=Toggle(True), SharpEdges=True, Tolerance=0.01)
offsetbrep_4 = OffsetBrep(Brep=extr_85, OffsetDistance=neg_29, Solid=Toggle(True), SharpEdges=True, Tolerance=0.01)  # -> flatten(Offset)

# ----
brep_31 = Brep(move_78.Geometry)
dispatch_52 = Dispatch(List=brep_31, DispatchPattern=bool_16)  # -> ListA, ListB

brep_32 = Brep(flatten([dispatch_41.ListA, dispatch_52.ListB]))
brep_33 = Brep(graft(brep_32))

# ---- group: Satteldach / Ziegel
panel_565 = Panel("Output Data Ziegel")
data_143 = Data([offsetbrep_3, extr_86])

# ---- group: Satteldach / Außenwand Gibel
brep_34 = Brep(brep_21)
panel_567 = Panel("Kurve ganz Außen")
num_162 = Number(num_13)
neg_30 = Negative(Value=num_162)
crv_55 = Curve(data_94)
offsetbrep_5 = OffsetBrep(Brep=brep_34, OffsetDistance=neg_30, Solid=False, SharpEdges=True, Tolerance=0.01)
num_163 = Number(num)
Z_126 = UnitZ(Factor=num_163)
neg_31 = Negative(Value=Z_126)
move_79 = Move(Geometry=offsetbrep_5, Motion=neg_31)  # -> Geometry, Transform
bcx_5 = BrepCurve(Brep=move_79.Geometry, Curve=crv_55)  # -> Curves, Points
null_3 = NullItem(Item=bcx_5.Curves)  # -> NullFlags, InvalidFlags, Description
Z_127 = UnitZ(Factor=Slider(100000000, range=0..100000000))
extr_87 = Extrude(Base=crv_55, Direction=Z_127)
cull_28 = CullPattern(List=graft(brep_34), CullPattern=null_3.NullFlags)
split_15 = SplitBrep(Brep=cull_28, Cutter=extr_87)
area_7 = Area(Geometry=split_15)  # -> Area, Centroid
bnd_29 = Bounds(Numbers=area_7.Area)
dedomain_26 = DeconstructDomain(Domain=bnd_29)  # -> Start, End
smaller_17 = SmallerThan(FirstNumber=dedomain_26.End, SecondNumber=area_7.Area)  # -> SmallerThan, OrEqualTo
cull_29 = CullPattern(List=split_15, CullPattern=smaller_17.OrEqualTo)
num_164 = Number(data_90)
neg_32 = Negative(Value=num_164)
offsetbrep_6 = OffsetBrep(Brep=cull_29, OffsetDistance=neg_32, Solid=Toggle(True), SharpEdges=True, Tolerance=0.01)  # -> simplify(flatten(Offset))

# ---- group: Satteldach / Dachaufbau
data_144 = Data(extr_80)

data_145 = Data(extr_82)

data_146 = Data(extr_84)

data_147 = Data([extr_81, extr_83])

# ---- group: Satteldach / Holzbalken
data_148 = Data(extr_77)

# ---- group: Satteldach / Außenwand Gibel
data_149 = Data(offsetbrep_6)

# ---- group: Holzkonstruktion (continued)
dispatch_53 = Dispatch(List=[data_121, extr_49], DispatchPattern=bool_16)  # -> ListA, ListB
dispatch_54 = Dispatch(List=[extr_48, data_123], DispatchPattern=bool_16)  # -> ListA, ListB
dispatch_55 = Dispatch(List=[extr_10, data_122], DispatchPattern=bool_16)  # -> ListA, ListB
dispatch_56 = Dispatch(List=[data_125, extr_50], DispatchPattern=bool_16)  # -> ListA, ListB
bcx_6 = BrepCurve(Brep=dach_brep_unterseite_4, Curve=line_6, UseTasks=False)  # -> Curves, flatten(Points)
bcx_7 = BrepCurve(Brep=dach_brep_unterseite_4, Curve=line_7, UseTasks=False)  # -> Curves, flatten(Points)
dispatch_57 = Dispatch(List=[extr_11, data_128], DispatchPattern=bool_16)  # -> ListA, ListB
dist_8 = Distance(PointA=midpt_4, PointB=bcx_6.Points)
dist_9 = Distance(PointA=midpt_5, PointB=bcx_7.Points)
fastsdiff_28 = FastSolidDifference(
    SubtractFrom=graft(dispatch_53.ListB),
    SubtractWith=data_103,
    Tolerance=0.01,
    computeBBFastSolidDiff=True,
    retainFastSolidDiff=True,
    strictFastSolidDiff=True,
    trueIntFastSolidDiff=False)
fastsdiff_29 = FastSolidDifference(
    SubtractFrom=graft(dispatch_54.ListB),
    SubtractWith=data_103,
    Tolerance=0.01,
    computeBBFastSolidDiff=True,
    retainFastSolidDiff=True,
    strictFastSolidDiff=True,
    trueIntFastSolidDiff=False)
fastsdiff_30 = FastSolidDifference(
    SubtractFrom=graft(dispatch_55.ListB),
    SubtractWith=data_103,
    Tolerance=0.01,
    computeBBFastSolidDiff=True,
    retainFastSolidDiff=True,
    strictFastSolidDiff=True,
    trueIntFastSolidDiff=False)
fastsdiff_31 = FastSolidDifference(
    SubtractFrom=graft(dispatch_56.ListB),
    SubtractWith=data_103,
    Tolerance=0.01,
    computeBBFastSolidDiff=True,
    retainFastSolidDiff=True,
    strictFastSolidDiff=True,
    trueIntFastSolidDiff=False)
bnd_30 = Bounds(Numbers=dist_8)
bnd_31 = Bounds(Numbers=dist_9)
fastsdiff_32 = FastSolidDifference(
    SubtractFrom=graft(dispatch_57.ListB),
    SubtractWith=data_103,
    Tolerance=0.01,
    computeBBFastSolidDiff=True,
    retainFastSolidDiff=True,
    strictFastSolidDiff=True,
    trueIntFastSolidDiff=False)
dedomain_27 = DeconstructDomain(Domain=bnd_30)  # -> Start, End
dedomain_28 = DeconstructDomain(Domain=bnd_31)  # -> Start, End
subtraction_21 = Subtraction(A=dedomain_27.Start, B=dedomain_28.Start)
subtraction_22 = Subtraction(A=dedomain_27.Start, B=subtraction_21)
Z_128 = UnitZ(Factor=subtraction_22)
Z_129 = UnitZ(Factor=dedomain_28.Start)
Z_130 = UnitZ(Factor=dedomain_28.Start)
dispatch_58 = Dispatch(List=Z_128, DispatchPattern=bool_16)  # -> ListA, ListB
move_80 = Move(Geometry=boundary_9, Motion=Z_129)  # -> Geometry, Transform
Z_131 = UnitZ(Factor=subtraction_21)
dispatch_59 = Dispatch(List=Z_130, DispatchPattern=bool_16)  # -> ListA, ListB
extr_88 = Extrude(Base=move_21.Geometry, Direction=dispatch_58.ListB)
extr_89 = Extrude(Base=move_80.Geometry, Direction=Z_131)
cap_9 = CapHoles(Brep=extr_88)
extr_90 = Extrude(Base=boundary_9, Direction=dispatch_59.ListB)
fastsdiff_33 = FastSolidDifference(
    SubtractFrom=graft(extr_89),
    SubtractWith=data_103,
    Tolerance=0.01,
    computeBBFastSolidDiff=True,
    retainFastSolidDiff=True,
    strictFastSolidDiff=True,
    trueIntFastSolidDiff=False)
fastsdiff_34 = FastSolidDifference(
    SubtractFrom=graft(cap_9),
    SubtractWith=data_103,
    Tolerance=0.01,
    UseTasks=False,
    computeBBFastSolidDiff=True,
    retainFastSolidDiff=True,
    strictFastSolidDiff=True,
    trueIntFastSolidDiff=False)

# ---- group: Holzkonstruktion / Dachteil (continued)
srf_24 = Surface(move_80.Geometry)
vec_21 = Vector(Z_131)
move_81 = Move(Geometry=srf_24, Motion=vec_21)  # -> Geometry, Transform
extr_91 = Extrude(Base=move_81.Geometry, Direction=Z_63)
brep_35 = Brep(dach_brep_unterseite_4)
split_16 = SplitBrep(Brep=extr_91, Cutter=brep_35)
volume_13 = Volume(Geometry=split_16)  # -> Volume, Centroid
bnd_32 = Bounds(Numbers=volume_13.Volume)
dedomain_29 = DeconstructDomain(Domain=bnd_32)  # -> Start, End
equals_16 = Equality(FirstNumber=volume_13.Volume, SecondNumber=dedomain_29.End)  # -> Equality, Inequality
cull_30 = CullPattern(List=split_16, CullPattern=equals_16.Inequality)
data_150 = Data(cull_30)

# ---- group: Holzkonstruktion (continued)
data_151 = Data([fastsdiff_29, fastsdiff_9])

data_152 = Data([fastsdiff_28, fastsdiff_8])

data_153 = Data([fastsdiff_30, fastsdiff_10])

data_154 = Data([fastsdiff_31, fastsdiff_11])

data_155 = Data([fastsdiff_32, fastsdiff_7])

data_156 = Data(fastsdiff_33)

data_157 = Data([fastsdiff_34, fastsdiff_12])

fastsdiff_35 = FastSolidDifference(
    SubtractFrom=extr_90,
    SubtractWith=data_157,
    Tolerance=0.01,
    computeBBFastSolidDiff=True,
    retainFastSolidDiff=True,
    strictFastSolidDiff=True,
    trueIntFastSolidDiff=False)
dispatch_60 = Dispatch(List=[extr_12, data_150], DispatchPattern=bool_16)  # -> ListA, ListB
fastsdiff_36 = FastSolidDifference(
    SubtractFrom=graft(dispatch_60.ListB),
    SubtractWith=data_103,
    Tolerance=0.01,
    computeBBFastSolidDiff=True,
    retainFastSolidDiff=True,
    strictFastSolidDiff=True,
    trueIntFastSolidDiff=False)
fastsdiff_37 = FastSolidDifference(
    SubtractFrom=graft(fastsdiff_35),
    SubtractWith=data_103,
    Tolerance=0.01,
    computeBBFastSolidDiff=True,
    retainFastSolidDiff=True,
    strictFastSolidDiff=True,
    trueIntFastSolidDiff=False)

data_158 = Data([fastsdiff_36, fastsdiff_37])

# ---- group: Solarpanel Generierung
panel_575 = Panel("Vektor Optimale Sonnenrichtung")
number_slider_7 = Slider(0.03, range=0..0.1)
panel_576 = Panel("Rectangle Solar Oberfläche")
vec_22 = Vector(vec_20.Vector)
unit = UnitVector(Vector=vec_22)
multiplication_26 = Multiplication(A=number_slider_7, B=unit)
panel_577 = Panel("Vektor Dachrichtung")
neg_33 = Negative(Value=number_slider_7)
vec_23 = Vector(unit)
multiplication_27 = Multiplication(A=vec_23, B=Slider(0.01, range=0..0.01))
data_159 = Data(skymatrix.sky_mtx)

# ---- group: Position Solarpanele
debrep_3 = DeconstructBrep(Brep=brep_33)  # -> Faces, Edges, Vertices
edges_13 = BrepEdges(Brep=debrep_3.Faces)  # -> Naked, Interior, NonManifold
boundary_33 = BoundarySurfaces(Edges=edges_13.Naked)
bbox_4 = BoundingBox(Content=boundary_33, Plane=PlaneXY(0, 0, 0))  # -> Box, Box_2
join_65 = JoinCurves(Curves=edges_13.Naked, Preserve=False)
debox_4 = DeconstructBox(Box=bbox_4.Box)  # -> Plane, X, Y, Z
num_165 = Number(debox_4.X)
num_166 = Number(debox_4.Y)
num_167 = Number(debox_4.Z)
sqr = Square(Value=num_166)
sqr_2 = Square(Value=num_167)
number_slider_8 = Slider(0.8, range=0..1)
addition_23 = Addition(A=sqr, B=sqr_2)
sqrt = SquareRoot(Value=addition_23)
division_19 = Division(A=sqrt, B=number_slider_8)
division_20 = Division(A=num_165, B=number_slider_8)
round = Round(Number=division_20)  # -> Nearest, Floor, Ceiling
round_2 = Round(Number=division_19)  # -> Nearest, Floor, Ceiling
divide_4 = DivideDomain²(Domain=boundary_33, UCount=round.Floor, VCount=round_2.Floor)
subsrf = Isotrim(Surface=boundary_33, Domain=divide_4)
sqr_3 = Square(Value=number_slider_8)
cp_2 = ControlPoints(Curve=subsrf)  # -> Points, Weights, Knots
multiplication_28 = Multiplication(A=sqr_3, B=Slider(2, range=0..10))
trim_10 = TrimTree(Tree=cp_2.Points, Depth=1)
sqrt_2 = SquareRoot(Value=multiplication_28)
srf_cp = SurfaceClosestPoint(Point=cp_2.Points, Surface=flatten(boundary_33))  # -> Point, UVPoint, Distance
division_21 = Division(A=sqrt_2, B=Slider(2, range=0..10))
trim_11 = TrimTree(Tree=srf_cp.Distance, Depth=1)
smaller_18 = SmallerThan(FirstNumber=trim_11, SecondNumber=Slider(0.03, range=0..0.1))  # -> SmallerThan, OrEqualTo
cull_31 = CullPattern(List=trim_10, CullPattern=smaller_18.SmallerThan)  # -> flatten(List)
neg_34 = Negative(Value="10")
Z_132 = UnitZ(Factor=neg_34)
Z_133 = UnitZ(Factor=1)
panel_578 = Panel("Dach Brep Splitted")
brep_36 = Brep(graft(debrep_3.Faces))
md_slider_9 = MDSlider(SliderMode=0, slider_value=Point(0, 0, 0.5), x_domain=Domain(0, 1), y_domain=Domain(0, 1), z_domain=Domain(0, 1))
evalsrf_11 = EvaluateSurface(Surface=reparameterize(brep_36), Point=md_slider_9)  # -> Point, Normal, UDirection, VDirection, Frame
panel_579 = Panel("Maximalgröße Zellen")
num_168 = Number(number_slider_8)
division_22 = Division(A=num_168, B="2")
division_23 = Division(A=num_168, B="2")
panel_580 = Panel("Vektor Plane Y")
panel_581 = Panel("Vektor Plane X")
multiplication_29 = Multiplication(A=division_23, B=evalsrf_11.VDirection)
multiplication_30 = Multiplication(A=division_22, B=evalsrf_11.UDirection)
neg_35 = Negative(Value=multiplication_29)
neg_36 = Negative(Value=multiplication_30)
vec_24 = Vector(vec_20.Vector)
panel_583 = Panel("Vektor Normale Dach")
vec_25 = Vector(evalsrf_11.Normal)

# ---- group: Wetterdaten Manipulation (continued)
incidentradiation = LBIncidentRadiation(
    sky_mtx=skymatrix.sky_mtx,
    geometry=flatten(brep_33),
    context=flatten(dispatch_40.ListA),
    grid_size="0.5",
    run=Toggle(True))  # -> report, points, results, total, mesh, legend, title, int_mtx; plug-in component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
bnd_33 = Bounds(Numbers=incidentradiation.results)
dedomain_30 = DeconstructDomain(Domain=bnd_33)  # -> Start, End
subtraction_23 = Subtraction(A=dedomain_30.End, B=dedomain_30.Start)
multiplication_31 = Multiplication(A=subtraction_23, B=Slider(0.8, range=0..1))
addition_24 = Addition(A=dedomain_30.Start, B=multiplication_31)
larger_14 = LargerThan(FirstNumber=incidentradiation.results, SecondNumber=addition_24)  # -> LargerThan, OrEqualTo
cull_32 = CullPattern(List=incidentradiation.points, CullPattern=larger_14.LargerThan)

# ---- group: Position Solarpanele (continued)
dist_10 = Distance(PointA=graft(cull_32), PointB=cull_31)
smaller_19 = SmallerThan(FirstNumber=dist_10, SecondNumber=division_21)  # -> SmallerThan, OrEqualTo
cull_33 = CullPattern(List=cull_31, CullPattern=smaller_19.SmallerThan)  # -> flatten(List)
crv_cp_8 = CurveClosestPoint(Point=cull_33, Curve=join_65)  # -> Point, Parameter, Distance
larger_15 = LargerThan(FirstNumber=crv_cp_8.Distance, SecondNumber=division_21)  # -> LargerThan, OrEqualTo
python_7 = GhPythonScript(Bool_List_In=larger_15.LargerThan)  # -> out, result_tree; inputs Bool_List_In: tree of Boolean
# ---------- python_7: Python ----------
__author__ = "mfls"
__version__ = "2024.08.01"

import ghpythonlib.treehelpers as th
import Grasshopper.DataTree as DataTree
from Grasshopper.Kernel.Data import GH_Path

# Function to combine boolean trees
def combine_boolean_trees(trees):
    # Initialize the result tree with values from the first tree
    result_tree = DataTree[bool]()
    
    # Determine the branch count from the first tree
    branch_count = trees[0].BranchCount
    for i in range(branch_count):
        # Get the path of the current branch
        branch_path = trees[0].Path(i)
        
        # Get the number of items in the current branch
        branch_length = len(trees[0].Branch(i))
        
        for j in range(branch_length):
            # Start with the value from the first tree
            combined_value = trees[0].Branch(i)[j]
            for tree in trees[1:]:
                combined_value = combined_value and tree.Branch(i)[j]
                # If any comparison is false, update the result tree
                if not combined_value:
                    break
            result_tree.Add(combined_value, branch_path)
    
    return result_tree

# Convert input data tree to a list of lists
trees = [Bool_List_In.Branch(i) for i in range(Bool_List_In.BranchCount)]

# Convert each tree branch back to a DataTree for easier manipulation
data_trees = []
for i, branch in enumerate(trees):
    tree = DataTree[bool]()
    path = GH_Path(i)
    for j, item in enumerate(branch):
        tree.Add(item, path)
    data_trees.append(tree)

# Combine the boolean trees
result_tree = combine_boolean_trees(data_trees)
# ---------- end python_7 ----------
cull_34 = CullPattern(List=cull_33, CullPattern=python_7.result_tree)
cullpt = CullDuplicates(Points=cull_34, Tolerance=0.1, CullMode=3)  # -> Points, Indices, Valence
move_82 = Move(Geometry=cullpt.Points, Motion=Z_132)  # -> Geometry, Transform
line_10 = LineSDL(Start=move_82.Geometry, Direction=Z_133, Length=Slider(100000000, range=0..100000000))
bcx_8 = BrepCurve(Brep=brep_36, Curve=line_10)  # -> Curves, Points
trim_12 = TrimTree(Tree=bcx_8.Points, Depth=1)
pt_9 = Point(trim_12)
pl_5 = ConstructPlane(Origin=pt_9, XAxis=evalsrf_11.UDirection, YAxis=evalsrf_11.VDirection)
rectangle_7 = Rectangle(Plane=pl_5, XSize=num_168, YSize=num_168, Radius=0)  # -> Rectangle, Length
move_83 = Move(Geometry=rectangle_7.Rectangle, Motion=neg_36)  # -> Geometry, Transform
move_84 = Move(Geometry=move_83.Geometry, Motion=neg_35)  # -> Geometry, Transform
cp_3 = ControlPoints(Curve=move_84.Geometry)  # -> Points, Weights, Knots
area_8 = Area(Geometry=move_84.Geometry)  # -> Area, Centroid
rotate_4 = RotateDirection(Geometry=move_84.Geometry, Center=area_8.Centroid, From=evalsrf_11.Normal, To=vec_24)  # -> Geometry, Transform
cp_4 = ControlPoints(Curve=rotate_4.Geometry)  # -> Points, Weights, Knots
pdecon_2 = Deconstruct(Point=cp_4.Points)  # -> XComponent, YComponent, ZComponent
pdecon_3 = Deconstruct(Point=cp_3.Points)  # -> XComponent, YComponent, ZComponent
subtraction_24 = Subtraction(A=pdecon_2.XComponent, B=pdecon_3.XComponent)
subtraction_25 = Subtraction(A=pdecon_2.ZComponent, B=pdecon_3.ZComponent)
subtraction_26 = Subtraction(A=pdecon_2.YComponent, B=pdecon_3.YComponent)
abs_2 = Absolute(Value=subtraction_25)
abs_3 = Absolute(Value=subtraction_24)
abs_4 = Absolute(Value=subtraction_26)
bnd_34 = Bounds(Numbers=abs_2)
bnd_35 = Bounds(Numbers=abs_3)
bnd_36 = Bounds(Numbers=abs_4)
dedomain_31 = DeconstructDomain(Domain=bnd_34)  # -> Start, End
dedomain_32 = DeconstructDomain(Domain=bnd_35)  # -> Start, End
dedomain_33 = DeconstructDomain(Domain=bnd_36)  # -> Start, End
sqr_4 = Square(Value=dedomain_32.End)
sqr_5 = Square(Value=dedomain_33.End)
sqr_6 = Square(Value=dedomain_31.End)
addition_25 = Addition(A=sqr_4, B=sqr_5, C=sqr_6)
sqrt_3 = SquareRoot(Value=addition_25)
trim_13 = TrimTree(Tree=sqrt_3, Depth=1)
multiplication_32 = Multiplication(A=trim_13, B=vec_25)
move_85 = Move(Geometry=rotate_4.Geometry, Motion=multiplication_32)  # -> Geometry, Transform
null_4 = NullItem(Item=move_85.Geometry)  # -> NullFlags, InvalidFlags, Description
invbool_6 = InvertBoolean(Boolean=null_4.NullFlags)  # -> Inverted, Number
cull_35 = CullPattern(List=move_85.Geometry, CullPattern=invbool_6.Number)

# ---- group: Solarpanel Generierung (continued)
rec = Rectangle(cull_35)
crv_56 = Curve(rec)
cp_5 = ControlPoints(Curve=crv_56)  # -> Points, Weights, Knots
rec_2 = Rectangle(graft(rec))
extr_92 = Extrude(Base=crv_56, Direction=multiplication_26)
offset_42 = OffsetCurve(Curve=crv_56, Distance=neg_33, Corners=1)
trim_14 = TrimTree(Tree=cp_5.Points, Depth=1)
vec_26 = Vector(evalsrf_11.Normal)
srf_cp_2 = SurfaceClosestPoint(Point=trim_14, Surface=boundary_33)  # -> Point, UVPoint, Distance
cp_6 = ControlPoints(Curve=offset_42)  # -> Points, Weights, Knots
crv_57 = Curve(offset_42)
neg_37 = Negative(Value=srf_cp_2.Distance)
rec_2pt = Rectangle2Pt(Plane=rec_2, PointA=cp_5.Points, PointB=cp_6.Points, Radius=0)  # -> Rectangle, Length
boundary_34 = BoundarySurfaces(Edges=crv_57)
offsetbrep_7 = OffsetBrep(Brep=extr_92, OffsetDistance=number_slider_7, Solid=Toggle(True), SharpEdges=True, Tolerance=0.01)
multiplication_33 = Multiplication(A=vec_26, B=neg_37)
extr_93 = Extrude(Base=boundary_34, Direction=multiplication_27)
srf_25 = Surface(boundary_34)
trim_15 = TrimTree(Tree=rec_2pt.Rectangle, Depth=1)
trim_16 = TrimTree(Tree=trim_15, Depth=1)
extr_94 = Extrude(Base=trim_16, Direction=multiplication_33)
srf_26 = Surface(srf_25)
incidentradiation_2 = LBIncidentRadiation(sky_mtx=data_159, geometry=flatten(srf_26), grid_size="0.2", run=Toggle(True))  # -> report, points, results, total, mesh, legend, title, int_mtx; plug-in component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
multiplication_34 = Multiplication(A=incidentradiation_2.total, B=Slider(0.1, range=0..0.1))
division_24 = Division(A=multiplication_34, B="365")
panel_584 = Panel(division_24)

data_160 = Data(extr_93)
panel_585 = Panel("Output Data Solar")

data_161 = Data([offsetbrep_7, extr_94])

panel_587 = Panel(panel_584)
join_66 = TextJoin(Text=["Solarenergie im durchschnitt kWh/d", panel_587], Join=" = ")

# ---- group: Wetterdaten Manipulation (continued)
txt_4 = Text(join_66)
join_67 = TextJoin(Text=[join_58, join_57, txt_4])
panel_588 = Panel(join_67)

panel_589 = Panel("Text Solar")
txt_5 = Text(panel_588)

# ---- group: Schnittgenerierung
number_slider_9 = Slider(30, range=0..100)
number_slider_10 = Slider(30, range=0..100)
deplane = DeconstructPlane(Plane=pln_3)  # -> Origin, XAxis, YAxis, ZAxis
rectangle_8 = Rectangle(Plane=pln_3, XSize=number_slider_10, YSize=number_slider_9, Radius=0)  # -> Rectangle, Length
num_169 = Number(number_slider_10)
num_170 = Number(number_slider_9)
division_25 = Division(A=num_169, B="-2")
division_26 = Division(A=num_170, B="-2")
amp_2 = Amplitude(Vector=deplane.XAxis, Amplitude=division_25)
amp_3 = Amplitude(Vector=deplane.YAxis, Amplitude=division_26)
move_86 = Move(Geometry=rectangle_8.Rectangle, Motion=amp_3)  # -> Geometry, Transform
move_87 = Move(Geometry=move_86.Geometry, Motion=amp_2)  # -> Geometry, Transform
srf_27 = Surface(move_87.Geometry)
panel_590 = Panel("Mittelpunkt Fläche")
pt_10 = Point(area_6.Centroid)
pl_6 = ConstructPlane(Origin=pt_10, XAxis=Vector(1, 0, 0), YAxis=Vector(0, 1, 0))
geo = Geometry(data_4)
bbox_5 = BoundingBox(Content=geo, Plane=PlaneXY(0, 0, 0), UnionBox=True)  # -> Box, Box_2
debox_5 = DeconstructBox(Box=bbox_5.Box)  # -> Plane, X, Y, Z
debox_6 = DeconstructBox(Box=bbox_5.Box)  # -> Plane, X, Y, Z
num_171 = Number(debox_5.Y)
num_172 = Number(debox_6.X)
multiplication_35 = Multiplication(A=num_171, B="1.3")
multiplication_36 = Multiplication(A=num_172, B="1.3")
X_2 = UnitX(Factor=multiplication_35)
Y_7 = UnitY(Factor=multiplication_35)
X_3 = UnitX(Factor=multiplication_36)

panel_591 = Panel("Output Schnitt")

# ---- group: Verarbeitung und Ausgabe
swatch = ColourSwatch(SwatchColor=RGB(255, 255, 255))
swatch_2 = ColourSwatch(SwatchColor=RGB(3, 2, 13))
panel_592 = Panel("Solar")
data_162 = Data(data_160)
swatch_3 = ColourSwatch(SwatchColor=RGB(176, 176, 176))
panel_593 = Panel("Beton")
swatch_4 = ColourSwatch(SwatchColor=RGB(0, 0, 0))
swatch_5 = ColourSwatch(SwatchColor=RGB(255, 255, 255))
panel_594 = Panel("Holz")
panel_597 = Panel("Boden")
data_163 = Data([data_139, data_81, data_109, data_42, data_40, data_82, data_76])
data_164 = Data([data_137, data_115, data_140, data_39, data_101, data_154, data_157, data_156, data_104, data_77, data_148, data_147, data_141, data_11])
panel_599 = Panel("Putz")
panel_600 = Panel("Metall")
data_165 = Data([data_136, data_84, data_111, data_43, data_151, data_93, data_158, data_78, data_142, data_145])
panel_601 = Panel("Glas")
data_166 = Data(boundary_20)
swatch_6 = ColourSwatch(SwatchColor=RGB(204, 204, 204))
swatch_7 = ColourSwatch(SwatchColor=RGB(245, 206, 152))
data_167 = Data([data_134, data_83, data_44, data_41, data_153, data_85, data_113, data_79, data_144, data_146])
panel_602 = Panel("Ziegel")
data_168 = Data(data_143)
swatch_8 = ColourSwatch(SwatchColor=RGB(221, 232, 21))
data_169 = Data([data_133, data_118, data_155, data_149, data_119])
data_170 = Data([data_135, data_112, data_110, data_152])
data_171 = Data([data_96, data_98, data_102, data_161])
swatch_9 = ColourSwatch(SwatchColor=RGB(30, 45, 74))
swatch_10 = ColourSwatch(SwatchColor=RGB(176, 176, 176))
swatch_11 = ColourSwatch(SwatchColor=RGB(224, 224, 224))
data_172 = Data(data_99)
mcol = MeshColours(Mesh=data_164, Colours=swatch_7)
mcol_2 = MeshColours(Mesh=data_163, Colours=swatch_6)
mcol_3 = MeshColours(Mesh=data_165, Colours=swatch_8)
mcol_4 = MeshColours(Mesh=data_170, Colours=swatch_10)
mcol_5 = MeshColours(Mesh=data_171, Colours=swatch_3)
mcol_6 = MeshColours(Mesh=data_172, Colours=swatch)
mcol_7 = MeshColours(Mesh=data_169, Colours=swatch_11)
mcol_8 = MeshColours(Mesh=data_167, Colours=swatch_4)
mcol_9 = MeshColours(Mesh=data_162, Colours=swatch_2)
mcol_10 = MeshColours(Mesh=data_168, Colours=swatch_9)
mcol_11 = MeshColours(Mesh=data_166, Colours=swatch_5)
material = CreateMaterial(Diffuse=swatch_6, Specular=RGB(255, 255, 255), Emission=RGB(0, 0, 0), Transparency=0, Shine=Slider(0, range=0..100))
material_2 = CreateMaterial(Diffuse=swatch_7, Specular=RGB(255, 255, 255), Emission=RGB(0, 0, 0), Transparency=0, Shine=Slider(10, range=0..100))
material_3 = CreateMaterial(Diffuse=swatch_8, Specular=RGB(255, 255, 255), Emission=RGB(0, 0, 0), Transparency=0, Shine=Slider(0, range=0..100))
material_4 = CreateMaterial(Diffuse=swatch_4, Specular=RGB(255, 255, 255), Emission=RGB(0, 0, 0), Transparency=0, Shine=Slider(4, range=0..100))
material_5 = CreateMaterial(Diffuse=swatch_9, Specular=RGB(255, 255, 255), Emission=RGB(0, 0, 0), Transparency=0, Shine=Slider(16, range=0..100))
material_6 = CreateMaterial(Diffuse=swatch_10, Specular=RGB(255, 255, 255), Emission=RGB(0, 0, 0), Transparency=0, Shine=Slider(0, range=0..100))
material_7 = CreateMaterial(Diffuse=swatch_3, Specular=RGB(255, 255, 255), Emission=RGB(0, 0, 0), Transparency=0, Shine=Slider(2, range=0..100))
material_8 = CreateMaterial(Diffuse=swatch_11, Specular=RGB(255, 255, 255), Emission=RGB(0, 0, 0), Transparency=0, Shine=Slider(0, range=0..100))
material_9 = CreateMaterial(Diffuse=swatch, Specular=RGB(255, 255, 255), Emission=RGB(0, 0, 0), Transparency=Slider(0.8, range=0..1), Shine=0)
material_10 = CreateMaterial(Diffuse=swatch_2, Specular=RGB(255, 255, 255), Emission=RGB(0, 0, 0), Transparency=0, Shine=Slider(5, range=0..100))
material_11 = CreateMaterial(Diffuse=swatch_5, Specular=RGB(255, 255, 255), Emission=RGB(0, 0, 0), Transparency=0, Shine=Slider(0, range=0..100))
mesh = Mesh(mcol)
mesh_2 = Mesh(mcol_2)
mesh_3 = Mesh(mcol_3)
mesh_4 = Mesh(mcol_4)
mesh_5 = Mesh(mcol_5)
mesh_6 = Mesh(mcol_7)
mesh_7 = Mesh(mcol_6)
mesh_8 = Mesh(mcol_10)
mesh_9 = Mesh(mcol_8)
mesh_10 = Mesh(mcol_9)
mesh_11 = Mesh(mcol_11)

preview = CustomPreview(Geometry=data_163, Material=material)
preview_2 = CustomPreview(Geometry=data_164, Material=material_2)
preview_3 = CustomPreview(Geometry=data_165, Material=material_3)
preview_4 = CustomPreview(Geometry=data_167, Material=material_4)
preview_5 = CustomPreview(Geometry=data_168, Material=material_5)
preview_6 = CustomPreview(Geometry=data_170, Material=material_6)
preview_7 = CustomPreview(Geometry=data_171, Material=material_7)
preview_8 = CustomPreview(Geometry=data_169, Material=material_8)
preview_9 = CustomPreview(Geometry=data_172, Material=material_9)
preview_10 = CustomPreview(Geometry=data_162, Material=material_10)
preview_11 = CustomPreview(Geometry=data_166, Material=material_11)

panel_606 = Panel("Text Klima")
data_173 = Data(simplify(flatten([mesh_2, mesh, mesh_3, mesh_9, mesh_6, mesh_8, mesh_4, mesh_5, mesh_7, mesh_10, mesh_11])))
txt_6 = Text(txt_2)
txt_7 = Text(txt_3)
txt_8 = Text(txt_5)
txt_9 = Text([join_34, join_47])

mesh_12 = Mesh(data_173)
panel_607 = Panel(mesh_12)
join_68 = TextJoin(Text=[txt_6, txt_7, txt_8, txt_9])
null_5 = NullItem(Item=mesh_12)  # -> NullFlags, InvalidFlags, Description
invbool_7 = InvertBoolean(Boolean=null_5.NullFlags)  # -> Inverted, Number
cull_36 = CullPattern(List=mesh_12, CullPattern=invbool_7.Inverted)
panel_608 = Panel(join_68)
mesh_13 = Mesh(simplify(graft(cull_36)))
panel_609 = Panel(mesh_13)

# ---- group: Schnittgenerierung (continued)
mmx = MeshMesh(MeshA=mesh_12, MeshB=srf_27)
trim_17 = TrimTree(Tree=mmx, Depth=1)
orient = Orient(Geometry=trim_17, Source=pln_3, Target=pl_6)  # -> Geometry, Transform
bang = ExplodeTree(Data=orient.Geometry)  # -> Branch0, Branch1
move_88 = Move(Geometry=bang.Branch1, Motion=Y_7)  # -> Geometry, Transform
move_89 = Move(Geometry=bang.Branch0, Motion=X_3)  # -> Geometry, Transform

data_174 = Data([move_88.Geometry, move_89.Geometry])

# ---- group: Verarbeitung und Ausgabe (continued)
data_175 = Data(simplify(flatten([data_4, data_174])))

panel_610 = Panel(data_175)

context_bake = ContextBake(Floorplan=data_175)
context_bake_2 = ContextBake(Geometry=mesh_13)
context_print = ContextPrint(Text=join_68)

# ==== cluster FensterGenerator
kurven_himmelsrichtung = ClusterInput()
kurven_himmelsrichtung_2 = Curve(kurven_himmelsrichtung)
panel = Panel("Dicke Wandaufbau Innenände")
end = EndPoints(Curve=kurven_himmelsrichtung_2)  # -> Start, End
panel_2 = Panel("Punkte Innenwände")
panel_3 = Panel("Dicke Wandaufbau")
num = ClusterInput()
pt = ClusterInput()
num_2 = ClusterInput()
pt_2 = Point([end.Start, end.End])
num_3 = Number(num)
pt_3 = Point(pt)
num_4 = Number(num_2)
sph = Sphere(Base=pt_2, Radius=num_3)
sph_2 = Sphere(Base=pt_3, Radius=num_4)
wwr_himmelsrichtung = ClusterInput()
data = Data(flatten([sph, sph_2]))
maximalhöhe_fester_tür = ClusterInput()
panel_4 = Panel("Augenhöhe")
trim = TrimWithBreps(Curve=kurven_himmelsrichtung_2, Brep=data)  # -> Inside, graft(Outside)
mindestbreite_fenster = Slider(0.6, range=-0.3..0.7)
crv = Curve(trim.Outside)
wwr_himmelsrichtung_2 = Number(wwr_himmelsrichtung)
maximalhöhe_fester_tür_2 = Number(maximalhöhe_fester_tür)
num_5 = Number("1.6")
len = Length(Curve=crv)
subtraction = Subtraction(A=maximalhöhe_fester_tür_2, B=num_5)
graph = GraphMapper(wwr_himmelsrichtung_2, x0=0, x1=1, y0=0, y1=1, container_name="Bezier", cpx=[0, 0, 0.4891056716, 1], cpy=[0, 0, 1, 1])
graph_2 = GraphMapper(
    wwr_himmelsrichtung_2,
    x0=0,
    x1=1,
    y0=0,
    y1=1,
    container_name="Bezier",
    cpx=[0, 0.7343276143, 0, 1],
    cpy=[0, 0.2606632113, 0.6169146299, 1])
larger = LargerThan(FirstNumber=len, SecondNumber=mindestbreite_fenster)  # -> LargerThan, OrEqualTo
subtraction_2 = Subtraction(A=maximalhöhe_fester_tür_2, B=subtraction)
cull = CullPattern(List=crv, CullPattern=larger.LargerThan)
cull_2 = CullPattern(List=len, CullPattern=larger.LargerThan)
maximalbreite_fenster = Slider(2, range=0..10)
num_6 = Number(graph_2)
remap = RemapNumbers(Value=cull_2, Source=Domain(0, 1), Target=graph)  # -> Mapped, Clipped
graph_3 = GraphMapper(num_6, x0=0, x1=1, y0=0, y1=1, A=0, B=1, container_name="Linear", Graph_x0=0, Graph_x1=1, Graph_y0=1, Graph_y1=1)
graph_4 = GraphMapper(num_6, x0=0, x1=1, y0=0, y1=1, container_name="Bezier", cpx=[0, 0, 0.1790605038, 1], cpy=[0, 0, 0.6775124073, 1])
division = Division(A=remap.Mapped, B=maximalbreite_fenster)
round = Round(Number=division)  # -> Nearest, Floor, Ceiling
remap_2 = RemapNumbers(Value=subtraction_2, Source=Domain(0, 1), Target=graph_4)  # -> Mapped, Clipped
remap_3 = RemapNumbers(Value=subtraction, Source=Domain(0, 1), Target=graph_3)  # -> Mapped, Clipped
addition = Addition(A=remap_2.Mapped, B=remap_3.Mapped)
# Anzahl Fenster der Seite
anzahl_fenster_der_seite = Number(round.Ceiling)
panel_5 = Panel(round.Ceiling)
Z = UnitZ(Factor=remap_3.Mapped)
panel_6 = Panel("Einzelkurven der Himmelsrichtung")
num_7 = Number(addition)
division_2 = Division(A=remap.Mapped, B=round.Ceiling)
crv_2 = Curve(cull)
divide = DivideCurve(Curve=crv_2, Count=anzahl_fenster_der_seite, Kinks=False)  # -> Points, Tangents, Parameters
multiplication = Multiplication(A=num_7, B=remap.Mapped)
multiplication_2 = Multiplication(A=len, B=maximalhöhe_fester_tür_2)
item = ListItem(List=divide.Tangents, Index=Slider(0, range=0..100), Wrap=True)
shatter = Shatter(Curve=graft(crv_2), Parameters=divide.Parameters)
division_3 = Division(A=multiplication, B=multiplication_2)
midpt = CurveMiddle(Curve=shatter)
Z_2 = UnitZ(Factor=num_5)
wwr_actual = Number(division_3)
move = Move(Geometry=midpt, Motion=Z_2)  # -> Geometry, Transform
panel_8 = Panel(wwr_actual)
multiplication_3 = Multiplication(A=division_2, B=item)
panel_9 = Panel("WWR Actual")
Z_3 = UnitZ(Factor=1)
multiplication_4 = Multiplication(A="-0.5", B=multiplication_3)
extr = Extrude(Base=shatter, Direction=Z_3)
move_2 = Move(Geometry=move.Geometry, Motion=multiplication_4)  # -> Geometry, Transform
md_slider = MDSlider(SliderMode=0, slider_value=Point(0.5, 0.5, 0.5), x_domain=Domain(0, 1), y_domain=Domain(0, 1), z_domain=Domain(0, 1))
evalsrf = EvaluateSurface(Surface=reparameterize(extr), Point=md_slider)  # -> Point, Normal, UDirection, VDirection, Frame
vec = Vector(item)
pl = ConstructPlane(Origin=move_2.Geometry, XAxis=item, YAxis=evalsrf.Normal)
num_8 = ClusterInput()
panel_10 = Panel("Dicke Wandaufbau gesamt")
num_9 = Number(num_8)
rectangle = Rectangle(Plane=pl, XSize=division_2, YSize=num_9, Radius=0)  # -> Rectangle, Length
panel_11 = Panel("Höhe über Auenhöhe")
move_3 = Move(Geometry=rectangle.Rectangle, Motion=Z)  # -> Geometry, Transform
move_4 = Move(Geometry=move_2.Geometry, Motion=Z)  # -> Geometry, Transform
panel_12 = Panel("Höhe Fenster Gesamt")
clean = CleanTree(RemoveNulls=True, RemoveInvalid=True, RemoveEmpty=Toggle(True), Tree=move_3.Geometry)
neg = Negative(Value=num_7)
boxrec = BoxRectangle(Rectangle=clean, Height=neg)
B = ClusterOutput(boxrec)
panel_13 = Panel("Breite Fenster")
num_10 = Number(division_2)
item_2 = ListItem(List=divide.Tangents, Index="1", Wrap=True)
multiplication_5 = Multiplication(A=num_10, B="0.5")
item_3 = ListItem(List=vec, Index="1", Wrap=True)
multiplication_6 = Multiplication(A=multiplication_5, B=item_2)
item_4 = ListItem(List=evalsrf.Normal, Index="1", Wrap=True)
move_5 = Move(Geometry=move_4.Geometry, Motion=multiplication_6)  # -> Geometry, Transform
vec_2 = Vector(item_3)
panel_16 = Panel("Fenster Höhe")
cullpt = CullDuplicates(Points=move_5.Geometry, Tolerance=0.1, CullMode=3)  # -> Points, Indices, Valence
multiplication_7 = Multiplication(A=vec_2, B=num_10)
num_11 = Number(num_7)
num_12 = Number(num_9)
pt_4 = Point(cullpt.Points)
neg_2 = Negative(Value=num_11)
multiplication_8 = Multiplication(A=item_4, B=num_12)
Z_4 = UnitZ(Factor=neg_2)
multiplication_9 = Multiplication(A=multiplication_7, B="0.5")
multiplication_10 = Multiplication(A=multiplication_7, B="-0.5")
panel_17 = Panel("Innere Ecken Oben")
panel_18 = Panel("Innere Ecken Unten")
move_6 = Move(Geometry=pt_4, Motion=multiplication_9)  # -> graft(Geometry), Transform
move_7 = Move(Geometry=pt_4, Motion=multiplication_10)  # -> graft(Geometry), Transform
move_8 = Move(Geometry=move_7.Geometry, Motion=Z_4)  # -> Geometry, Transform
move_9 = Move(Geometry=move_6.Geometry, Motion=Z_4)  # -> Geometry, Transform
panel_19 = Panel("Äußere Ecken Oben")
panel_20 = Panel("Äußere Ecken Unten")
move_10 = Move(Geometry=move_6.Geometry, Motion=multiplication_8)  # -> Geometry, Transform
move_11 = Move(Geometry=move_10.Geometry, Motion=Z_4)  # -> Geometry, Transform
move_12 = Move(Geometry=move_7.Geometry, Motion=multiplication_8)  # -> Geometry, Transform
move_13 = Move(Geometry=move_12.Geometry, Motion=Z_4)  # -> Geometry, Transform
panel_21 = Panel(move_11.Geometry)
pline = PolyLine(Vertices=[move_9.Geometry, move_11.Geometry, move_13.Geometry, move_8.Geometry], Closed=Toggle(True))
pline_2 = PolyLine(Vertices=[move_6.Geometry, move_7.Geometry, move_12.Geometry, move_10.Geometry], Closed=Toggle(True))
pline_3 = PolyLine(Vertices=[move_6.Geometry, move_10.Geometry, move_11.Geometry, move_9.Geometry], Closed=Toggle(True))
pline_4 = PolyLine(Vertices=[move_12.Geometry, move_7.Geometry, move_8.Geometry, move_13.Geometry], Closed=Toggle(True))
fpatch = FragmentPatch(Boundary=pline)
fpatch_2 = FragmentPatch(Boundary=pline_2)
fpatch_3 = FragmentPatch(Boundary=pline_3)
fpatch_4 = FragmentPatch(Boundary=pline_4)
panel_22 = Panel("Tangente Vektor")
panel_23 = Panel("Dicke Rahmen")
panel_24 = Panel("Oben")
panel_25 = Panel("Unten")
panel_26 = Panel("1")
panel_27 = Panel("2")
vec_3 = Vector(vec)
item_5 = ListItem(List=vec_3, Index="1", Wrap=True)
dicke_rahmen = Slider(0.03, range=0..0.1)
num_13 = Number(dicke_rahmen)
neg_3 = Negative(Value=num_13)
Z_5 = UnitZ(Factor=neg_3)
move_14 = Move(Geometry=move_7.Geometry, Motion=Z_5)  # -> Geometry, Transform
move_15 = Move(Geometry=move_6.Geometry, Motion=Z_5)  # -> Geometry, Transform
join = BrepJoin(Breps=[fpatch, fpatch_3, fpatch_4, pline_2])  # -> Breps, Closed
multiplication_11 = Multiplication(A=item_5, B=dicke_rahmen)
panel_29 = Panel("Dicke Fußplatte")
vec_4 = Vector(multiplication_11)
offsetbrep = OffsetBrep(Brep=join.Breps, OffsetDistance=dicke_rahmen, Solid=Toggle(True), SharpEdges=True, Tolerance=0.01)
rev = Reverse(Vector=vec_4)
output_fensterrahmen = Data(offsetbrep)
num_14 = Number(dicke_rahmen)
num_15 = Number(dicke_rahmen)
move_16 = Move(Geometry=move_15.Geometry, Motion=rev)  # -> Geometry, Transform
move_17 = Move(Geometry=move_14.Geometry, Motion=vec_4)  # -> Geometry, Transform
num_16 = Number(num_11)
output_fensterrahmen_2 = ClusterOutput(output_fensterrahmen)
addition_2 = Addition(A=num_14, B=num_15)
subtraction_3 = Subtraction(A=num_16, B=addition_2)
panel_31 = Panel("Fensterscheibe Grundform")
neg_4 = Negative(Value=subtraction_3)
Z_6 = UnitZ(Factor=neg_4)
move_18 = Move(Geometry=move_16.Geometry, Motion=Z_6)  # -> Geometry, Transform
move_19 = Move(Geometry=move_17.Geometry, Motion=Z_6)  # -> Geometry, Transform
pline_5 = PolyLine(Vertices=[move_17.Geometry, move_16.Geometry, move_18.Geometry, move_19.Geometry], Closed=Toggle(True))
fpatch_5 = FragmentPatch(Boundary=pline_5)
panel_32 = Panel("Normal Vektor Wand")
vec_5 = Vector(evalsrf.Normal)
num_17 = Number(num_9)
item_6 = ListItem(List=vec_5, Index="1", Wrap=True)
multiplication_12 = Multiplication(A=num_17, B=Slider(0.5, range=0..1))
multiplication_13 = Multiplication(A=item_6, B=multiplication_12)
move_20 = Move(Geometry=fpatch_5, Motion=multiplication_13)  # -> Geometry, Transform
G = ClusterOutput(move_20.Geometry)
offsrf = OffsetSurface(Surface=move_20.Geometry, Distance=Slider(0.05, range=0..0.1), BothSides=0, CreateSolid=True)
output_glas = Data(offsrf)
output_glas_2 = ClusterOutput(output_glas)
